# Grasshopper definition Lect2_Curv.gh (Grasshopper 1.0.7)

number_slider = Slider(-714, range=-1000..50)
pt = ConstructPoint(XCoordinate=number_slider, YCoordinate=0, ZCoordinate=0)

# ---- group: Sine
series = Series(Start=0, Step=Slider(7, range=0..100), Count=Slider(224, range=0..300))
rad = Radians(Degrees=series)
sin = Sine(Value=rad)
multiplication = Multiplication(A=sin, B=Slider(234, range=0..300))
pt_2 = ConstructPoint(XCoordinate=series, YCoordinate=multiplication, ZCoordinate=0)
viewer = ParamViewer(pt_2)
intcrv = Interpolate(Vertices=pt_2, Degree=3, Periodic=False, KnotStyle=1)  # -> Curve, Length, Domain
panel = Panel(pt_2)

# ----
number_slider_2 = Slider(234, range=0..300)
series_2 = Series(Start=0, Step=Slider(7, range=0..100), Count=Slider(224, range=0..300))
number_slider_3 = Slider(33, range=0..100)
rad_2 = Radians(Degrees=series_2)

# ---- group: Point to Point
# Straight line
number_slider_4 = Slider(7, range=0..50)
pt_3 = ConstructPoint(XCoordinate=number_slider, YCoordinate=number_slider_4, ZCoordinate=0)
ln = Line(StartPoint=pt, EndPoint=pt_3)

# ----
multiplication_2 = Multiplication(A=number_slider_2, B="2")
sin_2 = Sine(Value=rad_2)

# ---- group: Point direction
X = UnitX(Factor=1)
Y = UnitY(Factor=1)
Z = UnitZ(Factor=1)
line = LineSDL(Start=pt, Direction=[X, Y, Z], Length=Slider(38, range=1..1000))

# ---- group: circle w/ Plane
# Circle
xy = XYPlane(Origin=pt)
yz = YZPlane(Origin=pt)
xz = XZPlane(Origin=pt)
cir = Circle(Plane=[xy, yz, xz], Radius=number_slider_3)

# ---- group: CNR Circle
Y_2 = UnitY(Factor=1)
X_2 = UnitX(Factor=1)
Z_2 = UnitZ(Factor=1)
circle = CircleCNR(Center=xy, Normal=[Z_2, Y_2, X_2], Radius=number_slider_3)

# ----
series_3 = Series(Start=0, Step=multiplication_2, Count=Slider(10, range=0..30))
multiplication_3 = Multiplication(A=sin_2, B=number_slider_2)
Y_3 = UnitY(Factor=series_3)
pt_4 = ConstructPoint(XCoordinate=series_2, YCoordinate=multiplication_3, ZCoordinate=0)
group = Group(Objects=pt_4)
viewer_2 = ParamViewer(pt_4)
move = Move(Geometry=group, Motion=Y_3)  # -> Geometry, Transform
ungroup = Ungroup(Group=move.Geometry)  # -> flatten(Objects)
viewer_3 = ParamViewer(ungroup)
pline = PolyLine(Vertices=ungroup, Closed=False)
