# Grasshopper definition Lect1_PT.gh (Grasshopper 1.0.7)

series = Series(Start=0, Step=Slider(26, range=0..100), Count=Slider(38, range=0..100))
rad = Radians(Degrees=series)
sin = Sine(Value=rad)
multiplication = Multiplication(A=sin, B=Slider(98, range=0..100))
pt = ConstructPoint(XCoordinate=series, YCoordinate=multiplication, ZCoordinate=0)
