# Grasshopper definition MBS-Panelize-MainRoof.gh (Grasshopper 1.0.7)
# plug-ins: HFTidyCanvas

maximum_height_m = Panel("1.5")
gapbtwvert_m = Panel("0.05")
gapbtwhoriz_m = Panel("0.07")
maximum_width_m = Panel("2.5")
gapbtwslant_m = Panel("0.07")
srf = Surface(reparameterize(<surface referenced from the Rhino model>))
mainsrf = DataDescription(srf)
gapbtwhoriz = GapBTWHorizM(gapbtwhoriz_m)
gapbtwslant = GapBTWSlantM(gapbtwslant_m)
gapbtwvert = GapBTWVertM(gapbtwvert_m)
mainsrf_2 = MainSrf(mainsrf)
gapbtwhoriz_2 = GapBTWHoriz(gapbtwhoriz)
gapbtwslant_2 = GapBTWSlant(gapbtwslant)
gapbtwvert_2 = GapBTWVert(gapbtwvert)
maximum_height_m_2 = MaximumWidth(maximum_height_m)
maximum_width_m_2 = MaximumWidth(maximum_width_m)

# ----
# 01. Check Surface
untrim = Untrim(Surface=mainsrf_2)

# ----
# 02. Get Longest Edge
mainsrf_3 = Curve(mainsrf_2)
disc = Discontinuity(Curve=mainsrf_3, Level=1)  # -> Points, Parameters
shatter = Shatter(Curve=mainsrf_3, Parameters=disc.Parameters)
sort = SortList(Keys=shatter, ValuesA=shatter)  # -> Keys, ValuesA
item = ListItem(List=sort.ValuesA, Index="-1", Wrap=True)
longest_edge = DataDescription(item)

# ----
# 03. Let each segement under Maximum Width
# - To satisfy fabrication condition
maximum_width_m_3 = MaximumWidth(maximum_width_m_2)
longest_edge_2 = LongestEdge(longest_edge)
len = Length(Curve=longest_edge_2)
division = Division(A=len, B=maximum_width_m_3)
round = Round(Number=division)  # -> Nearest, Floor, Ceiling
divide = DivideCurve(Curve=longest_edge_2, Count=round.Ceiling, Kinks=False)  # -> Points, Tangents, Parameters
primary_edge_points = DataDescription(divide.Points)
primary_edge_points_2 = Points(primary_edge_points)
pline = PolyLine(Vertices=primary_edge_points_2, Closed=False)
explode = Explode(Curve=pline, Recursive=True)  # -> Segments, Vertices
len_2 = Length(Curve=explode.Segments)
sort_2 = SortList(Keys=len_2)  # -> Keys, ValuesA
maximum_width_m_4 = MaximumWidth(maximum_width_m_2)
item_2 = ListItem(List=reverse(sort_2.Keys), Index=0, Wrap=True)
panel = Panel(item_2)
panel_2 = Panel(maximum_width_m_4)

# ----
# 04. Get rib direction curves
# 04.01 Check curves direction
primary_edge_points_3 = Points(primary_edge_points)
mainsrf_4 = MainSrf(mainsrf)
srf_cp = SurfaceClosestPoint(Point=primary_edge_points_3, Surface=mainsrf_4)  # -> Point, UVPoint, Distance
iso = IsoCurve(Surface=mainsrf_4, UVPoint=srf_cp.UVPoint)  # -> UIsocurve, VIsocurve
rib_direction_curves = DataDescription(iso.VIsocurve)
curvepoint = PointOnCurve(rib_direction_curves, parameter=0.478)

# ----
# 05. Get Primary Points
rib_direction_curves_2 = RibDirectionCurves(rib_direction_curves)
maximum_height_m_3 = MaximumHeightM(maximum_height_m_2)
len_3 = Length(Curve=flatten(rib_direction_curves_2))
sort_3 = SortList(Keys=len_3)  # -> Keys, ValuesA
item_3 = ListItem(List=reverse(sort_3.Keys), Index=0, Wrap=True)
longest_rib_curve_length = DataDescription(item_3)
division_2 = Division(A=longest_rib_curve_length, B=maximum_height_m_3)
round_2 = Round(Number=division_2)  # -> Nearest, Floor, Ceiling
divide_2 = DivideCurve(Curve=rib_direction_curves_2, Count=round_2.Floor, Kinks=False)  # -> simplify(Points), Tangents, Parameters
primary_points = DataDescription(divide_2.Points)

# ----
# 06. Gropuing Points Even/Odd Rows
# and then Re-order
primary_points_2 = PrimaryPoints(primary_points)
tstat = TreeStatistics(Tree=primary_points_2)  # -> Paths, Length, Count
cull_i = CullIndex(List=tstat.Paths, Indices="-1", Wrap=True)
cull_i_2 = CullIndex(List=tstat.Paths, Indices="0", Wrap=True)
branch = TreeBranch(Tree=primary_points_2, Path=cull_i_2, MaintainPaths=True)
branch_2 = TreeBranch(Tree=primary_points_2, Path=cull_i, MaintainPaths=True)
path_mapper = PathMapper(branch, source="{A}", target="{A-1}")
graft = GraftTree(Tree=path_mapper, IncludeEmptyLists=True, IncludeNullItems=True)
graft_2 = GraftTree(Tree=branch_2, IncludeEmptyLists=True, IncludeNullItems=True)
merge = Merge(Data1=graft_2, Data2=graft)
group = Group(Objects=merge)
trim = TrimTree(Tree=group, Depth=1)
cull_i_3 = CullIndex(List=trim, Indices="-1", Wrap=True)
cull_i_4 = CullIndex(List=trim, Indices="0", Wrap=True)
graft_3 = GraftTree(Tree=cull_i_3, IncludeEmptyLists=True, IncludeNullItems=True)
graft_4 = GraftTree(Tree=cull_i_4, IncludeEmptyLists=True, IncludeNullItems=True)
merge_2 = Merge(Data1=graft_3, Data2=graft_4)
group_2 = Group(Objects=merge_2)  # -> simplify(Group)
trim_2 = TrimTree(Tree=group_2, Depth=1)
ungroup = Ungroup(Group=trim_2)
ungroup_2 = Ungroup(Group=ungroup)
trim_3 = TrimTree(Tree=ungroup_2, Depth=1)
item_4 = ListItem(List=trim_3, Index=0, Wrap=True)  # -> Item, Item1, Item2, Item3
merge_3 = Merge(Data1=item_4.Item, Data2=item_4.Item1, Data3=item_4.Item3, Data4=item_4.Item2)
pline_2 = PolyLine(Vertices=trim_3, Closed=False)

clockwiseorderedpoints = DataDescription(merge_3)

pline_3 = PolyLine(Vertices=clockwiseorderedpoints, Closed=False)

# ----
# 07. Re-group for 2 patterns
clockwiseorderedpoints_2 = ClockwiseOrderedPoints(clockwiseorderedpoints)
group_3 = Group(Objects=clockwiseorderedpoints_2)
trim_4 = TrimTree(Tree=group_3, Depth=1)
tstat_2 = TreeStatistics(Tree=trim_4)  # -> Paths, Length, Count
dispatch = Dispatch(List=tstat_2.Paths, DispatchPattern=[True, False])  # -> ListA, ListB
branch_3 = TreeBranch(Tree=trim_4, Path=dispatch.ListA, MaintainPaths=True)
branch_4 = TreeBranch(Tree=trim_4, Path=dispatch.ListB, MaintainPaths=True)
dispatch_2 = Dispatch(List=branch_4, DispatchPattern=[True, False])  # -> ListA, ListB
dispatch_3 = Dispatch(List=branch_3, DispatchPattern=[True, False])  # -> ListA, ListB
merge_4 = Merge(Data1=dispatch_3.ListA, Data2=dispatch_2.ListB)
merge_5 = Merge(Data1=dispatch_3.ListB, Data2=dispatch_2.ListA)
righttoppattern = DataDescription(merge_5)
lefttoppattern = DataDescription(merge_4)

# ----
# 07. Re-group points for 2 patterns and
# Panelize with 2 patterns
# double click here if you want a triagle shape
lefttoppattern_2 = LeftTopPattern(lefttoppattern)
righttoppattern_2 = RightTopPattern(righttoppattern)
ungroup_3 = Ungroup(Group=righttoppattern_2)
ungroup_4 = Ungroup(Group=lefttoppattern_2)
item_5 = ListItem(List=ungroup_3, Index=0, Wrap=True)  # -> Item, Item1, Item2, Item3
item_6 = ListItem(List=ungroup_4, Index=0, Wrap=True)  # -> Item, Item1, Item2, Item3
toggle = BooleanToggle(True)
merge_6 = Merge(Data1=item_5.Item1, Data2=item_5.Item2, Data3=item_5.Item3)
merge_7 = Merge(Data1=item_6.Item, Data2=item_6.Item1, Data3=item_6.Item2)
merge_8 = Merge(Data1=item_6.Item2, Data2=item_6.Item3, Data3=item_6.Item)
merge_9 = Merge(Data1=item_5.Item3, Data2=item_5.Item, Data3=item_5.Item1)
pline_4 = PolyLine(Vertices=merge_7, Closed=toggle)
pline_5 = PolyLine(Vertices=merge_8, Closed=toggle)
pline_6 = PolyLine(Vertices=merge_9, Closed=toggle)
pline_7 = PolyLine(Vertices=merge_6, Closed=toggle)
trim_5 = TrimTree(Tree=pline_7, Depth=1)
trim_6 = TrimTree(Tree=pline_4, Depth=1)
trim_7 = TrimTree(Tree=pline_5, Depth=1)
trim_8 = TrimTree(Tree=pline_6, Depth=1)
merge_10 = Merge(Data1=trim_8, Data2=trim_5)
merge_11 = Merge(Data1=trim_6, Data2=trim_7)
patternb = DataDescription(merge_10)
patterna = DataDescription(merge_11)

patterna_2 = PatternA(patterna)

# ----
# 08. Generate gap btw Panels
gapbtwhoriz_3 = GapBTWHoriz(gapbtwhoriz)
gapbtwvert_3 = GapBTWVert(gapbtwvert)
gapbtwslant_3 = GapBTWSlant(gapbtwslant)
patternb_2 = PatternB(patternb)
merge_12 = Merge(Data1=gapbtwhoriz_3, Data2=gapbtwvert_3, Data3=gapbtwslant_3)
merge_13 = Merge(Data1=gapbtwvert_3, Data2=gapbtwhoriz_3, Data3=gapbtwslant_3)
area = Area(Geometry=patterna_2)  # -> Area, Centroid
area_2 = Area(Geometry=patternb_2)  # -> Area, Centroid
horizvertslantgap = DataDescription(merge_12)
verthorizslantgap = DataDescription(merge_13)
explode_2 = Explode(Curve=patterna_2, Recursive=True)  # -> Segments, Vertices
graft_5 = GraftTree(Tree=area.Centroid, IncludeEmptyLists=True, IncludeNullItems=True)
explode_3 = Explode(Curve=patternb_2, Recursive=True)  # -> Segments, Vertices
graft_6 = GraftTree(Tree=area_2.Centroid, IncludeEmptyLists=True, IncludeNullItems=True)
crv_cp = CurveClosestPoint(Point=graft_5, Curve=explode_2.Segments)  # -> Point, Parameter, Distance
crv_cp_2 = CurveClosestPoint(Point=graft_6, Curve=explode_3.Segments)  # -> Point, Parameter, Distance
ln = Line(StartPoint=crv_cp.Point, EndPoint=graft_5)
ln_2 = Line(StartPoint=crv_cp_2.Point, EndPoint=graft_6)
vectorasline = DataDescription(ln)
vectorasline_2 = DataDescription(ln_2)
vec = Vector(unitize(vectorasline))
vec_2 = Vector(unitize(vectorasline_2))
division_3 = Division(A=horizvertslantgap, B="2")
division_4 = Division(A=verthorizslantgap, B="2")
amp = Amplitude(Vector=vec, Amplitude=division_3)
amp_2 = Amplitude(Vector=vec_2, Amplitude=division_4)
move = Move(Geometry=explode_2.Segments, Motion=amp)  # -> Geometry, Transform
move_2 = Move(Geometry=explode_3.Segments, Motion=amp_2)  # -> Geometry, Transform
item_7 = ListItem(List=move.Geometry, Index=0, Wrap=True)  # -> Item, Item1, Item2
item_8 = ListItem(List=move_2.Geometry, Index=0, Wrap=True)  # -> Item, Item1, Item2
ccx = CurveCurve(CurveA=item_7.Item1, CurveB=item_7.Item2)  # -> Points, ParamsA, ParamsB
ccx_2 = CurveCurve(CurveA=item_7.Item, CurveB=item_7.Item2)  # -> Points, ParamsA, ParamsB
ccx_3 = CurveCurve(CurveA=item_7.Item, CurveB=item_7.Item1)  # -> Points, ParamsA, ParamsB
ccx_4 = CurveCurve(CurveA=item_8.Item1, CurveB=item_8.Item2)  # -> Points, ParamsA, ParamsB
ccx_5 = CurveCurve(CurveA=item_8.Item, CurveB=item_8.Item2)  # -> Points, ParamsA, ParamsB
ccx_6 = CurveCurve(CurveA=item_8.Item, CurveB=item_8.Item1)  # -> Points, ParamsA, ParamsB
merge_14 = Merge(Data1=ccx_2.Points, Data2=ccx_3.Points, Data3=ccx.Points)
merge_15 = Merge(Data1=ccx_5.Points, Data2=ccx_6.Points, Data3=ccx_4.Points)
pline_8 = PolyLine(Vertices=merge_14, Closed=invert(False))  # -> simplify(Polyline)
pline_9 = PolyLine(Vertices=merge_15, Closed=invert(False))  # -> simplify(Polyline)
trim_9 = TrimTree(Tree=pline_8, Depth=1)
trim_10 = TrimTree(Tree=pline_9, Depth=1)
patternawgap = DataDescription(trim_9)
patternbwgap = DataDescription(trim_10)

# ----
# 09. Reconstruct Trees
patternawgap_2 = PatternAWGap(patternawgap)
patternbwgap_2 = PatternBWGap(patternbwgap)
tstat_3 = TreeStatistics(Tree=patternawgap_2)  # -> Paths, Length, Count
tstat_4 = TreeStatistics(Tree=patternbwgap_2)  # -> Paths, Length, Count
dispatch_4 = Dispatch(List=tstat_3.Paths, DispatchPattern=[True, False])  # -> ListA, ListB
dispatch_5 = Dispatch(List=tstat_4.Paths, DispatchPattern=[True, False])  # -> ListA, ListB
branch_5 = TreeBranch(Tree=patternawgap_2, Path=dispatch_4.ListA, MaintainPaths=True)
branch_6 = TreeBranch(Tree=patternawgap_2, Path=dispatch_4.ListB, MaintainPaths=True)
branch_7 = TreeBranch(Tree=patternbwgap_2, Path=dispatch_5.ListA, MaintainPaths=True)
branch_8 = TreeBranch(Tree=patternbwgap_2, Path=dispatch_5.ListB, MaintainPaths=True)
merge_16 = Merge(Data1=branch_5, Data2=branch_7, Data3=branch_6, Data4=branch_8)
reorderedpanel = DataDescription(merge_16)
