# Grasshopper definition HC_Changi.gh (Grasshopper 1.0.7)
# plug-ins: EleFront

panel = Panel("""DRV::DRV-SRF
DRV::DRV-CRV""")
reference_by_layer = ReferenceByLayer(LayerName=panel)
explode_tree = ExplodeTree(Data=reference_by_layer)  # -> Branch0, Branch1
get_rhino_attributes = GetRhinoAttributes(Geometry=explode_tree.Branch1)  # -> Name, Layer, Color
sort_text = SortText(Keys=get_rhino_attributes.Name, Values=explode_tree.Branch1, Culture=127)  # -> Keys, Values
match_text = MatchText(Text=sort_text.Keys, Pattern="L*", Case=True)
maximumpanelheight = Panel("2")
multiplication = Multiplication(A=maximumpanelheight, B=2)
dispatch = Dispatch(List=sort_text.Keys, DispatchPattern=match_text)  # -> ListA, ListB
dispatch_2 = Dispatch(List=sort_text.Values, DispatchPattern=match_text)  # -> ListA, ListB
panel_2 = Panel(dispatch.ListB)
list_item = ListItem(List=dispatch_2.ListB, Index=0, Wrap=True)  # -> Item, Item1, Item2, Item3
list_item_2 = ListItem(List=dispatch_2.ListB, Index="2", Wrap=True)
list_item_3 = ListItem(List=dispatch_2.ListA, Index="1", Wrap=True)
merge = Merge(Data1=list_item.Item1, Data2=list_item.Item3, Data3=list_item.Item, Data4=list_item.Item2)
end_points = EndPoints(Curve=list_item_3)  # -> Start, End
area = Area(Geometry=list_item_2)  # -> Area, Centroid
xy_plane = XYPlane(Origin=end_points.Start)
maximumpanelwidth = Panel("3")
brep_plane = BrepPlane(Brep=explode_tree.Branch0, Plane=xy_plane)  # -> Curves, Points
transitionrow = Panel("""0
12
17
26""")
division = Division(A=maximumpanelwidth, B=2)
length = Length(Curve=brep_plane.Curves)
division_2 = Division(A=length, B=division)
cull_index = CullIndex(List=transitionrow, Indices="-1", Wrap=True)
cull_index_2 = CullIndex(List=transitionrow, Indices="0", Wrap=True)
round = Round(Number=division_2)  # -> Nearest, Floor, Ceiling
list_item_4 = ListItem(List=transitionrow, Index=0, Wrap=True)  # -> Item, Item1, Item2, Item3
modulus = Modulus(A=round.Ceiling, B="2")
expression = Expression(x=modulus, Expression="if(x=0,0,1)")
addition = Addition(A=round.Ceiling, B=expression)
log_n = LogN(Number=addition, Base="10")
log_n_2 = LogN(Number="2", Base="10")
division_3 = Division(A=log_n, B=log_n_2)
round_2 = Round(Number=division_3)  # -> Nearest, Floor, Ceiling
power_of_2 = PowerOf2(Value=round_2.Ceiling)
division_4 = Division(A="1", B=power_of_2)
addition_2 = Addition(A=power_of_2, B="1")
series = Series(Start=0, Step=division_4, Count=power_of_2)
evaluate_curve = EvaluateCurve(Curve=reparameterize(brep_plane.Curves), Parameter=series)  # -> Point, Tangent, Angle
project = Project(Geometry=area.Centroid, Plane=PlaneXY(0, 0, 0))  # -> Geometry, Transform
project_2 = Project(Geometry=evaluate_curve.Point, Plane=PlaneXY(0, 0, 0))  # -> Geometry, Transform
line = Line(StartPoint=project.Geometry, EndPoint=project_2.Geometry)
extend_curve = ExtendCurve(Curve=line, Type=0, Start="0", End="100")
unit_z = UnitZ(Factor="-0.01")
move = Move(Geometry=extend_curve, Motion=unit_z)  # -> Geometry, Transform
unit_z_2 = UnitZ(Factor="50")
extrude = Extrude(Base=move.Geometry, Direction=unit_z_2)
brep_brep = BrepBrep(BrepA=explode_tree.Branch0, BrepB=extrude)  # -> simplify(Curves), Points
end_points_2 = EndPoints(Curve=brep_brep.Curves)  # -> Start, End
deconstruct = Deconstruct(Point=end_points_2.End)  # -> XComponent, YComponent, ZComponent
deconstruct_2 = Deconstruct(Point=end_points_2.Start)  # -> XComponent, YComponent, ZComponent
smaller_than = SmallerThan(FirstNumber=deconstruct_2.ZComponent, SecondNumber=deconstruct.ZComponent)  # -> SmallerThan, OrEqualTo
dispatch_3 = Dispatch(List=brep_brep.Curves, DispatchPattern=smaller_than.SmallerThan)  # -> ListA, ListB
flip_curve = FlipCurve(Curve=dispatch_3.ListB)  # -> Curve, Flag
panel_3 = Panel("""0
-1""")
merge_2 = Merge(Data1=dispatch_3.ListA, Data2=flip_curve.Curve)  # -> simplify(Result)
cull_index_3 = CullIndex(List=merge, Indices=panel_3, Wrap=True)
curve_curve = CurveCurve(CurveA=merge_2, CurveB=cull_index_3)  # -> Points, ParamsA, ParamsB
trim_tree = TrimTree(Tree=curve_curve.ParamsA, Depth=1)
shatter = Shatter(Curve=merge_2, Parameters=trim_tree)
flip_matrix = FlipMatrix(Data=shatter)
sort_list = SortList(Keys=flip_matrix)  # -> reverse(Keys), ValuesValuesA
list_item_5 = ListItem(List=sort_list.Keys, Index=0, Wrap=True)
division_5 = Division(A=list_item_5, B=multiplication)
round_3 = Round(Number=division_5)  # -> Nearest, Floor, Ceiling
flip_matrix_2 = FlipMatrix(Data=round_3.Ceiling)
divide_curve = DivideCurve(Curve=shatter, Count=flip_matrix_2, Kinks=False)  # -> simplify(Points), Tangents, Parameters
trim_tree_2 = TrimTree(Tree=divide_curve.Points, Depth=1)
cull_duplicates = CullDuplicates(Points=trim_tree_2, Tolerance=0.1, CullMode=3)  # -> Points, Indices, Valence
flip_matrix_3 = FlipMatrix(Data=cull_duplicates.Points)
tree_statistics = TreeStatistics(Tree=flip_matrix_3)  # -> Paths, Length, Count
subtraction = Subtraction(A=tree_statistics.Count, B="1")
entwine = Entwine(Branch00=transitionrow, Branch01=subtraction, FlattenInputs=True)  # -> flatten(Result)
mass_addition = MassAddition(Input=entwine)  # -> Result, PartialResults
tree_statistics_2 = TreeStatistics(Tree=flip_matrix_3)  # -> Paths, Length, Count
cull_index_4 = CullIndex(List=entwine, Indices="0", Wrap=True)
cull_index_5 = CullIndex(List=entwine, Indices="-1", Wrap=True)
subtraction_2 = Subtraction(A=cull_index_4, B=cull_index_5)
list_item_6 = ListItem(List=mass_addition.PartialResults, Index=0, Wrap=True)  # -> Item, Item1, Item2, Item3
division_6 = Division(A=tree_statistics_2.Count, B="2")
modulus_2 = Modulus(A=tree_statistics_2.Count, B="2")
tree_statistics_3 = TreeStatistics(Tree=flip_matrix_3)  # -> Paths, Length, Count
construct_domain = ConstructDomain(DomainStart=cull_index_5, DomainEnd=cull_index_4)
boolean = Boolean(invert(modulus_2))
division_7 = Division(A=tree_statistics_3.Count, B="2")
modulus_3 = Modulus(A=tree_statistics_3.Count, B="2")
sub_list = SubList(List=tree_statistics.Paths, Domain=construct_domain, Wrap=True)  # -> List, Index
integer = Integer(boolean)
round_4 = Round(Number=division_7)  # -> Nearest, Floor, Ceiling
round_5 = Round(Number=division_6)  # -> Nearest, Floor, Ceiling
subtraction_3 = Subtraction(A=round_5.Floor, B=integer)
subtraction_4 = Subtraction(A=round_4.Ceiling, B=modulus_3)
flip_matrix_4 = FlipMatrix(Data=sub_list.List)
series_2 = Series(Start=0, Step="2", Count=round_5.Floor)
series_3 = Series(Start="1", Step="2", Count=round_5.Floor)
series_4 = Series(Start="1", Step="2", Count=subtraction_3)
list_item_7 = ListItem(List=flip_matrix_4, Index=0, Wrap=True)  # -> Item, Item1, Item2, Item3
addition_3 = Addition(A=series_4, B=1)
series_5 = Series(Start="2", Step="2", Count=subtraction_4)
series_6 = Series(Start="1", Step="2", Count=round_4.Floor)
list_item_8 = ListItem(List=tree_statistics_2.Paths, Index=series_2, Wrap=True)
list_item_9 = ListItem(List=tree_statistics_2.Paths, Index=series_3, Wrap=True)
panel_4 = Panel(list_item_7.Item1)
list_item_10 = ListItem(List=tree_statistics_2.Paths, Index=series_4, Wrap=True)
list_item_11 = ListItem(List=tree_statistics_2.Paths, Index=addition_3, Wrap=True)
subtraction_5 = Subtraction(A=series_6, B=1)
panel_5 = Panel(list_item_6.Item1)
subtraction_6 = Subtraction(A=series_5, B=1)
tree_branch = TreeBranch(Tree=flip_matrix_3, Path=list_item_7.Item, MaintainPaths=True)  # -> simplify(Branch)
tree_branch_2 = TreeBranch(Tree=flip_matrix_3, Path=list_item_7.Item1, MaintainPaths=True)  # -> simplify(Branch)
tree_branch_3 = TreeBranch(Tree=flip_matrix_3, Path=list_item_7.Item2, MaintainPaths=True)  # -> simplify(Branch)
list_item_12 = ListItem(List=tree_statistics_3.Paths, Index=series_5, Wrap=True)
tree_branch_4 = TreeBranch(Tree=flip_matrix_3, Path=list_item_9, MaintainPaths=True)
tree_branch_5 = TreeBranch(Tree=flip_matrix_3, Path=list_item_8, MaintainPaths=True)
tree_branch_6 = TreeBranch(Tree=flip_matrix_3, Path=list_item_7.Item3, MaintainPaths=True)  # -> simplify(Branch)
list_item_13 = ListItem(List=tree_statistics_3.Paths, Index=subtraction_6, Wrap=True)
list_item_14 = ListItem(List=tree_statistics_3.Paths, Index=series_6, Wrap=True)
modulus_4 = Modulus(A=panel_5, B="2")
tree_branch_7 = TreeBranch(Tree=flip_matrix_3, Path=list_item_10, MaintainPaths=True)
tree_branch_8 = TreeBranch(Tree=flip_matrix_3, Path=list_item_11, MaintainPaths=True)
list_item_15 = ListItem(List=tree_statistics_3.Paths, Index=subtraction_5, Wrap=True)
tree_branch_9 = TreeBranch(Tree=flip_matrix_3, Path=list_item_12, MaintainPaths=True)
tree_branch_10 = TreeBranch(Tree=flip_matrix_3, Path=list_item_13, MaintainPaths=True)
shift_list = ShiftList(List=tree_branch_7, Shift="-1", Wrap=True)
shift_list_2 = ShiftList(List=tree_branch_4, Shift=1, Wrap=True)
tree_branch_11 = TreeBranch(Tree=flip_matrix_3, Path=list_item_14, MaintainPaths=True)
tree_branch_12 = TreeBranch(Tree=flip_matrix_3, Path=list_item_15, MaintainPaths=True)
shift_list_3 = ShiftList(List=tree_branch_4, Shift="-1", Wrap=True)
tree_statistics_4 = TreeStatistics(Tree=tree_branch_2)  # -> Paths, Length, Count
tree_statistics_5 = TreeStatistics(Tree=tree_branch)  # -> Paths, Length, Count
cull_nth = CullNth(List=tree_branch_8, CullFrequency=2)
cull_nth_2 = CullNth(List=shift_list, CullFrequency=2)
shift_list_4 = ShiftList(List=tree_branch_11, Shift=1, Wrap=True)
cull_nth_3 = CullNth(List=tree_branch_5, CullFrequency=2)
shift_list_5 = ShiftList(List=tree_branch_10, Shift=1, Wrap=True)
cull_nth_4 = CullNth(List=shift_list_2, CullFrequency=2)
cull_nth_5 = CullNth(List=shift_list_3, CullFrequency=2)
cull_nth_6 = CullNth(List=tree_branch_12, CullFrequency=2)
split_list = SplitList(List=tree_statistics_4.Paths, Index="1")  # -> ListA, ListB
cull_nth_7 = CullNth(List=shift_list_4, CullFrequency=2)
dispatch_4 = Dispatch(List=tree_statistics_5.Paths, DispatchPattern=[True, False])  # -> ListA, ListB
shift_list_6 = ShiftList(List=cull_nth, Shift="-1", Wrap=True)
shift_list_7 = ShiftList(List=cull_nth_3, Shift="1", Wrap=True)
cull_nth_8 = CullNth(List=tree_branch_9, CullFrequency=2)
cull_nth_9 = CullNth(List=shift_list_5, CullFrequency=2)
shift_list_8 = ShiftList(List=cull_nth_6, Shift=1, Wrap=True)
dispatch_5 = Dispatch(List=split_list.ListB, DispatchPattern=[True, False])  # -> ListA, ListB
shift_list_9 = ShiftList(List=cull_nth_2, Shift=1, Wrap=True)
shift_list_10 = ShiftList(List=cull_nth_7, Shift="-1", Wrap=True)
tree_branch_13 = TreeBranch(Tree=tree_branch, Path=dispatch_4.ListA, MaintainPaths=True)
tree_branch_14 = TreeBranch(Tree=tree_branch, Path=dispatch_4.ListB, MaintainPaths=True)
shift_list_11 = ShiftList(List=cull_nth_8, Shift="1", Wrap=True)
shift_list_12 = ShiftList(List=cull_nth_8, Shift="-1", Wrap=True)
shift_list_13 = ShiftList(List=cull_nth_9, Shift="-1", Wrap=True)
tree_branch_15 = TreeBranch(Tree=tree_branch_2, Path=split_list.ListA, MaintainPaths=True)
addition_4 = Addition(A=modulus_4, B="2")
shift_list_14 = ShiftList(List=tree_branch_14, Shift=1, Wrap=True)

line_2 = Line(StartPoint=cull_nth_2, EndPoint=cull_nth)  # -> simplify(Line)
line_3 = Line(StartPoint=shift_list_6, EndPoint=cull_nth_2)  # -> simplify(Line)
line_4 = Line(StartPoint=shift_list_6, EndPoint=cull_nth)  # -> simplify(Line)

line_5 = Line(StartPoint=cull_nth, EndPoint=cull_nth_2)  # -> simplify(Line)
line_6 = Line(StartPoint=cull_nth_2, EndPoint=shift_list_9)  # -> simplify(Line)
line_7 = Line(StartPoint=shift_list_9, EndPoint=cull_nth)  # -> simplify(Line)

shift_list_15 = ShiftList(List=tree_branch_15, Shift=modulus_4, Wrap=True)
tree_branch_16 = TreeBranch(Tree=tree_branch_2, Path=dispatch_5.ListB, MaintainPaths=True)
tree_branch_17 = TreeBranch(Tree=tree_branch_2, Path=dispatch_5.ListA, MaintainPaths=True)

line_8 = Line(StartPoint=cull_nth_4, EndPoint=cull_nth_3)
line_9 = Line(StartPoint=cull_nth_3, EndPoint=shift_list_7)
line_10 = Line(StartPoint=shift_list_7, EndPoint=cull_nth_4)

line_11 = Line(StartPoint=cull_nth_3, EndPoint=cull_nth_4)  # -> simplify(Line)
line_12 = Line(StartPoint=cull_nth_4, EndPoint=cull_nth_5)  # -> simplify(Line)
line_13 = Line(StartPoint=cull_nth_5, EndPoint=cull_nth_3)  # -> simplify(Line)

cull_nth_10 = CullNth(List=tree_branch_13, CullFrequency=2)  # -> simplify(List)
cull_nth_11 = CullNth(List=shift_list_14, CullFrequency=2)  # -> simplify(List)
shift_list_16 = ShiftList(List=tree_branch_16, Shift=addition_4, Wrap=True)
shift_list_17 = ShiftList(List=tree_branch_17, Shift=modulus_4, Wrap=True)
merge_3 = Merge(Data1=cull_nth_10, Data2=cull_nth_11)
cull_nth_12 = CullNth(List=shift_list_15, CullFrequency=2)
graft_tree = GraftTree(Tree=line_6, IncludeEmptyLists=True, IncludeNullItems=True)  # -> simplify(Tree)
graft_tree_2 = GraftTree(Tree=line_5, IncludeEmptyLists=True, IncludeNullItems=True)  # -> simplify(Tree)
graft_tree_3 = GraftTree(Tree=line_2, IncludeEmptyLists=True, IncludeNullItems=True)  # -> simplify(Tree)
graft_tree_4 = GraftTree(Tree=line_12, IncludeEmptyLists=True, IncludeNullItems=True)  # -> simplify(Tree)
graft_tree_5 = GraftTree(Tree=line_13, IncludeEmptyLists=True, IncludeNullItems=True)  # -> simplify(Tree)
graft_tree_6 = GraftTree(Tree=line_4, IncludeEmptyLists=True, IncludeNullItems=True)  # -> simplify(Tree)
graft_tree_7 = GraftTree(Tree=line_11, IncludeEmptyLists=True, IncludeNullItems=True)  # -> simplify(Tree)
graft_tree_8 = GraftTree(Tree=line_8, IncludeEmptyLists=True, IncludeNullItems=True)  # -> simplify(Tree)
graft_tree_9 = GraftTree(Tree=line_3, IncludeEmptyLists=True, IncludeNullItems=True)  # -> simplify(Tree)
graft_tree_10 = GraftTree(Tree=line_10, IncludeEmptyLists=True, IncludeNullItems=True)  # -> simplify(Tree)
graft_tree_11 = GraftTree(Tree=line_9, IncludeEmptyLists=True, IncludeNullItems=True)  # -> simplify(Tree)
graft_tree_12 = GraftTree(Tree=line_7, IncludeEmptyLists=True, IncludeNullItems=True)  # -> simplify(Tree)
cull_nth_13 = CullNth(List=shift_list_16, CullFrequency=2)  # -> simplify(List)
cull_nth_14 = CullNth(List=shift_list_17, CullFrequency=2)  # -> simplify(List)
join_curves = JoinCurves(Curves=[graft_tree_7, graft_tree_4, graft_tree_5], Preserve=False)
join_curves_2 = JoinCurves(Curves=[graft_tree_3, graft_tree_6, graft_tree_9], Preserve=False)
join_curves_3 = JoinCurves(Curves=[graft_tree_8, graft_tree_11, graft_tree_10], Preserve=False)
join_curves_4 = JoinCurves(Curves=[graft_tree_2, graft_tree, graft_tree_12], Preserve=False)
dispatch_6 = Dispatch(List=cull_nth_12, DispatchPattern=[True, False])  # -> ListA, ListB
cull_nth_15 = CullNth(List=cull_nth_13, CullFrequency=2)  # -> simplify(List)
cull_nth_16 = CullNth(List=cull_nth_14, CullFrequency=2)  # -> simplify(List)

line_14 = Line(StartPoint=cull_nth_8, EndPoint=cull_nth_9)
line_15 = Line(StartPoint=cull_nth_9, EndPoint=shift_list_11)
line_16 = Line(StartPoint=cull_nth_8, EndPoint=shift_list_12)

line_17 = Line(StartPoint=cull_nth_6, EndPoint=cull_nth_7)
line_18 = Line(StartPoint=shift_list_10, EndPoint=cull_nth_6)
line_19 = Line(StartPoint=cull_nth_7, EndPoint=shift_list_10)

line_20 = Line(StartPoint=cull_nth_7, EndPoint=shift_list_8)
line_21 = Line(StartPoint=cull_nth_6, EndPoint=cull_nth_7)
line_22 = Line(StartPoint=shift_list_8, EndPoint=cull_nth_6)

line_23 = Line(StartPoint=cull_nth_8, EndPoint=cull_nth_9)
line_24 = Line(StartPoint=cull_nth_9, EndPoint=shift_list_13)
line_25 = Line(StartPoint=shift_list_13, EndPoint=cull_nth_8)

boundary_surfaces = BoundarySurfaces(Edges=join_curves_4)
boundary_surfaces_2 = BoundarySurfaces(Edges=join_curves_2)
boundary_surfaces_3 = BoundarySurfaces(Edges=join_curves)
boundary_surfaces_4 = BoundarySurfaces(Edges=join_curves_3)
tree_statistics_6 = TreeStatistics(Tree=cull_nth_16)  # -> Paths, Length, Count
merge_4 = Merge(Data1=dispatch_6.ListB, Data2=cull_nth_16, Data3=cull_nth_15)
graft_tree_13 = GraftTree(Tree=line_18, IncludeEmptyLists=True, IncludeNullItems=True)  # -> simplify(Tree)
graft_tree_14 = GraftTree(Tree=line_17, IncludeEmptyLists=True, IncludeNullItems=True)  # -> simplify(Tree)
graft_tree_15 = GraftTree(Tree=line_19, IncludeEmptyLists=True, IncludeNullItems=True)  # -> simplify(Tree)
graft_tree_16 = GraftTree(Tree=line_23, IncludeEmptyLists=True, IncludeNullItems=True)  # -> simplify(Tree)
graft_tree_17 = GraftTree(Tree=line_20, IncludeEmptyLists=True, IncludeNullItems=True)  # -> simplify(Tree)
graft_tree_18 = GraftTree(Tree=line_21, IncludeEmptyLists=True, IncludeNullItems=True)  # -> simplify(Tree)
graft_tree_19 = GraftTree(Tree=line_22, IncludeEmptyLists=True, IncludeNullItems=True)  # -> simplify(Tree)
graft_tree_20 = GraftTree(Tree=line_25, IncludeEmptyLists=True, IncludeNullItems=True)  # -> simplify(Tree)
list_item_16 = ListItem(List=tree_statistics_6.Paths, Index=0, Wrap=True)
graft_tree_21 = GraftTree(Tree=line_24, IncludeEmptyLists=True, IncludeNullItems=True)  # -> simplify(Tree)
graft_tree_22 = GraftTree(Tree=line_14, IncludeEmptyLists=True, IncludeNullItems=True)  # -> simplify(Tree)
graft_tree_23 = GraftTree(Tree=line_15, IncludeEmptyLists=True, IncludeNullItems=True)  # -> simplify(Tree)
graft_tree_24 = GraftTree(Tree=line_16, IncludeEmptyLists=True, IncludeNullItems=True)  # -> simplify(Tree)
tree_branch_18 = TreeBranch(Tree=cull_nth_16, Path=list_item_16, MaintainPaths=True)
join_curves_5 = JoinCurves(Curves=[graft_tree_17, graft_tree_19, graft_tree_18], Preserve=False)  # -> simplify(Curves)
join_curves_6 = JoinCurves(Curves=[graft_tree_14, graft_tree_15, graft_tree_13], Preserve=False)  # -> simplify(Curves)
join_curves_7 = JoinCurves(Curves=[graft_tree_22, graft_tree_23, graft_tree_24], Preserve=False)  # -> simplify(Curves)
join_curves_8 = JoinCurves(Curves=[graft_tree_16, graft_tree_21, graft_tree_20], Preserve=False)  # -> simplify(Curves)
shift_list_18 = ShiftList(List=dispatch_6.ListB, Shift="-1", Wrap=True)
graft_tree_25 = GraftTree(Tree=dispatch_6.ListA, IncludeEmptyLists=True, IncludeNullItems=True)  # -> simplify(Tree)
tree_statistics_7 = TreeStatistics(Tree=merge_3)  # -> Paths, Length, Count
tree_statistics_8 = TreeStatistics(Tree=merge_3)  # -> Paths, Length, Count
graft_tree_26 = GraftTree(Tree=dispatch_6.ListB, IncludeEmptyLists=True, IncludeNullItems=True)  # -> simplify(Tree)
graft_tree_27 = GraftTree(Tree=tree_branch_18, IncludeEmptyLists=True, IncludeNullItems=True)  # -> simplify(Tree)
polyline = PolyLine(Vertices=merge_3, Closed=invert(False))
polyline_2 = PolyLine(Vertices=merge_3, Closed=invert(False))
graft_tree_28 = GraftTree(Tree=shift_list_18, IncludeEmptyLists=True, IncludeNullItems=True)  # -> simplify(Tree)
dispatch_7 = Dispatch(List=tree_statistics_7.Paths, DispatchPattern=[True, False])  # -> ListA, ListB
dispatch_8 = Dispatch(List=tree_statistics_8.Paths, DispatchPattern=[True, False])  # -> ListA, ListB
flip_matrix_5 = FlipMatrix(Data=merge_3)
flip_matrix_6 = FlipMatrix(Data=merge_3)
polyline_3 = PolyLine(Vertices=[graft_tree_25, graft_tree_27, graft_tree_26], Closed=invert(False))
polyline_4 = PolyLine(Vertices=[graft_tree_28, graft_tree_27, graft_tree_25], Closed=invert(False))
tree_branch_19 = TreeBranch(Tree=merge_3, Path=dispatch_8.ListA, MaintainPaths=True)
tree_branch_20 = TreeBranch(Tree=merge_3, Path=dispatch_7.ListA, MaintainPaths=True)
tree_branch_21 = TreeBranch(Tree=merge_3, Path=dispatch_8.ListB, MaintainPaths=True)
tree_branch_22 = TreeBranch(Tree=merge_3, Path=dispatch_7.ListB, MaintainPaths=True)
match_tree = MatchTree(Tree=merge_4, Guide=tree_branch_2)

boundary_surfaces_5 = BoundarySurfaces(Edges=polyline_3)
boundary_surfaces_6 = BoundarySurfaces(Edges=polyline_4)

shift_list_19 = ShiftList(List=tree_branch_20, Shift=1, Wrap=True)  # -> simplify(List)
shift_list_20 = ShiftList(List=tree_branch_21, Shift="-1", Wrap=True)  # -> simplify(List)
explode = Explode(Curve=polyline, Recursive=True)  # -> simplify(Segments), Vertices
explode_2 = Explode(Curve=polyline_2, Recursive=True)  # -> simplify(Segments), Vertices
tree_statistics_9 = TreeStatistics(Tree=match_tree)  # -> Paths, Length, Count
merge_5 = Merge(Data1=shift_list_19, Data2=tree_branch_22)
merge_6 = Merge(Data1=tree_branch_19, Data2=shift_list_20)
dispatch_9 = Dispatch(List=tree_statistics_9.Paths, DispatchPattern=[True, False])  # -> ListA, ListB
flip_matrix_7 = FlipMatrix(Data=merge_5)
flip_matrix_8 = FlipMatrix(Data=merge_6)
shift_list_21 = ShiftList(List=explode_2.Segments, Shift="-1", Wrap=True)
tree_branch_23 = TreeBranch(Tree=match_tree, Path=dispatch_9.ListA, MaintainPaths=True)
polyline_5 = PolyLine(Vertices=flip_matrix_5, Closed=False)
polyline_6 = PolyLine(Vertices=flip_matrix_6, Closed=False)
tree_branch_24 = TreeBranch(Tree=match_tree, Path=dispatch_9.ListB, MaintainPaths=True)
polyline_7 = PolyLine(Vertices=flip_matrix_7, Closed=False)
polyline_8 = PolyLine(Vertices=flip_matrix_8, Closed=False)
flip_matrix_9 = FlipMatrix(Data=shift_list_21)
flip_matrix_10 = FlipMatrix(Data=explode.Segments)
shift_list_22 = ShiftList(List=tree_branch_24, Shift=1, Wrap=True)  # -> simplify(List)
dispatch_10 = Dispatch(List=flip_matrix_9, DispatchPattern=[True, False])  # -> ListA, ListB
explode_3 = Explode(Curve=polyline_5, Recursive=True)  # -> simplify(Segments), Vertices
explode_4 = Explode(Curve=polyline_6, Recursive=True)  # -> simplify(Segments), Vertices
explode_5 = Explode(Curve=polyline_7, Recursive=True)  # -> simplify(Segments), Vertices
explode_6 = Explode(Curve=polyline_8, Recursive=True)  # -> simplify(Segments), Vertices
merge_7 = Merge(Data1=tree_branch_23, Data2=shift_list_22)  # -> simplify(Result)
cull_index_6 = CullIndex(List=flip_matrix_10, Indices="0", Wrap=True)  # -> simplify(List)
cull_index_7 = CullIndex(List=flip_matrix_10, Indices="-1", Wrap=True)  # -> simplify(List)
flip_curve_2 = FlipCurve(Curve=explode_4.Segments)  # -> Curve, Flag
curve = Curve(dispatch_10.ListB)
match_tree_2 = MatchTree(Tree=merge_7, Guide=tree_branch_2)
flip_curve_3 = FlipCurve(Curve=explode_5.Segments)  # -> Curve, Flag
flip_curve_4 = FlipCurve(Curve=curve)  # -> Curve, Flag
flip_curve_5 = FlipCurve(Curve=cull_index_7)  # -> Curve, Flag
weave = Weave(Pattern=[0, 1], Stream0=curve, Stream1=flip_curve_4.Curve, NullGaps=False)
list_item_17 = ListItem(List=flatten(flip_curve_2.Curve), Index=0, Wrap=True)
list_item_18 = ListItem(List=flatten(explode_6.Segments), Index=0, Wrap=True)
shortest_list = ShortestList(ListListA=explode_6.Segments, ListListB=weave, TrimMode=2)  # -> ListListA, ListListB
tree_statistics_10 = TreeStatistics(Tree=match_tree_2)  # -> Paths, Length, Count
tree_statistics_11 = TreeStatistics(Tree=match_tree_2)  # -> Paths, Length, Count
polyline_9 = PolyLine(Vertices=match_tree_2, Closed=invert(False))
polyline_10 = PolyLine(Vertices=match_tree_2, Closed=invert(False))
shift_list_23 = ShiftList(List=shortest_list.ListListB, Shift="1", Wrap=True)
graft_tree_29 = GraftTree(Tree=explode_3.Segments, IncludeEmptyLists=True, IncludeNullItems=True)  # -> simplify(Tree)
graft_tree_30 = GraftTree(Tree=flip_curve_2.Curve, IncludeEmptyLists=True, IncludeNullItems=True)  # -> simplify(Tree)
graft_tree_31 = GraftTree(Tree=flip_curve_3.Curve, IncludeEmptyLists=True, IncludeNullItems=True)  # -> simplify(Tree)
graft_tree_32 = GraftTree(Tree=explode_6.Segments, IncludeEmptyLists=True, IncludeNullItems=True)  # -> simplify(Tree)
dispatch_11 = Dispatch(List=tree_statistics_10.Paths, DispatchPattern=[True, False])  # -> ListA, ListB
dispatch_12 = Dispatch(List=tree_statistics_11.Paths, DispatchPattern=[True, False])  # -> ListA, ListB
graft_tree_33 = GraftTree(Tree=cull_index_6, IncludeEmptyLists=True, IncludeNullItems=True)  # -> simplify(Tree)
graft_tree_34 = GraftTree(Tree=flip_curve_5.Curve, IncludeEmptyLists=True, IncludeNullItems=True)  # -> simplify(Tree)
graft_tree_35 = GraftTree(Tree=explode_3.Segments, IncludeEmptyLists=True, IncludeNullItems=True)  # -> simplify(Tree)
graft_tree_36 = GraftTree(Tree=shortest_list.ListListB, IncludeEmptyLists=True, IncludeNullItems=True)  # -> simplify(Tree)
graft_tree_37 = GraftTree(Tree=flip_curve_3.Curve, IncludeEmptyLists=True, IncludeNullItems=True)  # -> simplify(Tree)
list_item_19 = ListItem(List=flatten(shortest_list.ListListB), Index=0, Wrap=True)
flip_matrix_11 = FlipMatrix(Data=match_tree_2)
flip_matrix_12 = FlipMatrix(Data=match_tree_2)
tree_branch_25 = TreeBranch(Tree=match_tree_2, Path=dispatch_12.ListA, MaintainPaths=True)
tree_branch_26 = TreeBranch(Tree=match_tree_2, Path=dispatch_11.ListA, MaintainPaths=True)
tree_branch_27 = TreeBranch(Tree=match_tree_2, Path=dispatch_12.ListB, MaintainPaths=True)
tree_branch_28 = TreeBranch(Tree=match_tree_2, Path=dispatch_11.ListB, MaintainPaths=True)
shift_list_24 = ShiftList(List=tree_branch_26, Shift=1, Wrap=True)  # -> simplify(List)
shift_list_25 = ShiftList(List=tree_branch_27, Shift="-1", Wrap=True)  # -> simplify(List)
boundary_surfaces_7 = BoundarySurfaces(Edges=[graft_tree_35, graft_tree_37, graft_tree_33])
boundary_surfaces_8 = BoundarySurfaces(Edges=[graft_tree_29, graft_tree_31, graft_tree_34])
explode_7 = Explode(Curve=polyline_9, Recursive=True)  # -> simplify(Segments), Vertices
explode_8 = Explode(Curve=polyline_10, Recursive=True)  # -> simplify(Segments), Vertices
merge_8 = Merge(Data1=tree_branch_25, Data2=shift_list_25)
merge_9 = Merge(Data1=shift_list_24, Data2=tree_branch_28)
trim_tree_3 = TrimTree(Tree=boundary_surfaces_8, Depth=1)
match_tree_3 = MatchTree(Tree=merge_8, Guide=tree_branch_2)
trim_tree_4 = TrimTree(Tree=boundary_surfaces_7, Depth=1)
boundary_surfaces_9 = BoundarySurfaces(Edges=[graft_tree_30, graft_tree_32, graft_tree_36])
flip_matrix_13 = FlipMatrix(Data=merge_9)
flip_matrix_14 = FlipMatrix(Data=match_tree_3)
shift_list_26 = ShiftList(List=explode_8.Segments, Shift="-1", Wrap=True)
polyline_11 = PolyLine(Vertices=flip_matrix_11, Closed=False)
polyline_12 = PolyLine(Vertices=flip_matrix_12, Closed=False)
polyline_13 = PolyLine(Vertices=flip_matrix_13, Closed=False)
polyline_14 = PolyLine(Vertices=flip_matrix_14, Closed=False)
flip_matrix_15 = FlipMatrix(Data=shift_list_26)
weave_2 = Weave(Pattern=[0, 1], Stream0=trim_tree_3, Stream1=trim_tree_4, NullGaps=False)
trim_tree_5 = TrimTree(Tree=boundary_surfaces_9, Depth=1)
flip_matrix_16 = FlipMatrix(Data=explode_7.Segments)
dispatch_13 = Dispatch(List=flip_matrix_15, DispatchPattern=[True, False])  # -> ListA, ListB
explode_9 = Explode(Curve=polyline_11, Recursive=True)  # -> simplify(Segments), Vertices
explode_10 = Explode(Curve=polyline_12, Recursive=True)  # -> simplify(Segments), Vertices
explode_11 = Explode(Curve=polyline_13, Recursive=True)  # -> simplify(Segments), Vertices
explode_12 = Explode(Curve=polyline_14, Recursive=True)  # -> simplify(Segments), Vertices
cull_index_8 = CullIndex(List=flip_matrix_16, Indices="0", Wrap=True)  # -> simplify(List)
cull_index_9 = CullIndex(List=flip_matrix_16, Indices="-1", Wrap=True)  # -> simplify(List)
flip_curve_6 = FlipCurve(Curve=explode_10.Segments)  # -> Curve, Flag
curve_2 = Curve(dispatch_13.ListB)
flip_curve_7 = FlipCurve(Curve=explode_11.Segments)  # -> Curve, Flag
flip_curve_8 = FlipCurve(Curve=curve_2)  # -> Curve, Flag
weave_3 = Weave(Pattern=[0, 1], Stream0=weave_2, Stream1=trim_tree_5, NullGaps=False)
flip_curve_9 = FlipCurve(Curve=cull_index_9)  # -> Curve, Flag
weave_4 = Weave(Pattern=[0, 1], Stream0=curve_2, Stream1=flip_curve_8.Curve, NullGaps=False)
list_item_20 = ListItem(List=flatten(explode_12.Segments), Index=0, Wrap=True)
shortest_list_2 = ShortestList(ListListA=explode_12.Segments, ListListB=weave_4, TrimMode=2)  # -> ListListA, ListListB
shift_list_27 = ShiftList(List=shortest_list_2.ListListB, Shift="1", Wrap=True)
graft_tree_38 = GraftTree(Tree=explode_9.Segments, IncludeEmptyLists=True, IncludeNullItems=True)  # -> simplify(Tree)
graft_tree_39 = GraftTree(Tree=flip_curve_6.Curve, IncludeEmptyLists=True, IncludeNullItems=True)  # -> simplify(Tree)
graft_tree_40 = GraftTree(Tree=flip_curve_7.Curve, IncludeEmptyLists=True, IncludeNullItems=True)  # -> simplify(Tree)
graft_tree_41 = GraftTree(Tree=explode_12.Segments, IncludeEmptyLists=True, IncludeNullItems=True)  # -> simplify(Tree)
graft_tree_42 = GraftTree(Tree=cull_index_8, IncludeEmptyLists=True, IncludeNullItems=True)  # -> simplify(Tree)
graft_tree_43 = GraftTree(Tree=flip_curve_9.Curve, IncludeEmptyLists=True, IncludeNullItems=True)  # -> simplify(Tree)
graft_tree_44 = GraftTree(Tree=explode_9.Segments, IncludeEmptyLists=True, IncludeNullItems=True)  # -> simplify(Tree)
graft_tree_45 = GraftTree(Tree=shortest_list_2.ListListB, IncludeEmptyLists=True, IncludeNullItems=True)  # -> simplify(Tree)
graft_tree_46 = GraftTree(Tree=flip_curve_7.Curve, IncludeEmptyLists=True, IncludeNullItems=True)  # -> simplify(Tree)
list_item_21 = ListItem(List=flatten(shortest_list_2.ListListB), Index=0, Wrap=True)
boundary_surfaces_10 = BoundarySurfaces(Edges=[graft_tree_44, graft_tree_46, graft_tree_42])
boundary_surfaces_11 = BoundarySurfaces(Edges=[graft_tree_38, graft_tree_40, graft_tree_43])
trim_tree_6 = TrimTree(Tree=boundary_surfaces_11, Depth=1)
trim_tree_7 = TrimTree(Tree=boundary_surfaces_10, Depth=1)
boundary_surfaces_12 = BoundarySurfaces(Edges=[graft_tree_39, graft_tree_41, graft_tree_45])
weave_5 = Weave(Pattern=[0, 1], Stream0=trim_tree_6, Stream1=trim_tree_7, NullGaps=False)
trim_tree_8 = TrimTree(Tree=boundary_surfaces_12, Depth=1)
weave_6 = Weave(Pattern=[0, 1], Stream0=weave_5, Stream1=trim_tree_8, NullGaps=False)
cull_index_10 = CullIndex(List=weave_6, Indices="0", Wrap=True)
flatten_tree = FlattenTree(Tree=cull_index_10, Path="{0}")
brep_join = BrepJoin(Breps=flatten_tree)  # -> Breps, Closed
brep_edges = BrepEdges(Brep=brep_join.Breps)  # -> Naked, Interior, NonManifold
curve_3 = Curve(brep_edges.Naked)
join_curves_9 = JoinCurves(Curves=curve_3, Preserve=False)
sort_list_2 = SortList(Keys=join_curves_9, ValuesValuesA=join_curves_9)  # -> Keys, ValuesValuesA
list_item_22 = ListItem(List=sort_list_2.ValuesValuesA, Index=0, Wrap=True)
explode_13 = Explode(Curve=list_item_22, Recursive=True)  # -> Segments, Vertices
cull_duplicates_2 = CullDuplicates(Points=explode_13.Vertices, Tolerance=0.1, CullMode=3)  # -> Points, Indices, Valence
tree_statistics_12 = TreeStatistics(Tree=tree_branch_3)  # -> Paths, Length, Count
cull_index_11 = CullIndex(List=tree_statistics_12.Paths, Indices="0", Wrap=True)
graft_tree_47 = GraftTree(Tree=cull_duplicates_2.Points, IncludeEmptyLists=True, IncludeNullItems=True)
list_item_23 = ListItem(List=tree_statistics_12.Paths, Index="0", Wrap=True)
dispatch_14 = Dispatch(List=cull_index_11, DispatchPattern=[True, False])  # -> ListA, ListB
tree_branch_29 = TreeBranch(Tree=tree_branch_3, Path=list_item_23, MaintainPaths=True)
tree_branch_30 = TreeBranch(Tree=tree_branch_3, Path=dispatch_14.ListB, MaintainPaths=True)
tree_branch_31 = TreeBranch(Tree=tree_branch_3, Path=dispatch_14.ListA, MaintainPaths=True)
distance = Distance(PointA=graft_tree_47, PointB=tree_branch_29)
sort_list_3 = SortList(Keys=distance, ValuesValuesA=tree_branch_29)  # -> Keys, ValuesValuesA
list_item_24 = ListItem(List=sort_list_3.ValuesValuesA, Index=0, Wrap=True)  # -> simplify(Item)
item_index = ItemIndex(List=tree_branch_29, Item=list_item_24)  # -> flatten(Index)
dispatch_15 = Dispatch(List=item_index, DispatchPattern=[True, False])  # -> ListA, ListB
subtraction_7 = Subtraction(A=dispatch_15.ListB, B="4")
list_item_25 = ListItem(List=tree_branch_31, Index=dispatch_15.ListB, Wrap=True)
list_item_26 = ListItem(List=tree_branch_29, Index=item_index, Wrap=True)
list_item_27 = ListItem(List=tree_branch_29, Index=dispatch_15.ListA, Wrap=True)
list_item_28 = ListItem(List=tree_branch_30, Index=subtraction_7, Wrap=True)
tree_statistics_13 = TreeStatistics(Tree=list_item_25)  # -> Paths, Length, Count
merge_10 = Merge(Data1=list_item_27, Data2=list_item_25, Data3=list_item_28)
list_item_29 = ListItem(List=tree_statistics_13.Paths, Index=0, Wrap=True)
dispatch_16 = Dispatch(List=list_item_26, DispatchPattern=[True, False])  # -> ListA, ListB
tree_branch_32 = TreeBranch(Tree=list_item_25, Path=list_item_29, MaintainPaths=True)
tree_statistics_14 = TreeStatistics(Tree=merge_10)  # -> Paths, Length, Count
tree_statistics_15 = TreeStatistics(Tree=merge_10)  # -> Paths, Length, Count
shift_list_28 = ShiftList(List=tree_branch_32, Shift="-1", Wrap=True)
shift_list_29 = ShiftList(List=dispatch_16.ListB, Shift="-1", Wrap=True)
polyline_15 = PolyLine(Vertices=merge_10, Closed=invert(False))
polyline_16 = PolyLine(Vertices=merge_10, Closed=invert(False))
graft_tree_48 = GraftTree(Tree=dispatch_16.ListA, IncludeEmptyLists=True, IncludeNullItems=True)  # -> simplify(Tree)
graft_tree_49 = GraftTree(Tree=tree_branch_32, IncludeEmptyLists=True, IncludeNullItems=True)  # -> simplify(Tree)
graft_tree_50 = GraftTree(Tree=shift_list_29, IncludeEmptyLists=True, IncludeNullItems=True)  # -> simplify(Tree)
graft_tree_51 = GraftTree(Tree=dispatch_16.ListB, IncludeEmptyLists=True, IncludeNullItems=True)  # -> simplify(Tree)
graft_tree_52 = GraftTree(Tree=shift_list_28, IncludeEmptyLists=True, IncludeNullItems=True)  # -> simplify(Tree)
dispatch_17 = Dispatch(List=tree_statistics_14.Paths, DispatchPattern=[True, False])  # -> ListA, ListB
dispatch_18 = Dispatch(List=tree_statistics_15.Paths, DispatchPattern=[True, False])  # -> ListA, ListB
flip_matrix_17 = FlipMatrix(Data=merge_10)
flip_matrix_18 = FlipMatrix(Data=merge_10)
polyline_17 = PolyLine(Vertices=[graft_tree_48, graft_tree_49, graft_tree_51], Closed=invert(False))
polyline_18 = PolyLine(Vertices=[graft_tree_48, graft_tree_50, graft_tree_52], Closed=invert(False))
tree_branch_33 = TreeBranch(Tree=merge_10, Path=dispatch_17.ListA, MaintainPaths=True)
tree_branch_34 = TreeBranch(Tree=merge_10, Path=dispatch_18.ListA, MaintainPaths=True)
tree_branch_35 = TreeBranch(Tree=merge_10, Path=dispatch_18.ListB, MaintainPaths=True)
tree_branch_36 = TreeBranch(Tree=merge_10, Path=dispatch_17.ListB, MaintainPaths=True)
panel_6 = Panel("-1")
shift_list_30 = ShiftList(List=tree_branch_33, Shift=1, Wrap=True)  # -> simplify(List)
shift_list_31 = ShiftList(List=tree_branch_35, Shift="-1", Wrap=True)  # -> simplify(List)
boundary_surfaces_13 = BoundarySurfaces(Edges=polyline_17)
boundary_surfaces_14 = BoundarySurfaces(Edges=polyline_18)
explode_14 = Explode(Curve=polyline_15, Recursive=True)  # -> simplify(Segments), Vertices
explode_15 = Explode(Curve=polyline_16, Recursive=True)  # -> simplify(Segments), Vertices
merge_11 = Merge(Data1=tree_branch_34, Data2=shift_list_31)
merge_12 = Merge(Data1=shift_list_30, Data2=tree_branch_36)
match_tree_4 = MatchTree(Tree=merge_11, Guide=merge_10)
flip_matrix_19 = FlipMatrix(Data=merge_12)
flip_matrix_20 = FlipMatrix(Data=match_tree_4)
shift_list_32 = ShiftList(List=explode_15.Segments, Shift="-1", Wrap=True)
polyline_19 = PolyLine(Vertices=flip_matrix_17, Closed=False)
polyline_20 = PolyLine(Vertices=flip_matrix_18, Closed=False)
polyline_21 = PolyLine(Vertices=flip_matrix_19, Closed=False)
polyline_22 = PolyLine(Vertices=flip_matrix_20, Closed=False)
flip_matrix_21 = FlipMatrix(Data=shift_list_32)
flip_matrix_22 = FlipMatrix(Data=explode_14.Segments)
dispatch_19 = Dispatch(List=flip_matrix_21, DispatchPattern=[True, False])  # -> ListA, ListB
explode_16 = Explode(Curve=polyline_19, Recursive=True)  # -> simplify(Segments), Vertices
explode_17 = Explode(Curve=polyline_20, Recursive=True)  # -> simplify(Segments), Vertices
explode_18 = Explode(Curve=polyline_21, Recursive=True)  # -> simplify(Segments), Vertices
explode_19 = Explode(Curve=polyline_22, Recursive=True)  # -> simplify(Segments), Vertices
cull_index_12 = CullIndex(List=flip_matrix_22, Indices="0", Wrap=True)  # -> simplify(List)
cull_index_13 = CullIndex(List=flip_matrix_22, Indices="-1", Wrap=True)  # -> simplify(List)
flip_curve_10 = FlipCurve(Curve=explode_17.Segments)  # -> Curve, Flag
curve_4 = Curve(dispatch_19.ListB)
flip_curve_11 = FlipCurve(Curve=explode_18.Segments)  # -> Curve, Flag
flip_curve_12 = FlipCurve(Curve=curve_4)  # -> Curve, Flag
flip_curve_13 = FlipCurve(Curve=cull_index_13)  # -> Curve, Flag
weave_7 = Weave(Pattern=[0, 1], Stream0=curve_4, Stream1=flip_curve_12.Curve, NullGaps=False)
list_item_30 = ListItem(List=flatten(explode_19.Segments), Index=0, Wrap=True)
shortest_list_3 = ShortestList(ListListA=explode_19.Segments, ListListB=weave_7, TrimMode=2)  # -> ListListA, ListListB
shift_list_33 = ShiftList(List=shortest_list_3.ListListB, Shift="1", Wrap=True)
graft_tree_53 = GraftTree(Tree=explode_16.Segments, IncludeEmptyLists=True, IncludeNullItems=True)  # -> simplify(Tree)
graft_tree_54 = GraftTree(Tree=flip_curve_10.Curve, IncludeEmptyLists=True, IncludeNullItems=True)  # -> simplify(Tree)
graft_tree_55 = GraftTree(Tree=flip_curve_11.Curve, IncludeEmptyLists=True, IncludeNullItems=True)  # -> simplify(Tree)
graft_tree_56 = GraftTree(Tree=explode_19.Segments, IncludeEmptyLists=True, IncludeNullItems=True)  # -> simplify(Tree)
graft_tree_57 = GraftTree(Tree=cull_index_12, IncludeEmptyLists=True, IncludeNullItems=True)  # -> simplify(Tree)
graft_tree_58 = GraftTree(Tree=flip_curve_13.Curve, IncludeEmptyLists=True, IncludeNullItems=True)  # -> simplify(Tree)
graft_tree_59 = GraftTree(Tree=explode_16.Segments, IncludeEmptyLists=True, IncludeNullItems=True)  # -> simplify(Tree)
graft_tree_60 = GraftTree(Tree=shortest_list_3.ListListB, IncludeEmptyLists=True, IncludeNullItems=True)  # -> simplify(Tree)
graft_tree_61 = GraftTree(Tree=flip_curve_11.Curve, IncludeEmptyLists=True, IncludeNullItems=True)  # -> simplify(Tree)
list_item_31 = ListItem(List=flatten(shortest_list_3.ListListB), Index=0, Wrap=True)
boundary_surfaces_15 = BoundarySurfaces(Edges=[graft_tree_59, graft_tree_61, graft_tree_57])
boundary_surfaces_16 = BoundarySurfaces(Edges=[graft_tree_53, graft_tree_55, graft_tree_58])
trim_tree_9 = TrimTree(Tree=boundary_surfaces_16, Depth=1)
trim_tree_10 = TrimTree(Tree=boundary_surfaces_15, Depth=1)
boundary_surfaces_17 = BoundarySurfaces(Edges=[graft_tree_54, graft_tree_56, graft_tree_60])
weave_8 = Weave(Pattern=[0, 1], Stream0=trim_tree_9, Stream1=trim_tree_10, NullGaps=False)
trim_tree_11 = TrimTree(Tree=boundary_surfaces_17, Depth=1)
weave_9 = Weave(Pattern=[0, 1], Stream0=weave_8, Stream1=trim_tree_11, NullGaps=False)
cull_index_14 = CullIndex(List=weave_9, Indices="0", Wrap=True)
flatten_tree_2 = FlattenTree(Tree=cull_index_14, Path="{0}")
brep_join_2 = BrepJoin(Breps=flatten_tree_2)  # -> Breps, Closed
brep_edges_2 = BrepEdges(Brep=brep_join_2.Breps)  # -> Naked, Interior, NonManifold
curve_5 = Curve(brep_edges_2.Naked)
join_curves_10 = JoinCurves(Curves=curve_5, Preserve=False)
sort_list_4 = SortList(Keys=join_curves_10, ValuesValuesA=join_curves_10)  # -> Keys, ValuesValuesA
list_item_32 = ListItem(List=sort_list_4.ValuesValuesA, Index=0, Wrap=True)
explode_20 = Explode(Curve=list_item_32, Recursive=True)  # -> Segments, Vertices
tree_statistics_16 = TreeStatistics(Tree=tree_branch_6)  # -> Paths, Length, Count
cull_duplicates_3 = CullDuplicates(Points=explode_20.Vertices, Tolerance=0.1, CullMode=3)  # -> Points, Indices, Valence
cull_index_15 = CullIndex(List=tree_statistics_16.Paths, Indices="0", Wrap=True)
list_item_33 = ListItem(List=tree_statistics_16.Paths, Index="0", Wrap=True)
graft_tree_62 = GraftTree(Tree=cull_duplicates_3.Points, IncludeEmptyLists=True, IncludeNullItems=True)
dispatch_20 = Dispatch(List=cull_index_15, DispatchPattern=[True, False])  # -> ListA, ListB
tree_branch_37 = TreeBranch(Tree=tree_branch_6, Path=list_item_33, MaintainPaths=True)
tree_branch_38 = TreeBranch(Tree=tree_branch_6, Path=dispatch_20.ListA, MaintainPaths=True)
tree_branch_39 = TreeBranch(Tree=tree_branch_6, Path=dispatch_20.ListB, MaintainPaths=True)
distance_2 = Distance(PointA=graft_tree_62, PointB=tree_branch_37)
sort_list_5 = SortList(Keys=distance_2, ValuesValuesA=tree_branch_37)  # -> Keys, ValuesValuesA
list_item_34 = ListItem(List=sort_list_5.ValuesValuesA, Index=0, Wrap=True)  # -> simplify(Item)
item_index_2 = ItemIndex(List=tree_branch_37, Item=list_item_34)  # -> flatten(Index)
dispatch_21 = Dispatch(List=item_index_2, DispatchPattern=[True, False])  # -> ListA, ListB
subtraction_8 = Subtraction(A=dispatch_21.ListB, B="8")
list_item_35 = ListItem(List=tree_branch_38, Index=dispatch_21.ListB, Wrap=True)
list_item_36 = ListItem(List=tree_branch_37, Index=item_index_2, Wrap=True)
list_item_37 = ListItem(List=tree_branch_37, Index=dispatch_21.ListA, Wrap=True)
list_item_38 = ListItem(List=tree_branch_39, Index=subtraction_8, Wrap=True)
tree_statistics_17 = TreeStatistics(Tree=list_item_35)  # -> Paths, Length, Count
merge_13 = Merge(Data1=list_item_37, Data2=list_item_35, Data3=list_item_38)
list_item_39 = ListItem(List=tree_statistics_17.Paths, Index=0, Wrap=True)
dispatch_22 = Dispatch(List=list_item_36, DispatchPattern=[True, False])  # -> ListA, ListB
tree_branch_40 = TreeBranch(Tree=list_item_35, Path=list_item_39, MaintainPaths=True)
tree_statistics_18 = TreeStatistics(Tree=merge_13)  # -> Paths, Length, Count
tree_statistics_19 = TreeStatistics(Tree=merge_13)  # -> Paths, Length, Count
shift_list_34 = ShiftList(List=tree_branch_40, Shift="-1", Wrap=True)
shift_list_35 = ShiftList(List=dispatch_22.ListB, Shift="-1", Wrap=True)
polyline_23 = PolyLine(Vertices=merge_13, Closed=invert(False))
polyline_24 = PolyLine(Vertices=merge_13, Closed=invert(False))
graft_tree_63 = GraftTree(Tree=dispatch_22.ListA, IncludeEmptyLists=True, IncludeNullItems=True)  # -> simplify(Tree)
graft_tree_64 = GraftTree(Tree=tree_branch_40, IncludeEmptyLists=True, IncludeNullItems=True)  # -> simplify(Tree)
graft_tree_65 = GraftTree(Tree=shift_list_35, IncludeEmptyLists=True, IncludeNullItems=True)  # -> simplify(Tree)
graft_tree_66 = GraftTree(Tree=dispatch_22.ListB, IncludeEmptyLists=True, IncludeNullItems=True)  # -> simplify(Tree)
graft_tree_67 = GraftTree(Tree=shift_list_34, IncludeEmptyLists=True, IncludeNullItems=True)  # -> simplify(Tree)
dispatch_23 = Dispatch(List=tree_statistics_18.Paths, DispatchPattern=[True, False])  # -> ListA, ListB
dispatch_24 = Dispatch(List=tree_statistics_19.Paths, DispatchPattern=[True, False])  # -> ListA, ListB
flip_matrix_23 = FlipMatrix(Data=merge_13)
flip_matrix_24 = FlipMatrix(Data=merge_13)
polyline_25 = PolyLine(Vertices=[graft_tree_63, graft_tree_64, graft_tree_66], Closed=invert(False))
polyline_26 = PolyLine(Vertices=[graft_tree_63, graft_tree_65, graft_tree_67], Closed=invert(False))
tree_branch_41 = TreeBranch(Tree=merge_13, Path=dispatch_23.ListA, MaintainPaths=True)
tree_branch_42 = TreeBranch(Tree=merge_13, Path=dispatch_24.ListA, MaintainPaths=True)
tree_branch_43 = TreeBranch(Tree=merge_13, Path=dispatch_24.ListB, MaintainPaths=True)
tree_branch_44 = TreeBranch(Tree=merge_13, Path=dispatch_23.ListB, MaintainPaths=True)
shift_list_36 = ShiftList(List=tree_branch_41, Shift=1, Wrap=True)  # -> simplify(List)
shift_list_37 = ShiftList(List=tree_branch_43, Shift="-1", Wrap=True)  # -> simplify(List)

boundary_surfaces_18 = BoundarySurfaces(Edges=polyline_25)
boundary_surfaces_19 = BoundarySurfaces(Edges=polyline_26)

explode_21 = Explode(Curve=polyline_23, Recursive=True)  # -> simplify(Segments), Vertices
explode_22 = Explode(Curve=polyline_24, Recursive=True)  # -> simplify(Segments), Vertices
merge_14 = Merge(Data1=tree_branch_42, Data2=shift_list_37)
merge_15 = Merge(Data1=shift_list_36, Data2=tree_branch_44)
match_tree_5 = MatchTree(Tree=merge_14, Guide=merge_13)
flip_matrix_25 = FlipMatrix(Data=merge_15)
flip_matrix_26 = FlipMatrix(Data=match_tree_5)
shift_list_38 = ShiftList(List=explode_22.Segments, Shift="-1", Wrap=True)
polyline_27 = PolyLine(Vertices=flip_matrix_23, Closed=False)
polyline_28 = PolyLine(Vertices=flip_matrix_24, Closed=False)
polyline_29 = PolyLine(Vertices=flip_matrix_25, Closed=False)
polyline_30 = PolyLine(Vertices=flip_matrix_26, Closed=False)
flip_matrix_27 = FlipMatrix(Data=shift_list_38)
flip_matrix_28 = FlipMatrix(Data=explode_21.Segments)
dispatch_25 = Dispatch(List=flip_matrix_27, DispatchPattern=[True, False])  # -> ListA, ListB
explode_23 = Explode(Curve=polyline_27, Recursive=True)  # -> simplify(Segments), Vertices
explode_24 = Explode(Curve=polyline_28, Recursive=True)  # -> simplify(Segments), Vertices
explode_25 = Explode(Curve=polyline_29, Recursive=True)  # -> simplify(Segments), Vertices
explode_26 = Explode(Curve=polyline_30, Recursive=True)  # -> simplify(Segments), Vertices
cull_index_16 = CullIndex(List=flip_matrix_28, Indices="0", Wrap=True)  # -> simplify(List)
cull_index_17 = CullIndex(List=flip_matrix_28, Indices="-1", Wrap=True)  # -> simplify(List)
flip_curve_14 = FlipCurve(Curve=explode_24.Segments)  # -> Curve, Flag
curve_6 = Curve(dispatch_25.ListB)
flip_curve_15 = FlipCurve(Curve=explode_25.Segments)  # -> Curve, Flag
flip_curve_16 = FlipCurve(Curve=curve_6)  # -> Curve, Flag
flip_curve_17 = FlipCurve(Curve=cull_index_17)  # -> Curve, Flag
weave_10 = Weave(Pattern=[0, 1], Stream0=curve_6, Stream1=flip_curve_16.Curve, NullGaps=False)
list_item_40 = ListItem(List=flatten(explode_26.Segments), Index=0, Wrap=True)
shortest_list_4 = ShortestList(ListListA=explode_26.Segments, ListListB=weave_10, TrimMode=2)  # -> ListListA, ListListB
shift_list_39 = ShiftList(List=shortest_list_4.ListListB, Shift="1", Wrap=True)
graft_tree_68 = GraftTree(Tree=explode_23.Segments, IncludeEmptyLists=True, IncludeNullItems=True)  # -> simplify(Tree)
graft_tree_69 = GraftTree(Tree=flip_curve_14.Curve, IncludeEmptyLists=True, IncludeNullItems=True)  # -> simplify(Tree)
graft_tree_70 = GraftTree(Tree=flip_curve_15.Curve, IncludeEmptyLists=True, IncludeNullItems=True)  # -> simplify(Tree)
graft_tree_71 = GraftTree(Tree=explode_26.Segments, IncludeEmptyLists=True, IncludeNullItems=True)  # -> simplify(Tree)
graft_tree_72 = GraftTree(Tree=cull_index_16, IncludeEmptyLists=True, IncludeNullItems=True)  # -> simplify(Tree)
graft_tree_73 = GraftTree(Tree=flip_curve_17.Curve, IncludeEmptyLists=True, IncludeNullItems=True)  # -> simplify(Tree)
graft_tree_74 = GraftTree(Tree=explode_23.Segments, IncludeEmptyLists=True, IncludeNullItems=True)  # -> simplify(Tree)
graft_tree_75 = GraftTree(Tree=shortest_list_4.ListListB, IncludeEmptyLists=True, IncludeNullItems=True)  # -> simplify(Tree)
graft_tree_76 = GraftTree(Tree=flip_curve_15.Curve, IncludeEmptyLists=True, IncludeNullItems=True)  # -> simplify(Tree)
list_item_41 = ListItem(List=flatten(shortest_list_4.ListListB), Index=0, Wrap=True)
boundary_surfaces_20 = BoundarySurfaces(Edges=[graft_tree_74, graft_tree_76, graft_tree_72])
boundary_surfaces_21 = BoundarySurfaces(Edges=[graft_tree_68, graft_tree_70, graft_tree_73])
trim_tree_12 = TrimTree(Tree=boundary_surfaces_21, Depth=1)
trim_tree_13 = TrimTree(Tree=boundary_surfaces_20, Depth=1)
boundary_surfaces_22 = BoundarySurfaces(Edges=[graft_tree_69, graft_tree_71, graft_tree_75])
weave_11 = Weave(Pattern=[0, 1], Stream0=trim_tree_12, Stream1=trim_tree_13, NullGaps=False)
trim_tree_14 = TrimTree(Tree=boundary_surfaces_22, Depth=1)
weave_12 = Weave(Pattern=[0, 1], Stream0=weave_11, Stream1=trim_tree_14, NullGaps=False)
cull_index_18 = CullIndex(List=weave_12, Indices="0", Wrap=True)
