# Grasshopper definition HC_MBS.gh (Grasshopper 1.0.7)
# plug-ins: EleFront

surface = Surface(<surface referenced from the Rhino model>)
curve = Curve(surface)
discontinuity = Discontinuity(Curve=curve, Level=1)  # -> Points, Parameters
shatter = Shatter(Curve=curve, Parameters=discontinuity.Parameters)
list_item = ListItem(List=shatter, Index="3", Wrap=True)
maximum_panel_width = Panel("5")
length = Length(Curve=list_item)
division = Division(A=length, B=maximum_panel_width)
panel = Panel(length)
round = Round(Number=division)  # -> Nearest, Floor, Ceiling
divide_curve = DivideCurve(Curve=list_item, Count=round.Ceiling, Kinks=False)  # -> Points, Tangents, Parameters
surface_closest_point = SurfaceClosestPoint(Point=divide_curve.Points, Surface=surface)  # -> Point, UVPoint, Distance
iso_curve = IsoCurve(Surface=surface, UVPoint=surface_closest_point.UVPoint)  # -> UIsocurve, VIsocurve
curve_2 = Curve(simplify(flatten(iso_curve.VIsocurve)))
flatten_tree = FlattenTree(Tree=curve_2, Path="{0}")
sort_list = SortList(Keys=flatten_tree, ValuesValuesA=flatten_tree)  # -> Keys, ValuesValuesA
list_item_2 = ListItem(List=sort_list.Keys, Index="-1", Wrap=True)
list_item_3 = ListItem(List=sort_list.ValuesValuesA, Index="-1", Wrap=True)
maximum_panel_length = Panel("5")
division_2 = Division(A=list_item_2, B=maximum_panel_length)
round_2 = Round(Number=division_2)  # -> Nearest, Floor, Ceiling
flip_curve = FlipCurve(Curve=curve_2)  # -> reverse(Curve), Flag
divide_curve_2 = DivideCurve(Curve=flip_curve.Curve, Count=round_2.Ceiling, Kinks=False)  # -> simplify(Points), Tangents, Parameters
tree_statistics = TreeStatistics(Tree=divide_curve_2.Points)  # -> Paths, Length, Count
flip_matrix = FlipMatrix(Data=divide_curve_2.Points)
tree_statistics_2 = TreeStatistics(Tree=divide_curve_2.Points)  # -> Paths, Length, Count
tree_statistics_3 = TreeStatistics(Tree=flip_matrix)  # -> Paths, Length, Count
cull_index = CullIndex(List=tree_statistics.Paths, Indices="0", Wrap=True)
cull_index_2 = CullIndex(List=tree_statistics_2.Paths, Indices="-1", Wrap=True)
tree_statistics_4 = TreeStatistics(Tree=divide_curve_2.Points)  # -> Paths, Length, Count
dispatch = Dispatch(List=tree_statistics_3.Paths, DispatchPattern=[True, False])  # -> ListA, ListB
cull_index_3 = CullIndex(List=tree_statistics_4.Paths, Indices="0", Wrap=True)
cull_index_4 = CullIndex(List=tree_statistics_4.Paths, Indices="-1", Wrap=True)
tree_branch = TreeBranch(Tree=divide_curve_2.Points, Path=cull_index, MaintainPaths=True)
tree_branch_2 = TreeBranch(Tree=divide_curve_2.Points, Path=cull_index_2, MaintainPaths=True)
tree_branch_3 = TreeBranch(Tree=flip_matrix, Path=dispatch.ListB, MaintainPaths=True)
tree_branch_4 = TreeBranch(Tree=flip_matrix, Path=dispatch.ListA, MaintainPaths=True)
tree_branch_5 = TreeBranch(Tree=divide_curve_2.Points, Path=cull_index_3, MaintainPaths=True)
tree_branch_6 = TreeBranch(Tree=divide_curve_2.Points, Path=cull_index_4, MaintainPaths=True)
path_mapper = PathMapper(tree_branch_6, source="{a}", target="{a+1}")
dispatch_2 = Dispatch(List=tree_branch_3, DispatchPattern=[True, False])  # -> ListA, ListB
dispatch_3 = Dispatch(List=tree_branch_4, DispatchPattern=[True, False])  # -> ListA, ListB
cull_index_5 = CullIndex(List=tree_branch_5, Indices="0", Wrap=True)
cull_index_6 = CullIndex(List=path_mapper, Indices="-1", Wrap=True)
point = Point(dispatch_3.ListA)
cull_index_7 = CullIndex(List=tree_branch_5, Indices="-1", Wrap=True)
point_2 = Point(dispatch_3.ListB)
point_3 = Point(dispatch_2.ListB)
cull_index_8 = CullIndex(List=path_mapper, Indices="0", Wrap=True)
point_4 = Point(dispatch_2.ListA)
graft_tree = GraftTree(Tree=cull_index_7, IncludeEmptyLists=True, IncludeNullItems=True)
graft_tree_2 = GraftTree(Tree=cull_index_5, IncludeEmptyLists=True, IncludeNullItems=True)
graft_tree_3 = GraftTree(Tree=cull_index_6, IncludeEmptyLists=True, IncludeNullItems=True)
line = Line(StartPoint=cull_index_8, EndPoint=cull_index_6)
graft_tree_4 = GraftTree(Tree=cull_index_8, IncludeEmptyLists=True, IncludeNullItems=True)
line_2 = Line(StartPoint=cull_index_5, EndPoint=cull_index_8)
line_3 = Line(StartPoint=cull_index_7, EndPoint=cull_index_5)
line_4 = Line(StartPoint=cull_index_6, EndPoint=cull_index_7)
graft_tree_5 = GraftTree(Tree=line_3, IncludeEmptyLists=True, IncludeNullItems=True)
graft_tree_6 = GraftTree(Tree=line_2, IncludeEmptyLists=True, IncludeNullItems=True)
graft_tree_7 = GraftTree(Tree=line_4, IncludeEmptyLists=True, IncludeNullItems=True)
graft_tree_8 = GraftTree(Tree=line, IncludeEmptyLists=True, IncludeNullItems=True)
merge = Merge(Data1=graft_tree, Data2=graft_tree_2, Data3=graft_tree_4, Data4=graft_tree_3)  # -> simplify(Result)
join_curves = JoinCurves(Curves=[graft_tree_5, graft_tree_6, graft_tree_8, graft_tree_7], Preserve=False)  # -> simplify(Curves)
group = Group(Objects=merge)
trim_tree = TrimTree(Tree=join_curves, Depth=1)
trim_tree_2 = TrimTree(Tree=group, Depth=1)
tree_statistics_5 = TreeStatistics(Tree=trim_tree)  # -> Paths, Length, Count
tree_statistics_6 = TreeStatistics(Tree=trim_tree_2)  # -> Paths, Length, Count
dispatch_4 = Dispatch(List=tree_statistics_6.Paths, DispatchPattern=[True, False])  # -> ListA, ListB
dispatch_5 = Dispatch(List=tree_statistics_5.Paths, DispatchPattern=[True, False])  # -> ListA, ListB
cull_index_9 = CullIndex(List=tree_branch, Indices="-1", Wrap=True)
cull_index_10 = CullIndex(List=tree_branch, Indices="0", Wrap=True)
cull_index_11 = CullIndex(List=tree_branch_2, Indices="0", Wrap=True)
cull_index_12 = CullIndex(List=tree_branch_2, Indices="-1", Wrap=True)
tree_branch_7 = TreeBranch(Tree=trim_tree_2, Path=dispatch_4.ListA, MaintainPaths=True)
tree_branch_8 = TreeBranch(Tree=trim_tree, Path=dispatch_5.ListA, MaintainPaths=True)
tree_branch_9 = TreeBranch(Tree=trim_tree, Path=dispatch_5.ListB, MaintainPaths=True)
line_5 = Line(StartPoint=cull_index_9, EndPoint=cull_index_10)
tree_branch_10 = TreeBranch(Tree=trim_tree_2, Path=dispatch_4.ListB, MaintainPaths=True)
line_6 = Line(StartPoint=cull_index_10, EndPoint=cull_index_12)
line_7 = Line(StartPoint=cull_index_12, EndPoint=cull_index_9)
line_8 = Line(StartPoint=cull_index_10, EndPoint=cull_index_11)
line_9 = Line(StartPoint=cull_index_11, EndPoint=cull_index_12)
line_10 = Line(StartPoint=cull_index_12, EndPoint=cull_index_10)
dispatch_6 = Dispatch(List=tree_branch_7, DispatchPattern=[True, False])  # -> ListA, ListB
dispatch_7 = Dispatch(List=tree_branch_9, DispatchPattern=[True, False])  # -> ListA, ListB
dispatch_8 = Dispatch(List=tree_branch_8, DispatchPattern=[True, False])  # -> ListA, ListB
dispatch_9 = Dispatch(List=tree_branch_10, DispatchPattern=[True, False])  # -> ListA, ListB
graft_tree_9 = GraftTree(Tree=line_5, IncludeEmptyLists=True, IncludeNullItems=True)
graft_tree_10 = GraftTree(Tree=line_6, IncludeEmptyLists=True, IncludeNullItems=True)
graft_tree_11 = GraftTree(Tree=line_7, IncludeEmptyLists=True, IncludeNullItems=True)
graft_tree_12 = GraftTree(Tree=line_8, IncludeEmptyLists=True, IncludeNullItems=True)
graft_tree_13 = GraftTree(Tree=line_9, IncludeEmptyLists=True, IncludeNullItems=True)
graft_tree_14 = GraftTree(Tree=line_10, IncludeEmptyLists=True, IncludeNullItems=True)
curve_3 = Curve(dispatch_8.ListA)
curve_4 = Curve(dispatch_7.ListB)
merge_2 = Merge(Data1=dispatch_6.ListA, Data2=dispatch_9.ListB)
merge_3 = Merge(Data1=dispatch_6.ListB, Data2=dispatch_9.ListA)
merge_4 = Merge(Data1=dispatch_8.ListB, Data2=dispatch_7.ListA)
merge_5 = Merge(Data1=curve_3, Data2=curve_4)
ungroup = Ungroup(Group=merge_2)
join_curves_2 = JoinCurves(Curves=[graft_tree_9, graft_tree_10, graft_tree_11], Preserve=False)
ungroup_2 = Ungroup(Group=merge_3)
join_curves_3 = JoinCurves(Curves=[graft_tree_12, graft_tree_13, graft_tree_14], Preserve=False)
discontinuity_2 = Discontinuity(Curve=merge_4, Level=1)  # -> Points, Parameters
discontinuity_3 = Discontinuity(Curve=merge_5, Level=1)  # -> Points, Parameters
list_item_4 = ListItem(List=ungroup_2, Index=0, Wrap=True)  # -> Item, Item1, Item2, Item3
list_item_5 = ListItem(List=ungroup, Index=0, Wrap=True)  # -> Item, Item1, Item2, Item3
list_item_6 = ListItem(List=discontinuity_3.Points, Index=0, Wrap=True)  # -> Item, Item1, Item2, Item3
list_item_7 = ListItem(List=discontinuity_2.Points, Index=0, Wrap=True)  # -> Item, Item1, Item2, Item3

line_11 = Line(StartPoint=list_item_4.Item, EndPoint=list_item_4.Item1)
line_12 = Line(StartPoint=list_item_4.Item1, EndPoint=list_item_4.Item2)
line_13 = Line(StartPoint=list_item_4.Item2, EndPoint=list_item_4.Item)

line_14 = Line(StartPoint=list_item_4.Item2, EndPoint=list_item_4.Item3)
line_15 = Line(StartPoint=list_item_4.Item3, EndPoint=list_item_4.Item)
line_16 = Line(StartPoint=list_item_4.Item, EndPoint=list_item_4.Item2)

line_17 = Line(StartPoint=list_item_5.Item, EndPoint=list_item_5.Item1)
line_18 = Line(StartPoint=list_item_5.Item1, EndPoint=list_item_5.Item3)
line_19 = Line(StartPoint=list_item_5.Item3, EndPoint=list_item_5.Item)

line_20 = Line(StartPoint=list_item_5.Item2, EndPoint=list_item_5.Item3)
line_21 = Line(StartPoint=list_item_5.Item3, EndPoint=list_item_5.Item1)
line_22 = Line(StartPoint=list_item_5.Item1, EndPoint=list_item_5.Item2)

biggap = Panel("0.6")
smallgap = Panel("0.4")
line_23 = Line(StartPoint=list_item_6.Item, EndPoint=list_item_6.Item1)
line_24 = Line(StartPoint=list_item_6.Item1, EndPoint=list_item_6.Item2)
line_25 = Line(StartPoint=list_item_6.Item2, EndPoint=list_item_6.Item)
line_26 = Line(StartPoint=list_item_6.Item2, EndPoint=list_item_6.Item3)
line_27 = Line(StartPoint=list_item_6.Item3, EndPoint=list_item_6.Item)
line_28 = Line(StartPoint=list_item_6.Item, EndPoint=list_item_6.Item2)
line_29 = Line(StartPoint=list_item_7.Item, EndPoint=list_item_7.Item1)
line_30 = Line(StartPoint=list_item_7.Item1, EndPoint=list_item_7.Item3)
line_31 = Line(StartPoint=list_item_7.Item1, EndPoint=list_item_7.Item2)
line_32 = Line(StartPoint=list_item_7.Item2, EndPoint=list_item_7.Item3)
line_33 = Line(StartPoint=list_item_7.Item3, EndPoint=list_item_7.Item1)
line_34 = Line(StartPoint=list_item_7.Item3, EndPoint=list_item_7.Item)
join_curves_4 = JoinCurves(Curves=[line_11, line_12, line_13], Preserve=False)
merge_6 = Merge(Data1=line_11, Data2=line_12, Data3=line_13)

join_curves_5 = JoinCurves(Curves=[line_14, line_15, line_16], Preserve=False)
merge_7 = Merge(Data1=line_14, Data2=line_15, Data3=line_16)
area = Area(Geometry=join_curves_5)  # -> Area, Centroid

join_curves_6 = JoinCurves(Curves=[line_17, line_18, line_19], Preserve=False)
merge_8 = Merge(Data1=line_17, Data2=line_18, Data3=line_19)
area_2 = Area(Geometry=join_curves_6)  # -> Area, Centroid

join_curves_7 = JoinCurves(Curves=[line_20, line_21, line_22], Preserve=False)
merge_9 = Merge(Data1=line_20, Data2=line_21, Data3=line_22)
area_3 = Area(Geometry=join_curves_7)  # -> Area, Centroid

area_4 = Area(Geometry=join_curves_4)  # -> Area, Centroid
join_curves_8 = JoinCurves(Curves=[line_23, line_24, line_25], Preserve=False)
join_curves_9 = JoinCurves(Curves=[line_26, line_27, line_28], Preserve=False)
join_curves_10 = JoinCurves(Curves=[line_34, line_29, line_30], Preserve=False)
join_curves_11 = JoinCurves(Curves=[line_31, line_32, line_33], Preserve=False)
list_item_8 = ListItem(List=merge_6, Index=0, Wrap=True)  # -> Item, Item1, Item2
curve_closest_point = CurveClosestPoint(Point=area_4.Centroid, Curve=merge_6)  # -> Point, Parameter, Distance
boundary_surfaces = BoundarySurfaces(Edges=join_curves_8)
boundary_surfaces_2 = BoundarySurfaces(Edges=join_curves_9)
boundary_surfaces_3 = BoundarySurfaces(Edges=join_curves_10)
boundary_surfaces_4 = BoundarySurfaces(Edges=join_curves_11)
vector_2pt = Vector2Pt(PointA=curve_closest_point.Point, PointB=area_4.Centroid, Unitize=False)  # -> Vector, Length
division_3 = Division(A=smallgap, B=2)
division_4 = Division(A=biggap, B=2)
list_item_9 = ListItem(List=vector_2pt.Vector, Index=0, Wrap=True)  # -> Item, Item1, Item2
curve_closest_point_2 = CurveClosestPoint(Point=area.Centroid, Curve=merge_7)  # -> Point, Parameter, Distance
list_item_10 = ListItem(List=merge_7, Index=0, Wrap=True)  # -> Item, Item1, Item2
amplitude = Amplitude(Vector=[list_item_9.Item, list_item_9.Item1], Amplitude=division_3)
amplitude_2 = Amplitude(Vector=list_item_9.Item2, Amplitude=division_4)
vector_display = VectorDisplay(Anchor=curve_closest_point.Point, Vector=vector_2pt.Vector)
curve_closest_point_3 = CurveClosestPoint(Point=area_3.Centroid, Curve=merge_9)  # -> Point, Parameter, Distance
curve_closest_point_4 = CurveClosestPoint(Point=area_2.Centroid, Curve=merge_8)  # -> Point, Parameter, Distance
vector_2pt_2 = Vector2Pt(PointA=curve_closest_point_2.Point, PointB=area.Centroid, Unitize=False)  # -> Vector, Length
division_5 = Division(A=smallgap, B=2)
division_6 = Division(A=biggap, B=2)
merge_10 = Merge(Data1=amplitude, Data2=amplitude_2)
list_item_11 = ListItem(List=vector_2pt_2.Vector, Index=0, Wrap=True)  # -> Item, Item1, Item2
vector_2pt_3 = Vector2Pt(PointA=curve_closest_point_3.Point, PointB=area_3.Centroid, Unitize=False)  # -> Vector, Length
list_item_12 = ListItem(List=curve_closest_point_3.Point, Index=0, Wrap=True)  # -> Item, Item1, Item2
list_item_13 = ListItem(List=curve_closest_point_4.Point, Index=0, Wrap=True)  # -> Item, Item1, Item2
vector_2pt_4 = Vector2Pt(PointA=curve_closest_point_4.Point, PointB=area_2.Centroid, Unitize=False)  # -> Vector, Length
move = Move(Geometry=merge_6, Motion=merge_10)  # -> Geometry, Transform
amplitude_3 = Amplitude(Vector=[list_item_11.Item, list_item_11.Item1], Amplitude=division_5)
amplitude_4 = Amplitude(Vector=list_item_11.Item2, Amplitude=division_6)
vector_display_2 = VectorDisplay(Anchor=curve_closest_point_2.Point, Vector=vector_2pt_2.Vector)
list_item_14 = ListItem(List=vector_2pt_3.Vector, Index=0, Wrap=True)  # -> Item, Item1, Item2
division_7 = Division(A=smallgap, B=2)
division_8 = Division(A=biggap, B=2)
list_item_15 = ListItem(List=vector_2pt_4.Vector, Index=0, Wrap=True)  # -> Item, Item1, Item2
division_9 = Division(A=smallgap, B=2)
division_10 = Division(A=biggap, B=2)

merge_11 = Merge(Data1=boundary_surfaces, Data2=boundary_surfaces_2)
merge_12 = Merge(Data1=line_23, Data2=line_26)
merge_13 = Merge(Data1=line_24, Data2=line_27)
merge_14 = Merge(Data1=line_25, Data2=line_28)
area_5 = Area(Geometry=merge_11)  # -> Area, Centroid
curve_closest_point_5 = CurveClosestPoint(Point=area_5.Centroid, Curve=merge_12)  # -> Point, Parameter, Distance
curve_closest_point_6 = CurveClosestPoint(Point=area_5.Centroid, Curve=merge_13)  # -> Point, Parameter, Distance
curve_closest_point_7 = CurveClosestPoint(Point=area_5.Centroid, Curve=merge_14)  # -> Point, Parameter, Distance
vector_2pt_5 = Vector2Pt(PointA=curve_closest_point_5.Point, PointB=area_5.Centroid, Unitize=False)  # -> Vector, Length
vector_2pt_6 = Vector2Pt(PointA=curve_closest_point_6.Point, PointB=area_5.Centroid, Unitize=False)  # -> Vector, Length
vector_2pt_7 = Vector2Pt(PointA=curve_closest_point_7.Point, PointB=area_5.Centroid, Unitize=False)  # -> Vector, Length
division_11 = Division(A=smallgap, B="2")
division_12 = Division(A=smallgap, B="2")
division_13 = Division(A=biggap, B="2")
amplitude_5 = Amplitude(Vector=vector_2pt_5.Vector, Amplitude=division_11)
amplitude_6 = Amplitude(Vector=vector_2pt_6.Vector, Amplitude=division_12)
amplitude_7 = Amplitude(Vector=vector_2pt_7.Vector, Amplitude=division_13)
move_2 = Move(Geometry=merge_13, Motion=amplitude_6)  # -> Geometry, Transform
move_3 = Move(Geometry=merge_14, Motion=amplitude_7)  # -> Geometry, Transform
move_4 = Move(Geometry=merge_12, Motion=amplitude_5)  # -> Geometry, Transform
graft_tree_15 = GraftTree(Tree=move_4.Geometry, IncludeEmptyLists=True, IncludeNullItems=True)
graft_tree_16 = GraftTree(Tree=move_2.Geometry, IncludeEmptyLists=True, IncludeNullItems=True)
graft_tree_17 = GraftTree(Tree=move_3.Geometry, IncludeEmptyLists=True, IncludeNullItems=True)
graft_tree_18 = GraftTree(Tree=merge_11, IncludeEmptyLists=True, IncludeNullItems=True)  # -> simplify(Tree)
merge_15 = Merge(Data1=graft_tree_15, Data2=graft_tree_16, Data3=graft_tree_17)  # -> simplify(Result)
surface_split = SurfaceSplit(Surface=graft_tree_18, Curves=merge_15)
area_6 = Area(Geometry=surface_split)  # -> Area, Centroid
sort_list_2 = SortList(Keys=area_6.Area, ValuesValuesA=surface_split)  # -> Keys, reverse(ValuesValuesA)
list_item_16 = ListItem(List=sort_list_2.ValuesValuesA, Index=0, Wrap=True)  # -> simplify(Item)

merge_16 = Merge(Data1=boundary_surfaces_3, Data2=boundary_surfaces_4)
merge_17 = Merge(Data1=line_34, Data2=line_31)
merge_18 = Merge(Data1=line_29, Data2=line_32)
merge_19 = Merge(Data1=line_30, Data2=line_33)
area_7 = Area(Geometry=merge_16)  # -> Area, Centroid
curve_closest_point_8 = CurveClosestPoint(Point=area_7.Centroid, Curve=merge_17)  # -> Point, Parameter, Distance
curve_closest_point_9 = CurveClosestPoint(Point=area_7.Centroid, Curve=merge_18)  # -> Point, Parameter, Distance
curve_closest_point_10 = CurveClosestPoint(Point=area_7.Centroid, Curve=merge_19)  # -> Point, Parameter, Distance
vector_2pt_8 = Vector2Pt(PointA=curve_closest_point_8.Point, PointB=area_7.Centroid, Unitize=False)  # -> Vector, Length
vector_2pt_9 = Vector2Pt(PointA=curve_closest_point_9.Point, PointB=area_7.Centroid, Unitize=False)  # -> Vector, Length
vector_2pt_10 = Vector2Pt(PointA=curve_closest_point_10.Point, PointB=area_7.Centroid, Unitize=False)  # -> Vector, Length
division_14 = Division(A=smallgap, B="2")
division_15 = Division(A=smallgap, B="2")
division_16 = Division(A=biggap, B="2")
amplitude_8 = Amplitude(Vector=vector_2pt_8.Vector, Amplitude=division_14)
amplitude_9 = Amplitude(Vector=vector_2pt_9.Vector, Amplitude=division_15)
amplitude_10 = Amplitude(Vector=vector_2pt_10.Vector, Amplitude=division_16)
move_5 = Move(Geometry=merge_18, Motion=amplitude_9)  # -> Geometry, Transform
move_6 = Move(Geometry=merge_19, Motion=amplitude_10)  # -> Geometry, Transform
move_7 = Move(Geometry=merge_17, Motion=amplitude_8)  # -> Geometry, Transform
graft_tree_19 = GraftTree(Tree=move_7.Geometry, IncludeEmptyLists=True, IncludeNullItems=True)
graft_tree_20 = GraftTree(Tree=move_5.Geometry, IncludeEmptyLists=True, IncludeNullItems=True)
graft_tree_21 = GraftTree(Tree=move_6.Geometry, IncludeEmptyLists=True, IncludeNullItems=True)
graft_tree_22 = GraftTree(Tree=merge_16, IncludeEmptyLists=True, IncludeNullItems=True)  # -> simplify(Tree)
merge_20 = Merge(Data1=graft_tree_19, Data2=graft_tree_20, Data3=graft_tree_21)  # -> simplify(Result)
surface_split_2 = SurfaceSplit(Surface=graft_tree_22, Curves=merge_20)
area_8 = Area(Geometry=surface_split_2)  # -> Area, Centroid
sort_list_3 = SortList(Keys=area_8.Area, ValuesValuesA=surface_split_2)  # -> Keys, reverse(ValuesValuesA)
list_item_17 = ListItem(List=sort_list_3.ValuesValuesA, Index=0, Wrap=True)  # -> simplify(Item)

merge_21 = Merge(Data1=amplitude_3, Data2=amplitude_4)
amplitude_11 = Amplitude(Vector=[list_item_14.Item, list_item_14.Item2], Amplitude=division_7)
graft_tree_23 = GraftTree(Tree=move.Geometry, IncludeEmptyLists=True, IncludeNullItems=True)
amplitude_12 = Amplitude(Vector=[list_item_15.Item, list_item_15.Item2], Amplitude=division_9)
amplitude_13 = Amplitude(Vector=list_item_14.Item1, Amplitude=division_8)
amplitude_14 = Amplitude(Vector=list_item_15.Item1, Amplitude=division_10)
vector_display_3 = VectorDisplay(Anchor=curve_closest_point_3.Point, Vector=vector_2pt_3.Vector)
vector_display_4 = VectorDisplay(Anchor=curve_closest_point_4.Point, Vector=vector_2pt_4.Vector)
shift_list = ShiftList(List=move.Geometry, Shift=1, Wrap=True)
shift_list_2 = ShiftList(List=move.Geometry, Shift="-1", Wrap=True)
move_8 = Move(Geometry=merge_7, Motion=merge_21)  # -> Geometry, Transform
list_item_18 = ListItem(List=amplitude_11, Index=0, Wrap=True)  # -> Item, Item1
list_item_19 = ListItem(List=amplitude_12, Index=0, Wrap=True)  # -> Item, Item1
graft_tree_24 = GraftTree(Tree=shift_list, IncludeEmptyLists=True, IncludeNullItems=True)
merge_22 = Merge(Data1=list_item_18.Item, Data2=amplitude_13, Data3=list_item_18.Item1)
merge_23 = Merge(Data1=list_item_19.Item, Data2=amplitude_14, Data3=list_item_19.Item1)
graft_tree_25 = GraftTree(Tree=shift_list_2, IncludeEmptyLists=True, IncludeNullItems=True)
graft_tree_26 = GraftTree(Tree=move_8.Geometry, IncludeEmptyLists=True, IncludeNullItems=True)
move_9 = Move(Geometry=merge_9, Motion=merge_22)  # -> Geometry, Transform
move_10 = Move(Geometry=merge_8, Motion=merge_23)  # -> Geometry, Transform
curve_curve = CurveCurve(CurveA=graft_tree_23, CurveB=graft_tree_24)  # -> Points, ParamsA, ParamsB
shift_list_3 = ShiftList(List=move_8.Geometry, Shift=1, Wrap=True)
shift_list_4 = ShiftList(List=move_8.Geometry, Shift="-1", Wrap=True)
curve_curve_2 = CurveCurve(CurveA=graft_tree_23, CurveB=graft_tree_25)  # -> Points, ParamsA, ParamsB
graft_tree_27 = GraftTree(Tree=shift_list_3, IncludeEmptyLists=True, IncludeNullItems=True)
graft_tree_28 = GraftTree(Tree=shift_list_4, IncludeEmptyLists=True, IncludeNullItems=True)
graft_tree_29 = GraftTree(Tree=move_9.Geometry, IncludeEmptyLists=True, IncludeNullItems=True)
shatter_2 = Shatter(Curve=graft_tree_23, Parameters=[curve_curve.ParamsA, curve_curve_2.ParamsA])
graft_tree_30 = GraftTree(Tree=move_10.Geometry, IncludeEmptyLists=True, IncludeNullItems=True)
shift_list_5 = ShiftList(List=move_9.Geometry, Shift=1, Wrap=True)
shift_list_6 = ShiftList(List=move_9.Geometry, Shift="-1", Wrap=True)
shift_list_7 = ShiftList(List=move_10.Geometry, Shift=1, Wrap=True)
shift_list_8 = ShiftList(List=move_10.Geometry, Shift="-1", Wrap=True)
curve_curve_3 = CurveCurve(CurveA=graft_tree_26, CurveB=graft_tree_27)  # -> Points, ParamsA, ParamsB
curve_curve_4 = CurveCurve(CurveA=graft_tree_26, CurveB=graft_tree_28)  # -> Points, ParamsA, ParamsB
graft_tree_31 = GraftTree(Tree=shift_list_5, IncludeEmptyLists=True, IncludeNullItems=True)
graft_tree_32 = GraftTree(Tree=shift_list_7, IncludeEmptyLists=True, IncludeNullItems=True)
graft_tree_33 = GraftTree(Tree=shift_list_6, IncludeEmptyLists=True, IncludeNullItems=True)
list_item_20 = ListItem(List=shatter_2, Index="1", Wrap=True)  # -> simplify(Item)
graft_tree_34 = GraftTree(Tree=shift_list_8, IncludeEmptyLists=True, IncludeNullItems=True)
shatter_3 = Shatter(Curve=graft_tree_26, Parameters=[curve_curve_3.ParamsA, curve_curve_4.ParamsA])
trim_tree_3 = TrimTree(Tree=list_item_20, Depth=1)
curve_curve_5 = CurveCurve(CurveA=graft_tree_29, CurveB=graft_tree_31)  # -> Points, ParamsA, ParamsB
curve_curve_6 = CurveCurve(CurveA=graft_tree_30, CurveB=graft_tree_32)  # -> Points, ParamsA, ParamsB
curve_curve_7 = CurveCurve(CurveA=graft_tree_29, CurveB=graft_tree_33)  # -> Points, ParamsA, ParamsB
curve_curve_8 = CurveCurve(CurveA=graft_tree_30, CurveB=graft_tree_34)  # -> Points, ParamsA, ParamsB
join_curves_12 = JoinCurves(Curves=trim_tree_3, Preserve=False)
list_item_21 = ListItem(List=shatter_3, Index="1", Wrap=True)  # -> simplify(Item)
shatter_4 = Shatter(Curve=graft_tree_29, Parameters=[curve_curve_5.ParamsA, curve_curve_7.ParamsA])
shatter_5 = Shatter(Curve=graft_tree_30, Parameters=[curve_curve_6.ParamsA, curve_curve_8.ParamsA])
trim_tree_4 = TrimTree(Tree=list_item_21, Depth=1)
list_item_22 = ListItem(List=shatter_4, Index="1", Wrap=True)  # -> simplify(Item)
list_item_23 = ListItem(List=shatter_5, Index="1", Wrap=True)  # -> simplify(Item)
join_curves_13 = JoinCurves(Curves=trim_tree_4, Preserve=False)
trim_tree_5 = TrimTree(Tree=list_item_22, Depth=1)
trim_tree_6 = TrimTree(Tree=list_item_23, Depth=1)
join_curves_14 = JoinCurves(Curves=trim_tree_5, Preserve=False)
join_curves_15 = JoinCurves(Curves=trim_tree_6, Preserve=False)

boundary_surfaces_5 = BoundarySurfaces(Edges=join_curves_12)
boundary_surfaces_6 = BoundarySurfaces(Edges=join_curves_13)
boundary_surfaces_7 = BoundarySurfaces(Edges=join_curves_14)
boundary_surfaces_8 = BoundarySurfaces(Edges=join_curves_15)

merge_24 = Merge(Data1=boundary_surfaces_8, Data2=boundary_surfaces_7)  # -> simplify(Result)
merge_25 = Merge(Data1=boundary_surfaces_5, Data2=boundary_surfaces_6)  # -> simplify(Result)
merge_26 = Merge(Data1=merge_24, Data2=merge_25)
trim_tree_7 = TrimTree(Tree=merge_26, Depth=1)
trim_tree_8 = TrimTree(Tree=list_item_17, Depth="2")
trim_tree_9 = TrimTree(Tree=list_item_16, Depth="2")
partition_list = PartitionList(List=trim_tree_9, Size="2")  # -> reverse(Chunks)
partition_list_2 = PartitionList(List=trim_tree_8, Size="2")  # -> reverse(Chunks)
trim_tree_10 = TrimTree(Tree=partition_list, Depth=1)
trim_tree_11 = TrimTree(Tree=partition_list_2, Depth=1)
tree_statistics_7 = TreeStatistics(Tree=trim_tree_10)  # -> Paths, Length, Count
tree_statistics_8 = TreeStatistics(Tree=trim_tree_11)  # -> Paths, Length, Count
dispatch_10 = Dispatch(List=tree_statistics_7.Paths, DispatchPattern=[True, False])  # -> ListA, ListB
dispatch_11 = Dispatch(List=tree_statistics_8.Paths, DispatchPattern=[True, False])  # -> ListA, ListB
tree_branch_11 = TreeBranch(Tree=trim_tree_10, Path=dispatch_10.ListA, MaintainPaths=True)
tree_branch_12 = TreeBranch(Tree=trim_tree_10, Path=dispatch_10.ListB, MaintainPaths=True)
tree_branch_13 = TreeBranch(Tree=trim_tree_11, Path=dispatch_11.ListA, MaintainPaths=True)
tree_branch_14 = TreeBranch(Tree=trim_tree_11, Path=dispatch_11.ListB, MaintainPaths=True)
panel_2 = Panel("""0
0
1
1""")
weave = Weave(Pattern=panel_2, Stream0=tree_branch_11, Stream1=tree_branch_13, NullGaps=False)
weave_2 = Weave(Pattern=panel_2, Stream0=tree_branch_14, Stream1=tree_branch_12, NullGaps=False)
merge_27 = Merge(Data1=weave, Data2=weave_2)
tree_statistics_9 = TreeStatistics(Tree=merge_27)  # -> Paths, Length, Count
area_9 = Area(Geometry=merge_27)  # -> Area, Centroid
series = Series(Start="1", Step=1, Count=tree_statistics_9.Count)
series_2 = Series(Start="1", Step=1, Count=tree_statistics_9.Length)
smaller_than = SmallerThan(FirstNumber=series, SecondNumber=10)  # -> SmallerThan, OrEqualTo
smaller_than_2 = SmallerThan(FirstNumber=series_2, SecondNumber=10)  # -> SmallerThan, OrEqualTo
panel_3 = Panel("x1")
panel_4 = Panel("x11")
dispatch_12 = Dispatch(List=series, DispatchPattern=smaller_than.SmallerThan)  # -> ListA, ListB
dispatch_13 = Dispatch(List=series_2, DispatchPattern=smaller_than_2.SmallerThan)  # -> ListA, ListB
panel_5 = Panel("""x1
x2
.
.
.
x10""")
panel_6 = Panel("""x1
x10
x11
x2
.
.
.""")
text = Text(dispatch_12.ListA)
text_2 = Text(dispatch_12.ListB)
text_3 = Text(dispatch_13.ListA)
text_4 = Text(dispatch_13.ListB)
concatenate = Concatenate(FragmentA="0", FragmentB=text)
concatenate_2 = Concatenate(FragmentA="0", FragmentB=text_3)
merge_28 = Merge(Data1=concatenate, Data2=text_2)
merge_29 = Merge(Data1=concatenate_2, Data2=text_4)
concatenate_3 = Concatenate(FragmentA="X", FragmentB=merge_28)
panel_7 = Panel(concatenate_3)
concatenate_4 = Concatenate(FragmentA="Y", FragmentB=merge_29)  # -> simplify(Result)
graft_tree_35 = GraftTree(Tree=concatenate_3, IncludeEmptyLists=True, IncludeNullItems=True)  # -> simplify(Tree)
cross_reference = CrossReference(ListA=graft_tree_35, ListB=concatenate_4, CrossMode=1)  # -> ListA, ListB
concatenate_5 = Concatenate(FragmentA=cross_reference.ListA, FragmentB=cross_reference.ListB, JoinSeparator="-")
define_text_dot = DefineTextDot(Text=concatenate_5, Location=area_9.Centroid, Font="Arial", Size=14)
define_object_attributes = DefineObjectAttributes(Name=concatenate_5, Layer="Layer::Panel")
bake_objects = BakeObjects(Geometry=define_text_dot, Bake=False)
bake_objects_2 = BakeObjects(Geometry=merge_27, Attributes=define_object_attributes, BakeName="Panel", Bake=False)
