# Grasshopper definition 01_GlideReflection.gh (Grasshopper 1.0.8)
# plug-ins: eleFront

gap_btw_panesl = Panel("1")
int_grid_rep = EleFrontDataDescription("6", ShiftDepth=0, isNameSet=True)
int_grid_rep_2 = EleFrontDataDescription(int_grid_rep, ShiftDepth=0, isNameSet=False)
int_gap_btw_panels = EleFrontDataDescription(gap_btw_panesl, ShiftDepth=0, isNameSet=True)
sqgrid = Square(Plane=PlaneXY(0, 0, 0), Size="40", ExtentX=int_grid_rep_2, ExtentY=int_grid_rep_2)  # -> Cells, Points
int_grid_rep_3 = EleFrontDataDescription(int_grid_rep, ShiftDepth=0, isNameSet=False)
panel = Panel("crv;odd_col_SW_dia")

# ---- group: Create horizontal divider
explode = Explode(Curve=sqgrid.Cells, Recursive=True)  # -> Segments, Vertices
dispatch = Dispatch(List=explode.Segments, DispatchPattern=[True, False])  # -> ListA, ListB
midpt = CurveMiddle(Curve=dispatch.ListB)
item = ListItem(List=dispatch.ListA, Index=0, Wrap=True)  # -> Item, Item1
flip = FlipCurve(Curve=item.Item)  # -> Curve, Flag
pline = PolyLine(Vertices=midpt, Closed=False)
merge = Merge(Data1=flip.Curve, Data2=item.Item1)
weave = Weave(Pattern=[0, 1], Stream0=merge, Stream1=pline, NullGaps=False)

# ----
item_2 = ListItem(List=explode.Segments, Index="1", Wrap=True)
trim = TrimTree(Tree=item_2, Depth=1)  # -> simplify(Tree)
flip_2 = FlipMatrix(Data=trim)
data = EleFrontDataDescription(flip_2, ShiftDepth=0, isNameSet=False)
indices = EleFrontDataDescription("0", ShiftDepth=0, isNameSet=False)
flip_3 = FlipMatrix(Data=flip_2)
int_gap_btw_panels_2 = EleFrontDataDescription(int_gap_btw_panels, ShiftDepth=0, isNameSet=True)
cull_i = CullIndex(List=reverse(data), Indices=indices, Wrap=True)
neg = Negative(Value=int_gap_btw_panels_2)
crv_vertical_inner_curve = EleFrontDataDescription(cull_i, ShiftDepth=0, isNameSet=True)
crv_vertical_inner_curve_2 = EleFrontDataDescription(crv_vertical_inner_curve, ShiftDepth=0, isNameSet=False)
trim_2 = TrimTree(Tree=weave, Depth=1)
crv_horizontal_lines = EleFrontDataDescription(trim_2, ShiftDepth=0, isNameSet=True)
panel_2 = Panel("crv;odd_col_NW_dia")
crv_horizontal_lines_2 = EleFrontDataDescription(crv_horizontal_lines, ShiftDepth=0, isNameSet=False)
tstat = TreeStatistics(Tree=crv_horizontal_lines_2)  # -> Paths, Length, Count
dispatch_2 = Dispatch(List=tstat.Paths, DispatchPattern=[True, False])  # -> ListA, ListB
branch = TreeBranch(Tree=crv_horizontal_lines_2, Path=dispatch_2.ListA, MaintainPaths=True)
branch_2 = TreeBranch(Tree=crv_horizontal_lines_2, Path=dispatch_2.ListB, MaintainPaths=True)
partition = PartitionList(List=branch, Size="3")
partition_2 = PartitionList(List=branch_2, Size="3")
item_3 = ListItem(List=partition_2, Index=0, Wrap=True)  # -> Item, Item1, Item2
item_4 = ListItem(List=partition, Index=0, Wrap=True)  # -> Item, Item1, Item2
line = Line(item_4.Item)
midpt_2 = CurveMiddle(Curve=item_4.Item1)
end = EndPoints(Curve=item_4.Item2)  # -> Start, End
end_2 = EndPoints(Curve=item_4.Item)  # -> Start, End
end_3 = EndPoints(Curve=line)  # -> Start, End
end_4 = EndPoints(Curve=item_4.Item1)  # -> Start, End
midpt_3 = CurveMiddle(Curve=item_4.Item1)
end_5 = EndPoints(Curve=item_4.Item2)  # -> Start, End

midpt_4 = CurveMiddle(Curve=item_3.Item)
end_6 = EndPoints(Curve=item_3.Item)  # -> Start, End

midpt_5 = CurveMiddle(Curve=item_3.Item2)
end_7 = EndPoints(Curve=item_3.Item2)  # -> Start, End

end_8 = EndPoints(Curve=item_3.Item1)  # -> Start, End
midpoint = EleFrontDataDescription(midpt_2, ShiftDepth=0, isNameSet=False)
midpoint_2 = EleFrontDataDescription(midpoint, ShiftDepth=0, isNameSet=False)
midpoint_3 = EleFrontDataDescription(midpoint_2, ShiftDepth=0, isNameSet=False)
start = EleFrontDataDescription(end_2.Start, ShiftDepth=0, isNameSet=False)
start_2 = EleFrontDataDescription(start, ShiftDepth=0, isNameSet=False)
start_3 = EleFrontDataDescription(start_2, ShiftDepth=0, isNameSet=False)
end_9 = EleFrontDataDescription(end.End, ShiftDepth=0, isNameSet=False)
end_10 = EleFrontDataDescription(end_9, ShiftDepth=0, isNameSet=False)
end_11 = EleFrontDataDescription(end_10, ShiftDepth=0, isNameSet=False)
midpoint_4 = EleFrontDataDescription(midpt_2, ShiftDepth=0, isNameSet=False)
midpoint_5 = EleFrontDataDescription(midpoint_4, ShiftDepth=0, isNameSet=False)
midpoint_6 = EleFrontDataDescription(midpoint_5, ShiftDepth=0, isNameSet=False)
midpoint_7 = EleFrontDataDescription(midpt_2, ShiftDepth=0, isNameSet=False)
midpoint_8 = EleFrontDataDescription(midpoint_7, ShiftDepth=0, isNameSet=False)
midpoint_9 = EleFrontDataDescription(midpoint_8, ShiftDepth=0, isNameSet=False)
start_4 = EleFrontDataDescription(end.Start, ShiftDepth=0, isNameSet=False)
start_5 = EleFrontDataDescription(start_4, ShiftDepth=0, isNameSet=False)
start_6 = EleFrontDataDescription(start_5, ShiftDepth=0, isNameSet=False)
end_12 = EleFrontDataDescription(end_2.End, ShiftDepth=0, isNameSet=False)
end_13 = EleFrontDataDescription(end_12, ShiftDepth=0, isNameSet=False)
end_14 = EleFrontDataDescription(end_13, ShiftDepth=0, isNameSet=False)
midpoint_10 = EleFrontDataDescription(midpt_2, ShiftDepth=0, isNameSet=False)
midpoint_11 = EleFrontDataDescription(midpoint_10, ShiftDepth=0, isNameSet=False)
midpoint_12 = EleFrontDataDescription(midpoint_11, ShiftDepth=0, isNameSet=False)
ln = Line(StartPoint=midpoint_3, EndPoint=start_3)
ln_2 = Line(StartPoint=end_11, EndPoint=midpoint_6)
ln_3 = Line(StartPoint=midpoint_9, EndPoint=start_6)
ln_4 = Line(StartPoint=end_14, EndPoint=midpoint_12)

crv_odd_col_nw_dia = EleFrontDataDescription(ln_2, ShiftDepth=0, isNameSet=True)
crv_odd_col_sw_dia = EleFrontDataDescription(ln_4, ShiftDepth=0, isNameSet=True)
crv_odd_col_ne_dia = EleFrontDataDescription(ln_3, ShiftDepth=0, isNameSet=True)
crv_odd_col_se_dia = EleFrontDataDescription(ln, ShiftDepth=0, isNameSet=True)

crv_odd_col_nw_dia_2 = EleFrontDataDescription(crv_odd_col_nw_dia, ShiftDepth=0, isNameSet=False)
crv_odd_col_sw_dia_2 = EleFrontDataDescription(crv_odd_col_sw_dia, ShiftDepth=0, isNameSet=False)
crv_odd_col_se_dia_2 = EleFrontDataDescription(crv_odd_col_se_dia, ShiftDepth=0, isNameSet=False)
crv_odd_col_ne_dia_2 = EleFrontDataDescription(crv_odd_col_ne_dia, ShiftDepth=0, isNameSet=False)
crv_odd_col_se_dia_3 = EleFrontDataDescription(crv_odd_col_se_dia_2, ShiftDepth=0, isNameSet=False)
crv_odd_col_nw_dia_3 = EleFrontDataDescription(crv_odd_col_nw_dia_2, ShiftDepth=0, isNameSet=False)
crv_odd_col_sw_dia_3 = EleFrontDataDescription(crv_odd_col_sw_dia_2, ShiftDepth=0, isNameSet=False)
crv_odd_col_ne_dia_3 = EleFrontDataDescription(crv_odd_col_ne_dia_2, ShiftDepth=0, isNameSet=False)

merge_2 = Merge(Data1=midpt_5, Data2=end_7.End, Data3=end_8.End)
merge_3 = Merge(Data1=midpt_4, Data2=end_8.End, Data3=midpt_5, Data4=end_8.Start)
merge_4 = Merge(Data1=end_8.End, Data2=end_8.Start, Data3=midpt_5)
merge_5 = Merge(Data1=end_6.End, Data2=midpt_4, Data3=end_8.End)
merge_6 = Merge(Data1=midpt_4, Data2=end_8.Start, Data3=end_8.End)
merge_7 = Merge(Data1=midpt_4, Data2=end_6.Start, Data3=end_8.Start)
merge_8 = Merge(Data1=end_7.Start, Data2=midpt_5, Data3=end_8.Start)

merge_9 = Merge(Data1=item_4.Item2, Data2=crv_odd_col_nw_dia_3, Data3=crv_odd_col_ne_dia_3)
merge_10 = Merge(Data1=end_3.End, Data2=end_4.End, Data3=midpt_3)
merge_11 = Merge(Data1=midpt_3, Data2=end_4.Start, Data3=end_3.Start)
merge_12 = Merge(Data1=end_4.End, Data2=end_5.End, Data3=midpt_3)
merge_13 = Merge(Data1=midpt_3, Data2=end_5.Start, Data3=end_4.Start)
merge_14 = Merge(Data1=item_4.Item, Data2=crv_odd_col_sw_dia_3, Data3=crv_odd_col_se_dia_3)

pline_2 = PolyLine(Vertices=merge_10, Closed=invert(False))
pline_3 = PolyLine(Vertices=merge_12, Closed=invert(False))
pline_4 = PolyLine(Vertices=merge_11, Closed=invert(False))
pline_5 = PolyLine(Vertices=merge_13, Closed=invert(False))
join = JoinCurves(Curves=merge_14, Preserve=False)
join_2 = JoinCurves(Curves=merge_9, Preserve=False)

entwine = Entwine(
    Branch0X=merge_5,
    Branch1X=merge_6,
    Branch2X=merge_7,
    Branch3X=merge_8,
    Branch4X=merge_4,
    Branch5X=merge_2,
    FlattenInputs=False)
int_grid_rep_4 = EleFrontDataDescription(int_grid_rep, ShiftDepth=0, isNameSet=False)

odd_column_sw_triangle = EleFrontDataDescription(simplify(pline_2), ShiftDepth=0, isNameSet=True)
odd_column_nw_triangle = EleFrontDataDescription(simplify(pline_3), ShiftDepth=0, isNameSet=True)
odd_column_ne_triangle = EleFrontDataDescription(simplify(pline_5), ShiftDepth=0, isNameSet=True)
odd_column_n_triangle = EleFrontDataDescription(simplify(join_2), ShiftDepth=0, isNameSet=True)
odd_column_se_triangle = EleFrontDataDescription(simplify(pline_4), ShiftDepth=0, isNameSet=True)
odd_column_s_triangle = EleFrontDataDescription(simplify(join), ShiftDepth=0, isNameSet=True)

division = Division(A=int_grid_rep_4, B=2)
pline_6 = PolyLine(Vertices=merge_3, Closed=invert(False))
pline_7 = PolyLine(Vertices=entwine, Closed=invert(False))  # -> simplify(Polyline)
multiplication = Multiplication(A=int_grid_rep_4, B=division)
crv_odd_col_dia = EleFrontDataDescription(pline_6, ShiftDepth=0, isNameSet=True)
trim_3 = TrimTree(Tree=pline_7, Depth=1)
odd_column_nw_triangle_2 = EleFrontDataDescription(odd_column_nw_triangle, ShiftDepth=0, isNameSet=False)
odd_column_sw_triangle_2 = EleFrontDataDescription(odd_column_sw_triangle, ShiftDepth=0, isNameSet=False)
odd_column_se_triangle_2 = EleFrontDataDescription(odd_column_se_triangle, ShiftDepth=0, isNameSet=False)
odd_column_ne_triangle_2 = EleFrontDataDescription(odd_column_ne_triangle, ShiftDepth=0, isNameSet=False)
odd_column_s_triangle_2 = EleFrontDataDescription(odd_column_s_triangle, ShiftDepth=0, isNameSet=False)
odd_column_n_triangle_2 = EleFrontDataDescription(odd_column_n_triangle, ShiftDepth=0, isNameSet=False)
path_mapper = PathMapper(trim_3, source="{A;B}(i)", target="{i;B}(a)")
crv_odd_col_dia_2 = EleFrontDataDescription(crv_odd_col_dia, ShiftDepth=0, isNameSet=False)

crv_odd_col_nw_dia_4 = EleFrontDataDescription(crv_odd_col_nw_dia, ShiftDepth=0, isNameSet=False)
crv_odd_col_sw_dia_4 = EleFrontDataDescription(crv_odd_col_sw_dia, ShiftDepth=0, isNameSet=False)
crv_odd_col_ne_dia_4 = EleFrontDataDescription(crv_odd_col_ne_dia, ShiftDepth=0, isNameSet=False)
crv_odd_col_se_dia_4 = EleFrontDataDescription(crv_odd_col_se_dia, ShiftDepth=0, isNameSet=False)
crv_horizontal_lines_3 = EleFrontDataDescription(crv_horizontal_lines, ShiftDepth=0, isNameSet=False)
int_gap_btw_panels_3 = EleFrontDataDescription(int_gap_btw_panels, ShiftDepth=0, isNameSet=True)
crv_vertical_inner_curve_3 = EleFrontDataDescription(crv_vertical_inner_curve, ShiftDepth=0, isNameSet=False)
crv_odd_col_dia_3 = EleFrontDataDescription(crv_odd_col_dia, ShiftDepth=0, isNameSet=False)

merge_15 = Merge(
    Data1=odd_column_sw_triangle_2,
    Data2=odd_column_s_triangle_2,
    Data3=odd_column_se_triangle_2,
    Data4=odd_column_ne_triangle_2,
    Data5=odd_column_n_triangle_2,
    Data6=odd_column_nw_triangle_2)
neg_2 = Negative(Value=int_gap_btw_panels_3)
explode_2 = Explode(Curve=crv_odd_col_dia_3, Recursive=True)  # -> Segments, Vertices
ext = ExtendCurve(Curve=crv_horizontal_lines_3, Type=0, Start=neg_2, End=neg_2)

crv_odd_column_triangles = EleFrontDataDescription(merge_15, ShiftDepth=0, isNameSet=True)
crv_odd_column_triangles_2 = EleFrontDataDescription(path_mapper, ShiftDepth=0, isNameSet=True)

crv_odd_column_triangles_3 = EleFrontDataDescription(crv_odd_column_triangles, ShiftDepth=0, isNameSet=False)
crv_odd_column_triangles_4 = EleFrontDataDescription(crv_odd_column_triangles_2, ShiftDepth=0, isNameSet=False)

entwine_2 = Entwine(Branch0X=crv_odd_column_triangles_3, Branch1X=crv_odd_column_triangles_4, FlattenInputs=False)
area = Area(Geometry=entwine_2)  # -> Area, Centroid
xy = XYPlane(Origin=area.Centroid)
offset = OffsetCurve(Curve=entwine_2, Distance=int_gap_btw_panels_2, Plane=xy, Corners=1)
offset_2 = OffsetCurve(Curve=entwine_2, Distance=neg, Plane=xy, Corners=1)
merge_16 = Merge(Data1=offset, Data2=offset_2)
sort = SortList(Keys=merge_16, ValuesA=merge_16)  # -> Keys, ValuesA
item_5 = ListItem(List=sort.ValuesA, Index=0, Wrap=True)
crv_offseted_panels = EleFrontDataDescription(item_5, ShiftDepth=0, isNameSet=True)
crv_offseted_panels_2 = EleFrontDataDescription(crv_offseted_panels, ShiftDepth=0, isNameSet=False)
crv_offseted_panels_3 = EleFrontDataDescription(crv_offseted_panels_2, ShiftDepth=0, isNameSet=False)
crv_offseted_panels_4 = EleFrontDataDescription(crv_offseted_panels_3, ShiftDepth=0, isNameSet=False)
trim_4 = TrimTree(Tree=crv_offseted_panels_4, Depth=1)
tstat_2 = TreeStatistics(Tree=trim_4)  # -> Paths, Length, Count
partition_3 = PartitionList(List=tstat_2.Paths, Size=multiplication)
flip_4 = FlipMatrix(Data=partition_3)
item_6 = ListItem(List=flip_4, Index=0, Wrap=True)  # -> Item, Item1
flip_5 = FlipMatrix(Data=item_6.Item)
flip_6 = FlipMatrix(Data=item_6.Item1)

branch_3 = TreeBranch(Tree=trim_4, Path=flip_5, MaintainPaths=True)
branch_4 = TreeBranch(Tree=trim_4, Path=flip_6, MaintainPaths=True)

flatten = FlattenTree(Tree=[branch_3, branch_4], Path="{0}")
fillet = Fillet(Curve=flatten, Radius=Slider(1, range=0..10))
neg_3 = Negative(Value=int_gap_btw_panels_3)
entwine_3 = Entwine(
    Branch00=crv_odd_col_sw_dia_4,
    Branch01=crv_odd_col_se_dia_4,
    Branch02=crv_odd_col_nw_dia_4,
    Branch03=crv_odd_col_ne_dia_4,
    Branch04=explode_2.Segments,
    FlattenInputs=True)  # -> flatten(Result)
lng = ListLength(List=ext)
Y = UnitY(Factor=int_gap_btw_panels_3)
ext_2 = ExtendCurve(Curve=crv_vertical_inner_curve_3, Type=0, Start=neg_3, End=neg_3)
subtraction = Subtraction(A=lng, B=1)
ext_3 = ExtendCurve(Curve=graft(entwine_3), Type=0, Start=neg_3, End=neg_3)
X = UnitX(Factor=int_gap_btw_panels_3)
merge_17 = Merge(Data1="0", Data2=subtraction)  # -> flatten(Result)
end_15 = EndPoints(Curve=ext_3)  # -> Start, End
cull_i_2 = CullIndex(List=ext, Indices=merge_17, Wrap=True)  # -> graft(List)
vec2pt = Vector2Pt(PointA=end_15.Start, PointB=end_15.End, Unitize=False)  # -> Vector, Length
rev = Reverse(Vector=Y)
boundary = BoundarySurfaces(Edges=fillet)
Z = UnitZ(Factor=1)
rev_2 = Reverse(Vector=X)
Z_2 = UnitZ(Factor=Slider(2, range=0..10))
move = Move(Geometry=cull_i_2, Motion=Y)  # -> Geometry, Transform
move_2 = Move(Geometry=cull_i_2, Motion=rev)  # -> Geometry, Transform
srf_triangle = EleFrontDataDescription(boundary, ShiftDepth=0, isNameSet=True)
vrot = Rotate(Vector=vec2pt.Vector, Axis=Z, Angle="Pi/2")
move_3 = Move(Geometry=ext_2, Motion=X)  # -> Geometry, Transform
move_4 = Move(Geometry=ext_2, Motion=rev_2)  # -> Geometry, Transform
srf_triangle_2 = EleFrontDataDescription(srf_triangle, ShiftDepth=0, isNameSet=False)
amp = Amplitude(Vector=vrot, Amplitude=int_gap_btw_panels_3)
extr = Extrude(Base=srf_triangle_2, Direction=Z_2)
rev_3 = Reverse(Vector=amp)
merge_18 = Merge(Data1=move_2.Geometry, Data2=cull_i_2, Data3=move.Geometry)
merge_19 = Merge(Data1=move_4.Geometry, Data2=ext_2, Data3=move_3.Geometry)
graft = GraftTree(Tree=entwine_3, IncludeEmptyLists=True, IncludeNullItems=True)
move_5 = Move(Geometry=ext_3, Motion=amp)  # -> Geometry, Transform
move_6 = Move(Geometry=ext_3, Motion=rev_3)  # -> Geometry, Transform
dispatch_3 = Dispatch(List=merge_18, DispatchPattern=[True, False])  # -> graft(ListA), graft(ListB)
sld_triangles = EleFrontDataDescription(extr, ShiftDepth=0, isNameSet=True)
dispatch_4 = Dispatch(List=merge_19, DispatchPattern=[True, False])  # -> graft(ListA), graft(ListB)
divide = DivideCurve(Curve=dispatch_3.ListA, Count="12", Kinks=False)  # -> Points, Tangents, Parameters
divide_2 = DivideCurve(Curve=dispatch_3.ListB, Count="12", Kinks=False)  # -> Points, Tangents, Parameters
merge_20 = Merge(Data1=move_5.Geometry, Data2=graft, Data3=move_6.Geometry)
divide_3 = DivideCurve(Curve=dispatch_4.ListA, Count="12", Kinks=False)  # -> Points, Tangents, Parameters
divide_4 = DivideCurve(Curve=dispatch_4.ListB, Count="12", Kinks=False)  # -> Points, Tangents, Parameters
dispatch_5 = Dispatch(List=merge_20, DispatchPattern=[True, False])  # -> graft(ListA), graft(ListB)
divide_5 = DivideCurve(Curve=dispatch_5.ListA, Count="12", Kinks=False)  # -> Points, Tangents, Parameters
divide_6 = DivideCurve(Curve=dispatch_5.ListB, Count="12", Kinks=False)  # -> Points, Tangents, Parameters

shatter = Shatter(Curve=dispatch_3.ListA, Parameters=divide.Parameters)
shatter_2 = Shatter(Curve=dispatch_3.ListB, Parameters=divide_2.Parameters)

shatter_3 = Shatter(Curve=dispatch_4.ListA, Parameters=divide_3.Parameters)
shatter_4 = Shatter(Curve=dispatch_4.ListB, Parameters=divide_4.Parameters)

shatter_5 = Shatter(Curve=dispatch_5.ListA, Parameters=divide_5.Parameters)
shatter_6 = Shatter(Curve=dispatch_5.ListB, Parameters=divide_6.Parameters)

ext_4 = ExtendCurve(Curve=shatter, Type=0, Start="-1", End="-1")
ext_5 = ExtendCurve(Curve=shatter_2, Type=0, Start="-1", End="-1")
ext_6 = ExtendCurve(Curve=shatter_3, Type=0, Start="-1", End="-1")
ext_7 = ExtendCurve(Curve=shatter_4, Type=0, Start="-1", End="-1")
ext_8 = ExtendCurve(Curve=shatter_5, Type=0, Start="-1", End="-1")
ext_9 = ExtendCurve(Curve=shatter_6, Type=0, Start="-1", End="-1")
int_gap_btw_panels_4 = EleFrontDataDescription(int_gap_btw_panels, ShiftDepth=0, isNameSet=True)
dispatch_6 = Dispatch(List=ext_5, DispatchPattern=[True, False])  # -> ListA, graft(ListB)
dispatch_7 = Dispatch(List=ext_4, DispatchPattern=[True, False])  # -> graft(ListA), ListB
int_gap_btw_panels_5 = EleFrontDataDescription(int_gap_btw_panels, ShiftDepth=0, isNameSet=True)
dispatch_8 = Dispatch(List=ext_7, DispatchPattern=[True, False])  # -> ListA, graft(ListB)
dispatch_9 = Dispatch(List=ext_6, DispatchPattern=[True, False])  # -> graft(ListA), ListB
division_2 = Division(A=int_gap_btw_panels_4, B=3)
neg_4 = Negative(Value=division_2)
division_3 = Division(A=int_gap_btw_panels_5, B=3)
neg_5 = Negative(Value=division_3)
offset_3 = OffsetCurve(Curve=dispatch_7.ListA, Distance=[division_2, neg_4], Corners=1)
offset_4 = OffsetCurve(Curve=dispatch_6.ListB, Distance=[division_2, neg_4], Corners=1)
int_gap_btw_panels_6 = EleFrontDataDescription(int_gap_btw_panels, ShiftDepth=0, isNameSet=True)
dispatch_10 = Dispatch(List=ext_9, DispatchPattern=[True, False])  # -> ListA, graft(ListB)
dispatch_11 = Dispatch(List=ext_8, DispatchPattern=[True, False])  # -> graft(ListA), ListB
offset_5 = OffsetCurve(Curve=dispatch_9.ListA, Distance=[division_3, neg_5], Corners=1)
offset_6 = OffsetCurve(Curve=dispatch_8.ListB, Distance=[division_3, neg_5], Corners=1)
trim_5 = TrimTree(Tree=offset_3, Depth=1)
trim_6 = TrimTree(Tree=offset_4, Depth=1)
division_4 = Division(A=int_gap_btw_panels_6, B=3)
trim_7 = TrimTree(Tree=offset_5, Depth=1)
trim_8 = TrimTree(Tree=offset_6, Depth=1)
item_7 = ListItem(List=trim_5, Index=0, Wrap=True)  # -> Item, Item1
item_8 = ListItem(List=trim_6, Index=0, Wrap=True)  # -> Item, Item1
neg_6 = Negative(Value=division_4)
item_9 = ListItem(List=trim_7, Index=0, Wrap=True)  # -> Item, Item1
item_10 = ListItem(List=trim_8, Index=0, Wrap=True)  # -> Item, Item1
flip_7 = FlipCurve(Curve=item_7.Item)  # -> Curve, Flag
flip_8 = FlipCurve(Curve=item_8.Item)  # -> Curve, Flag
offset_7 = OffsetCurve(Curve=dispatch_11.ListA, Distance=[division_4, neg_6], Corners=1)
offset_8 = OffsetCurve(Curve=dispatch_10.ListB, Distance=[division_4, neg_6], Corners=1)
flip_9 = FlipCurve(Curve=item_9.Item)  # -> Curve, Flag
flip_10 = FlipCurve(Curve=item_10.Item)  # -> Curve, Flag
trim_9 = TrimTree(Tree=offset_7, Depth=1)
trim_10 = TrimTree(Tree=offset_8, Depth=1)
item_11 = ListItem(List=trim_9, Index=0, Wrap=True)  # -> Item, Item1
item_12 = ListItem(List=trim_10, Index=0, Wrap=True)  # -> Item, Item1
connect = ConnectCurves(Curves=[flip_7.Curve, item_7.Item1], Continuity=2, Close=True, Bulge=1)
connect_2 = ConnectCurves(Curves=[flip_8.Curve, item_8.Item1], Continuity=2, Close=True, Bulge=1)
connect_3 = ConnectCurves(Curves=[flip_9.Curve, item_9.Item1], Continuity=2, Close=True, Bulge=1)
connect_4 = ConnectCurves(Curves=[flip_10.Curve, item_10.Item1], Continuity=2, Close=True, Bulge=1)
flip_11 = FlipCurve(Curve=item_11.Item)  # -> Curve, Flag
flip_12 = FlipCurve(Curve=item_12.Item)  # -> Curve, Flag
connect_5 = ConnectCurves(Curves=[flip_11.Curve, item_11.Item1], Continuity=2, Close=True, Bulge=1)
connect_6 = ConnectCurves(Curves=[flip_12.Curve, item_12.Item1], Continuity=2, Close=True, Bulge=1)
entwine_4 = Entwine(Branch00=connect_5, Branch01=connect_6, FlattenInputs=True)  # -> flatten(Result)
entwine_5 = Entwine(Branch00=connect, Branch01=connect_2, Branch02=connect_3, Branch03=connect_4, FlattenInputs=True)  # -> flatten(Result)
runion = RegionUnion(Curves=entwine_4)  # disabled
xy_2 = XYPlane(Origin=Point(0, 0, 0))  # disabled
runion_2 = RegionUnion(Curves=entwine_5, Plane=xy_2)  # disabled
entwine_6 = Entwine(Branch00=runion_2, Branch01=runion, FlattenInputs=True)  # -> flatten(Result); disabled
runion_3 = RegionUnion(Curves=entwine_6)  # disabled
bbox = BoundingBox(Content=runion_3, Plane=PlaneXY(0, 0, 0), UnionBox=True)  # -> Box, Box_2; disabled
sec = BrepPlane(Brep=bbox.Box, Plane=PlaneXY(0, 0, 0))  # -> Curves, Points; disabled
panel_3 = Panel("1")  # disabled
offset_9 = OffsetCurve(Curve=sec.Curves, Distance=panel_3, Corners=1)  # disabled
number_slider = Slider(0.3, range=0..2)  # disabled
entwine_7 = Entwine(Branch00=runion_3, Branch01=offset_9, FlattenInputs=True)  # -> flatten(Result); disabled
sld_triangles_2 = EleFrontDataDescription(sld_triangles, ShiftDepth=0, isNameSet=False)  # disabled
boundary_2 = BoundarySurfaces(Edges=entwine_7)  # disabled
Z_3 = UnitZ(Factor=number_slider)  # disabled
extr_2 = Extrude(Base=boundary_2, Direction=Z_3)  # disabled
move_7 = Move(Geometry=sld_triangles_2, Motion=Z_3)  # -> Geometry, Transform; disabled
