# Grasshopper definition 02_RadialFold.gh (Grasshopper 1.0.8)
# plug-ins: eleFront

cir = Circle(Plane=PlaneXY(0, 0, 0), Radius="50")
cir_2 = Circle(Plane=PlaneXY(0, 0, 0), Radius="100")
divide = DivideCurve(Curve=cir, Count="30", Kinks=False)  # -> Points, Tangents, Parameters
crv_cp = CurveClosestPoint(Point=divide.Points, Curve=cir_2)  # -> Point, Parameter, Distance
shatter = Shatter(Curve=cir, Parameters=divide.Parameters)
shatter_2 = Shatter(Curve=cir_2, Parameters=crv_cp.Parameter)
cull_i = CullIndex(List=shatter, Indices="0", Wrap=True)
cull_i_2 = CullIndex(List=shatter_2, Indices="0", Wrap=True)
join = JoinCurves(Curves=cull_i_2, Preserve=False)
join_2 = JoinCurves(Curves=cull_i, Preserve=False)
crv_outer_open_end_circle = EleFrontDataDescription(join, ShiftDepth=0, isNameSet=True)
crv_inner_open_end_circle = EleFrontDataDescription(join_2, ShiftDepth=0, isNameSet=True)

crv_outer_open_end_circle_2 = EleFrontDataDescription(crv_outer_open_end_circle, ShiftDepth=0, isNameSet=False)
crv_outer_open_end_circle_3 = EleFrontDataDescription(crv_outer_open_end_circle, ShiftDepth=0, isNameSet=False)
crv_inner_open_end_circle_2 = EleFrontDataDescription(crv_inner_open_end_circle, ShiftDepth=0, isNameSet=False)
crv_inner_open_end_circle_3 = EleFrontDataDescription(crv_inner_open_end_circle, ShiftDepth=0, isNameSet=False)

explode = Explode(Curve=crv_outer_open_end_circle_2, Recursive=True)  # -> Segments, Vertices
explode_2 = Explode(Curve=crv_inner_open_end_circle_2, Recursive=True)  # -> Segments, Vertices
end = EndPoints(Curve=crv_outer_open_end_circle_3)  # -> Start, End
end_2 = EndPoints(Curve=crv_inner_open_end_circle_3)  # -> Start, End
vec2pt = Vector2Pt(PointA=explode_2.Vertices, PointB=explode.Vertices, Unitize=False)  # -> Vector, Length
Z = UnitZ(Factor=1)
ln = Line(StartPoint=end_2.End, EndPoint=end.End)
ln_2 = Line(StartPoint=end_2.Start, EndPoint=end.Start)
ln_3 = Line(StartPoint=explode_2.Vertices, EndPoint=explode.Vertices)
vrot = Rotate(Vector=vec2pt.Vector, Axis=Z, Angle="Pi/2")
join_3 = JoinCurves(Curves=[crv_inner_open_end_circle_3, crv_outer_open_end_circle_3, ln_2, ln], Preserve=False)
panel = Panel("""-1
1""")
graft = GraftTree(Tree=ln_3, IncludeEmptyLists=True, IncludeNullItems=True)
graft_2 = GraftTree(Tree=vrot, IncludeEmptyLists=True, IncludeNullItems=True)
crv_base_plate = EleFrontDataDescription(join_3, ShiftDepth=0, isNameSet=True)
amp = Amplitude(Vector=graft_2, Amplitude=panel)
move = Move(Geometry=graft, Motion=amp)  # -> Geometry, Transform
crv_base_plate_2 = EleFrontDataDescription(crv_base_plate, ShiftDepth=0, isNameSet=False)
tstat = TreeStatistics(Tree=move.Geometry)  # -> Paths, Length, Count
subtraction = Subtraction(A=tstat.Count, B=1)
item = ListItem(List=tstat.Paths, Index=0, Wrap=True)  # -> Item1, Item
cull_i_3 = CullIndex(List=tstat.Paths, Indices=subtraction, Wrap=True)
merge = Merge(Data1=item.Item, Data2=item.Item1)
cull_i_4 = CullIndex(List=cull_i_3, Indices="0", Wrap=True)
branch = TreeBranch(Tree=move.Geometry, Path=cull_i_4, MaintainPaths=True)
branch_2 = TreeBranch(Tree=graft, Path=merge, MaintainPaths=True)
merge_2 = Merge(Data1=branch, Data2=branch_2)

crv_outer_open_end_circle_4 = EleFrontDataDescription(crv_outer_open_end_circle, ShiftDepth=0, isNameSet=False)
crv_inner_open_end_circle_4 = EleFrontDataDescription(crv_inner_open_end_circle, ShiftDepth=0, isNameSet=False)

flatten = FlattenTree(Tree=merge_2, Path="{0}")
item_2 = ListItem(List=flatten, Index=0, Wrap=True)  # -> Item, Item1, Item2
end_3 = EndPoints(Curve=flatten)  # -> Start, End
crv_cp_2 = CurveClosestPoint(Point=end_3.End, Curve=crv_outer_open_end_circle_4)  # -> Point, Parameter, Distance
crv_cp_3 = CurveClosestPoint(Point=end_3.Start, Curve=crv_inner_open_end_circle_4)  # -> Point, Parameter, Distance
neg = Negative(Value=crv_cp_2.Distance)
ext = ExtendCurve(Curve=flatten, Type=0, Start=crv_cp_3.Distance, End=neg)
shatter_3 = Shatter(Curve=crv_inner_open_end_circle_4, Parameters=crv_cp_3.Parameter)
shatter_4 = Shatter(Curve=crv_outer_open_end_circle_4, Parameters=crv_cp_2.Parameter)
dispatch = Dispatch(List=shatter_4, DispatchPattern=[True, False])  # -> ListA, ListB
dispatch_2 = Dispatch(List=shatter_3, DispatchPattern=[True, False])  # -> ListA, ListB
partition = PartitionList(List=ext, Size="2")  # -> simplify(Chunks)
graft_3 = GraftTree(Tree=dispatch_2.ListA, IncludeEmptyLists=True, IncludeNullItems=True)  # -> simplify(Tree)
graft_4 = GraftTree(Tree=dispatch.ListA, IncludeEmptyLists=True, IncludeNullItems=True)  # -> simplify(Tree)
merge_3 = Merge(Data1=partition, Data2=graft_3, Data3=graft_4)
crv_base_plate_3 = EleFrontDataDescription(crv_base_plate_2, ShiftDepth=0, isNameSet=False)
join_4 = JoinCurves(Curves=merge_3, Preserve=False)
fillet = FilletDistance(Curve=crv_base_plate_3, Distance=Slider(6, range=0..100))
Z_2 = UnitZ(Factor=Slider(0.1, range=0..1))
fillet_2 = FilletDistance(Curve=join_4, Distance=Slider(6, range=0..100))
boundary = BoundarySurfaces(Edges=fillet)
move_2 = Move(Geometry=fillet_2, Motion=Z_2)  # -> Geometry, Transform
extr = Extrude(Base=boundary, Direction=Z_2)
sld_base_plate = EleFrontDataDescription(extr, ShiftDepth=0, isNameSet=True)
boundary_2 = BoundarySurfaces(Edges=move_2.Geometry)
Z_3 = UnitZ(Factor=Slider(0.3, range=0..1))
extr_2 = Extrude(Base=boundary_2, Direction=Z_3)
sld_panels = EleFrontDataDescription(extr_2, ShiftDepth=0, isNameSet=False)

sld_base_plate_2 = EleFrontDataDescription(sld_base_plate, ShiftDepth=0, isNameSet=False)
sld_panels_2 = EleFrontDataDescription(sld_panels, ShiftDepth=0, isNameSet=True)

layer = ModelLayer()
col = Colour(RGB(0, 240, 208))
col_2 = Colour(RGB(240, 0, 240))
color = DefineColor(Source="object")
color_2 = DefineColor(Color=col_2, Source="object")
color_3 = DefineColor(Color=col, Source="object")
ef_att = EleFrontAttributes(Name="Layer1", Layer="Layer1", ColourSource="Object", ObjectColour=col_2)  # -> Attributes, Keys, Values, Name, Layer, ColourSource, DisplayColour, MaterialSource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
ef_att_2 = EleFrontAttributes(Name="Layer2", Layer="Layer2", ColourSource="Object", ObjectColour=col)  # -> Attributes, Keys, Values, Name, Layer, ColourSource, DisplayColour, MaterialSource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
tstat_2 = TreeStatistics(Tree=sld_panels_2)  # -> Paths, Length, Count
tstat_3 = TreeStatistics(Tree=sld_base_plate_2)  # -> Paths, Length, Count
button = Button()
repeat = RepeatData(Data=ef_att.Attributes, Length=tstat_2.Length)
repeat_2 = RepeatData(Data=ef_att_2.Attributes, Length=tstat_3.Length)
bake = BakeObjects(Geometry=sld_panels_2, Attributes=repeat, BakeName=ef_att.Name, Bake=button, createGroups=False)  # -> Message, Ghosts
bake_2 = BakeObjects(Geometry=sld_base_plate_2, Attributes=repeat_2, BakeName=ef_att_2.Name, Bake=button, createGroups=False)  # -> Message, Ghosts
