# Grasshopper definition 03_Hubermann.gh (Grasshopper 1.0.8)
# plug-ins: eleFront

panel = Panel("crv;outer_circle")
xy = XYPlane(Origin=Point(0, 0, 0))
X = UnitX(Factor=1)
jointcapthk = Panel("1")
jointheadthk = Panel("2")
int_bridge_division_number = EleFrontDataDescription(Slider(12, range=0..50), ShiftDepth=0, isNameSet=True)
bridgewidth = Panel("5")
number_slider = Slider(15, range=10..20)
bridgethk = Panel("4")
int_bridge_division_number_2 = EleFrontDataDescription(int_bridge_division_number, ShiftDepth=0, isNameSet=False)

int_bridge_nesting_vertical_adj = EleFrontDataDescription(Slider(-9, range=-100..0), ShiftDepth=0, isNameSet=True)
int_num_of_rows = EleFrontDataDescription(Slider(2, range=2..10), ShiftDepth=0, isNameSet=True)
int_joint_cap_thk = EleFrontDataDescription(jointcapthk, ShiftDepth=0, isNameSet=True)
int_bridge_wdith = EleFrontDataDescription(bridgewidth, ShiftDepth=0, isNameSet=True)
int_bridge_thk = EleFrontDataDescription(bridgethk, ShiftDepth=0, isNameSet=True)
int_jointheadthk = EleFrontDataDescription(jointheadthk, ShiftDepth=0, isNameSet=True)
cir = Circle(Plane=PlaneXY(0, 0, 0), Radius="40")
cir_2 = Circle(Plane=PlaneXY(0, 0, 0), Radius="80")
cir_3 = Circle(Plane=PlaneXY(0, 0, 0), Radius="120")

line = LineSDL(Start=xy, Direction=X, Length="120")
int_bridge_thk_2 = EleFrontDataDescription(int_bridge_thk, ShiftDepth=0, isNameSet=False)
crv_mddle_circle = EleFrontDataDescription(cir_2, ShiftDepth=0, isNameSet=True)
crv_outer_circle = EleFrontDataDescription(cir_3, ShiftDepth=0, isNameSet=True)
crv_inner_circle = EleFrontDataDescription(cir, ShiftDepth=0, isNameSet=True)
multiplication = Multiplication(A=int_bridge_division_number_2, B=2)
int_jointheadthk_2 = EleFrontDataDescription(int_jointheadthk, ShiftDepth=0, isNameSet=False)
int_bridge_thk_3 = EleFrontDataDescription(int_bridge_thk_2, ShiftDepth=0, isNameSet=False)
arrpolar = PolarArray(Geometry=line, Plane=PlaneXY(0, 0, 0), Count=multiplication, Angle=6.283185307)  # -> Geometry, Transform
crv_mddle_circle_2 = EleFrontDataDescription(crv_mddle_circle, ShiftDepth=0, isNameSet=False)
crv_inner_circle_2 = EleFrontDataDescription(crv_inner_circle, ShiftDepth=0, isNameSet=False)
crv_outer_circle_2 = EleFrontDataDescription(crv_outer_circle, ShiftDepth=0, isNameSet=False)
dispatch = Dispatch(List=arrpolar.Geometry, DispatchPattern=[True, False])  # -> ListA, ListB
line_middle_constraint = EleFrontDataDescription(dispatch.ListB, ShiftDepth=0, isNameSet=False)
entwine = Entwine(Branch00=crv_inner_circle_2, Branch01=crv_outer_circle_2, FlattenInputs=True)
arrpolar_2 = PolarArray(Geometry=line, Plane=PlaneXY(0, 0, 0), Count=int_bridge_division_number_2, Angle=6.283185307)  # -> Geometry, Transform
crv_inner_outer_circle = EleFrontDataDescription(entwine, ShiftDepth=0, isNameSet=True)

line_middle_constraint_2 = EleFrontDataDescription(line_middle_constraint, ShiftDepth=0, isNameSet=True)
line_end_constraint = EleFrontDataDescription(arrpolar_2.Geometry, ShiftDepth=0, isNameSet=True)

line_end_constraint_2 = EleFrontDataDescription(line_end_constraint, ShiftDepth=0, isNameSet=False)
crv_inner_outer_circle_2 = EleFrontDataDescription(crv_inner_outer_circle, ShiftDepth=0, isNameSet=False)
crv_mddle_circle_3 = EleFrontDataDescription(crv_mddle_circle, ShiftDepth=0, isNameSet=False)
crvprox = CurveProximity(CurveA=crv_inner_outer_circle_2, CurveB=line_end_constraint_2)  # -> PointA, PointB, Distance
crvprox_2 = CurveProximity(CurveA=crv_mddle_circle_3, CurveB=line_middle_constraint_2)  # -> PointA, PointB, Distance
path_mapper = PathMapper(crvprox.PointA, source="{A;B}\t", target="{A;2*B}")
tstat = TreeStatistics(Tree=crvprox.PointA)  # -> Paths, Length, Count
dispatch_2 = Dispatch(List=tstat.Paths, DispatchPattern=[True, False])  # -> ListA, ListB
panel_2 = Panel(path_mapper)
branch = TreeBranch(Tree=crvprox.PointA, Path=dispatch_2.ListB, MaintainPaths=True)
branch_2 = TreeBranch(Tree=crvprox.PointA, Path=dispatch_2.ListA, MaintainPaths=True)
shift = ShiftList(List=branch_2, Shift="-1", Wrap=True)  # -> simplify(List)
shift_2 = ShiftList(List=branch_2, Shift=1, Wrap=True)  # -> simplify(List)
pshift = ShiftPaths(Data=shift, Offset=-1)
pshift_2 = ShiftPaths(Data=shift_2, Offset=-1)
path_mapper_2 = PathMapper(crvprox_2.PointA, source="{A;B}\t", target="{A;2*B+1}")
merge = Merge(Data1=pshift, Data2=branch)
merge_2 = Merge(Data1=pshift_2, Data2=branch)
path_mapper_3 = PathMapper(merge, source="{A;B}\t", target="{A;2*B}")
path_mapper_4 = PathMapper(merge_2, source="{A;B}\t", target="{A;2*B}")
shift_3 = ShiftList(List=path_mapper_2, Shift="-1", Wrap=True)
pshift_3 = ShiftPaths(Data=shift_3, Offset=-1)
merge_3 = Merge(Data1=path_mapper_3, Data2=pshift_3)
merge_4 = Merge(Data1=path_mapper_4, Data2=path_mapper_2)
flip = FlipMatrix(Data=merge_3)
flip_2 = FlipMatrix(Data=merge_4)
item = ListItem(List=flip, Index=0, Wrap=True)  # -> Item, Item1, Item2
int_bridge_thk_4 = EleFrontDataDescription(int_bridge_thk_3, ShiftDepth=0, isNameSet=False)
item_2 = ListItem(List=flip_2, Index=0, Wrap=True)  # -> Item, Item1, Item2
arc = Arc3Pt(PointA=item_2.Item, PointB=item_2.Item1, PointC=item_2.Item2)  # -> Arc, Plane, Radius
Z = UnitZ(Factor=int_bridge_thk_4)
arc_2 = Arc3Pt(PointA=item.Item, PointB=item.Item1, PointC=item.Item2)  # -> Arc, Plane, Radius

move = Move(Geometry=arc.Arc, Motion=Z)  # -> Geometry, Transform
move_2 = Move(Geometry=flip_2, Motion=Z)  # -> Geometry, Transform

int_bridge_wdith_2 = EleFrontDataDescription(int_bridge_wdith, ShiftDepth=0, isNameSet=False)
entwine_2 = Entwine(Branch00=move.Geometry, Branch01=arc_2.Arc, FlattenInputs=True)
entwine_3 = Entwine(Branch00=move_2.Geometry, Branch01=flip, FlattenInputs=True)
neg = Negative(Value=int_bridge_wdith_2)
merge_5 = Merge(Data1=int_bridge_wdith_2, Data2=neg)
graft = GraftTree(Tree=entwine_2, IncludeEmptyLists=True, IncludeNullItems=True)
partition = PartitionList(List=entwine_3, Size="3")

crv_moved_center_curve = EleFrontDataDescription(graft, ShiftDepth=0, isNameSet=True)
pts_moved_points = EleFrontDataDescription(partition, ShiftDepth=0, isNameSet=True)

flatten = FlattenTree(Tree=entwine_2, Path="{0}")
pts_moved_points_2 = EleFrontDataDescription(pts_moved_points, ShiftDepth=0, isNameSet=False)
crv_moved_center_curve_2 = EleFrontDataDescription(crv_moved_center_curve, ShiftDepth=0, isNameSet=False)
item_3 = ListItem(List=flatten, Index=0, Wrap=True)
item_4 = ListItem(List=pts_moved_points_2, Index=0, Wrap=True)  # -> Item, Item1, Item2
crv_bridge_base_crv = EleFrontDataDescription(flatten, ShiftDepth=0, isNameSet=True)
int_bridge_wdith_3 = EleFrontDataDescription(int_bridge_wdith, ShiftDepth=0, isNameSet=False)
multiplication_2 = Multiplication(A=int_bridge_wdith_3, B=1.5)
offset = OffsetCurve(Curve=crv_moved_center_curve_2, Distance=merge_5, Corners=1)
merge_6 = Merge(Data1=item_4.Item, Data2=item_4.Item1, Data3=item_4.Item2)
int_joint_outer_rad = EleFrontDataDescription(multiplication_2, ShiftDepth=0, isNameSet=True)
pt_joint_center = EleFrontDataDescription(merge_6, ShiftDepth=0, isNameSet=True)
int_joint_outer_rad_2 = EleFrontDataDescription(int_joint_outer_rad, ShiftDepth=0, isNameSet=False)
pt_joint_center_2 = EleFrontDataDescription(pt_joint_center, ShiftDepth=0, isNameSet=False)
trim = TrimTree(Tree=offset, Depth=1)
circle = CircleCNR(Center=pt_joint_center_2, Normal=Vector(0, 0, 1), Radius=int_joint_outer_rad_2)
crv_outer_circles = EleFrontDataDescription(circle, ShiftDepth=0, isNameSet=True)
item_5 = ListItem(List=trim, Index=0, Wrap=True)  # -> Item, Item1
crv_outer_circles_2 = EleFrontDataDescription(crv_outer_circles, ShiftDepth=0, isNameSet=False)
Z_2 = UnitZ(Factor=1)
Z_3 = UnitZ(Factor="-2")
move_3 = Move(Geometry=crv_outer_circles_2, Motion=Z_2)  # -> Geometry, Transform
extr = Extrude(Base=move_3.Geometry, Direction=Z_3)
scx = SurfaceCurve(Surface=extr, Curve=item_5.Item1)  # -> Curves, Points, UVPoints, Normals, Parameters, Tangents
scx_2 = SurfaceCurve(Surface=extr, Curve=item_5.Item)  # -> Curves, Points, UVPoints, Normals, Parameters, Tangents
trim_2 = TrimTree(Tree=scx.Parameters, Depth=1)
trim_3 = TrimTree(Tree=scx_2.Parameters, Depth=1)
merge_7 = Merge(Data1=scx_2.Points, Data2=scx.Points)
graft_2 = GraftTree(Tree=crv_outer_circles_2, IncludeEmptyLists=True, IncludeNullItems=True)
shatter = Shatter(Curve=item_5.Item, Parameters=trim_3)
shatter_2 = Shatter(Curve=item_5.Item1, Parameters=trim_2)
crv_cp = CurveClosestPoint(Point=merge_7, Curve=graft_2)  # -> Point, Parameter, Distance
sort = SortList(Keys=shatter, ValuesA=shatter)  # -> Keys, reverse(ValuesA)
sort_2 = SortList(Keys=shatter_2, ValuesA=shatter_2)  # -> Keys, reverse(ValuesA)
item_6 = ListItem(List=sort_2.ValuesA, Index=0, Wrap=True)  # -> Item, Item1
item_7 = ListItem(List=sort.ValuesA, Index=0, Wrap=True)  # -> Item, Item1
shatter_3 = Shatter(Curve=graft_2, Parameters=crv_cp.Parameter)  # -> simplify(Segments)
merge_8 = Merge(Data1=item_7.Item, Data2=item_7.Item1)  # -> simplify(Result)
merge_9 = Merge(Data1=item_6.Item, Data2=item_6.Item1)  # -> simplify(Result)
tstat_2 = TreeStatistics(Tree=shatter_3)  # -> Paths, Length, Count

crv_long_edge_1 = EleFrontDataDescription(merge_8, ShiftDepth=0, isNameSet=True)
crv_long_edge_2 = EleFrontDataDescription(merge_9, ShiftDepth=0, isNameSet=True)

equals = Equality(FirstNumber=tstat_2.Length, SecondNumber=2)  # -> Equality, Inequality
dispatch_3 = Dispatch(List=tstat_2.Paths, DispatchPattern=equals.Equality)  # -> ListA, ListB
pts_moved_points_3 = EleFrontDataDescription(pts_moved_points, ShiftDepth=0, isNameSet=False)
crv_moved_center_curve_3 = EleFrontDataDescription(crv_moved_center_curve, ShiftDepth=0, isNameSet=False)
branch_3 = TreeBranch(Tree=shatter_3, Path=dispatch_3.ListA, MaintainPaths=True)
branch_4 = TreeBranch(Tree=shatter_3, Path=dispatch_3.ListB, MaintainPaths=True)
item_8 = ListItem(List=pts_moved_points_3, Index="1", Wrap=True)
sort_3 = SortList(Keys=branch_3, ValuesA=branch_3)  # -> Keys, reverse(ValuesA)
crv_cp_2 = CurveClosestPoint(Point=item_8, Curve=crv_moved_center_curve_3)  # -> Point, Parameter, Distance
pframe = PerpFrame(Curve=crv_moved_center_curve_3, Parameter=crv_cp_2.Parameter)
pcx = CurvePlane(Curve=branch_4, Plane=pframe)  # -> Points, ParamsC, ParamsP
graft_3 = GraftTree(Tree=branch_4, IncludeEmptyLists=True, IncludeNullItems=True)
tstat_3 = TreeStatistics(Tree=pcx.Points)  # -> Paths, Length, Count
dispatch_4 = Dispatch(List=tstat_3.Paths, DispatchPattern=tstat_3.Length)  # -> ListA, ListB
branch_5 = TreeBranch(Tree=graft_3, Path=dispatch_4.ListA, MaintainPaths=True)
item_9 = ListItem(List=sort_3.ValuesA, Index=0, Wrap=True)

crv_bridge_end_round = EleFrontDataDescription(item_9, ShiftDepth=0, isNameSet=True)
crv_bridge_middle_round = EleFrontDataDescription(branch_5, ShiftDepth=0, isNameSet=True)

crv_bridge_middle_round_2 = EleFrontDataDescription(crv_bridge_middle_round, ShiftDepth=0, isNameSet=False)
crv_bridge_end_round_2 = EleFrontDataDescription(crv_bridge_end_round, ShiftDepth=0, isNameSet=False)
crv_long_edge_2_2 = EleFrontDataDescription(crv_long_edge_2, ShiftDepth=0, isNameSet=False)
crv_long_edge_1_2 = EleFrontDataDescription(crv_long_edge_1, ShiftDepth=0, isNameSet=False)

int_joint_outer_rad_3 = EleFrontDataDescription(int_joint_outer_rad, ShiftDepth=0, isNameSet=False)
trim_4 = TrimTree(Tree=crv_bridge_middle_round_2, Depth="2")
trim_5 = TrimTree(Tree=crv_bridge_end_round_2, Depth=1)
pt_joint_center_3 = EleFrontDataDescription(pt_joint_center, ShiftDepth=0, isNameSet=False)
panel_3 = Panel("crv;bottom_joint_inner_circle")
division = Division(A=int_joint_outer_rad_3, B=3)
multiplication_3 = Multiplication(A=division, B=Slider(1.6, range=0..10))
circle_2 = CircleCNR(Center=pt_joint_center_3, Normal=Vector(0, 0, 1), Radius=multiplication_3)  # -> simplify(Circle)
crv_outer_circles_3 = EleFrontDataDescription(simplify(crv_outer_circles), ShiftDepth=0, isNameSet=False)
merge_10 = Merge(Data1=crv_long_edge_1_2, Data2=crv_long_edge_2_2, Data3=trim_5, Data4=trim_4, Data5=circle_2)
split = SplitTree(Data=circle_2, Masks=flatten("{1;*}"))  # -> Positive, Negative
split_2 = SplitTree(Data=crv_outer_circles_3, Masks=flatten("{1;*}"))  # -> Positive, Negative
crv_bottom_joint_outer_circle = EleFrontDataDescription(split_2.Positive, ShiftDepth=0, isNameSet=True)
crv_bottom_joint_inner_circle = EleFrontDataDescription(split.Positive, ShiftDepth=0, isNameSet=True)
join = JoinCurves(Curves=merge_10, Preserve=False)
boundary = BoundarySurfaces(Edges=join)
srf = Surface(boundary)
int_bridge_thk_5 = EleFrontDataDescription(int_bridge_thk_2, ShiftDepth=0, isNameSet=False)
Z_4 = UnitZ(Factor=int_bridge_thk_5)
int_bridge_thk_6 = EleFrontDataDescription(int_bridge_thk_2, ShiftDepth=0, isNameSet=False)
crv_bottom_joint_outer_circle_2 = EleFrontDataDescription(crv_bottom_joint_outer_circle, ShiftDepth=0, isNameSet=False)
crv_bottom_joint_inner_circle_2 = EleFrontDataDescription(crv_bottom_joint_inner_circle, ShiftDepth=0, isNameSet=False)
extr_2 = Extrude(Base=boundary, Direction=Z_4)
multiplication_4 = Multiplication(A=int_bridge_thk_6, B=2)
sld_bridge_solid = EleFrontDataDescription(extr_2, ShiftDepth=0, isNameSet=True)
Z_5 = UnitZ(Factor=multiplication_4)
entwine_4 = Entwine(Branch0X=crv_bottom_joint_inner_circle_2, Branch1X=crv_bottom_joint_outer_circle_2, FlattenInputs=False)
move_4 = Move(Geometry=entwine_4, Motion=Z_5)  # -> Geometry, Transform
crv_moved_joint_top = EleFrontDataDescription(move_4.Geometry, ShiftDepth=0, isNameSet=True)
crv_moved_joint_top_2 = EleFrontDataDescription(crv_moved_joint_top, ShiftDepth=0, isNameSet=False)
int_jointheadthk_3 = EleFrontDataDescription(int_jointheadthk, ShiftDepth=0, isNameSet=False)
Z_6 = UnitZ(Factor=int_jointheadthk_3)
split_3 = SplitTree(Data=crv_moved_joint_top_2, Masks=flatten("{1;*}"))  # -> Positive, Negative
positive = EleFrontDataDescription(split_3.Positive, ShiftDepth=0, isNameSet=False)
crv_joint_inner_circle = EleFrontDataDescription(split_3.Negative, ShiftDepth=0, isNameSet=True)
positive_2 = EleFrontDataDescription(positive, ShiftDepth=0, isNameSet=False)
move_5 = Move(Geometry=positive_2, Motion=Z_6)  # -> Geometry, Transform
crv_head_base_circle = EleFrontDataDescription(move_5.Geometry, ShiftDepth=0, isNameSet=True)

crv_head_base_circle_2 = EleFrontDataDescription(crv_head_base_circle, ShiftDepth=0, isNameSet=False)
sld_bridge_solid_2 = EleFrontDataDescription(sld_bridge_solid, ShiftDepth=0, isNameSet=False)

sld_bridge_solid_3 = EleFrontDataDescription(sld_bridge_solid_2, ShiftDepth=0, isNameSet=False)
int_jointheadthk_4 = EleFrontDataDescription(int_jointheadthk, ShiftDepth=0, isNameSet=False)
boundary_2 = BoundarySurfaces(Edges=crv_head_base_circle_2)
neg_2 = Negative(Value=int_jointheadthk_4)
crv_joint_inner_circle_2 = EleFrontDataDescription(crv_joint_inner_circle, ShiftDepth=0, isNameSet=False)
Z_7 = UnitZ(Factor=neg_2)
extr_3 = Extrude(Base=boundary_2, Direction=Z_7)
darc = DeconstructArc(Arc=crv_joint_inner_circle_2)  # -> BasePlane, Radius, Angle
sld_nail_head = EleFrontDataDescription(extr_3, ShiftDepth=0, isNameSet=True)
int_bridge_thk_7 = EleFrontDataDescription(int_bridge_thk_2, ShiftDepth=0, isNameSet=False)
multiplication_5 = Multiplication(A=darc.Radius, B="0.8")
panel_4 = Panel(multiplication_5)
subtraction = Subtraction(A=multiplication_5, B=1)
cir_4 = Circle(Plane=darc.BasePlane, Radius=multiplication_5)
cir_5 = Circle(Plane=darc.BasePlane, Radius=subtraction)
graft_4 = GraftTree(Tree=darc.BasePlane, IncludeEmptyLists=True, IncludeNullItems=True)
panel_5 = Panel("""0.5
-0.5""")
xz = XZPlane(Origin=graft_4)
graft_5 = GraftTree(Tree=cir_4, IncludeEmptyLists=True, IncludeNullItems=True)
plane = EleFrontDataDescription(xz, ShiftDepth=0, isNameSet=False)
offset_2 = EleFrontDataDescription(panel_5, ShiftDepth=0, isNameSet=False)
pl_offset = PlaneOffset(BasePlane=plane, Offset=offset_2)
pl_offset_2 = PlaneOffset(BasePlane=plane, Offset=offset_2)
pln_nail_body_gap = EleFrontDataDescription(pl_offset_2, ShiftDepth=0, isNameSet=True)
pcx_2 = CurvePlane(Curve=graft_5, Plane=pl_offset)  # -> Points, ParamsC, ParamsP
trim_6 = TrimTree(Tree=pcx_2.ParamsC, Depth=1)
shatter_4 = Shatter(Curve=graft_5, Parameters=trim_6)
dispatch_5 = Dispatch(List=shatter_4, DispatchPattern=[True, False])  # -> ListA, ListB
crv_joint_nail_base_curve = EleFrontDataDescription(dispatch_5.ListA, ShiftDepth=0, isNameSet=True)
crv_joint_nail_base_curve_2 = EleFrontDataDescription(crv_joint_nail_base_curve, ShiftDepth=0, isNameSet=False)
end = EndPoints(Curve=crv_joint_nail_base_curve_2)  # -> Start, End
multiplication_6 = Multiplication(A=int_bridge_thk_7, B="2.3")
ln = Line(StartPoint=end.Start, EndPoint=end.End)
neg_3 = Negative(Value=multiplication_6)
crv_joint_inner_circle_3 = EleFrontDataDescription(crv_joint_inner_circle, ShiftDepth=0, isNameSet=False)
join_2 = JoinCurves(Curves=[crv_joint_nail_base_curve_2, ln], Preserve=False)
Z_8 = UnitZ(Factor=neg_3)
unit_vector = EleFrontDataDescription(Z_8, ShiftDepth=0, isNameSet=False)
curves = EleFrontDataDescription(join_2, ShiftDepth=0, isNameSet=False)
move_6 = Move(Geometry=darc.BasePlane, Motion=Z_8)  # -> Geometry, Transform
multiplication_7 = Multiplication(A=darc.Radius, B="1.03")
boundary_3 = BoundarySurfaces(Edges=curves)
pln_nail_body_gap_2 = EleFrontDataDescription(pln_nail_body_gap, ShiftDepth=0, isNameSet=False)
extr_4 = Extrude(Base=boundary_3, Direction=unit_vector)
cir_6 = Circle(Plane=move_6.Geometry, Radius=multiplication_7)
sld_nail_body = EleFrontDataDescription(simplify(extr_4), ShiftDepth=0, isNameSet=True)
graft_6 = GraftTree(Tree=cir_6, IncludeEmptyLists=True, IncludeNullItems=True)
pcx_3 = CurvePlane(Curve=graft_6, Plane=pln_nail_body_gap_2)  # -> Points, ParamsC, ParamsP
trim_7 = TrimTree(Tree=pcx_3.ParamsC, Depth=1)
shatter_5 = Shatter(Curve=graft_6, Parameters=trim_7)
dispatch_6 = Dispatch(List=shatter_5, DispatchPattern=[True, False])  # -> ListA, ListB
end_2 = EndPoints(Curve=dispatch_6.ListA)  # -> Start, End
ln_2 = Line(StartPoint=end_2.Start, EndPoint=end_2.End)
join_3 = JoinCurves(Curves=[dispatch_6.ListA, ln_2], Preserve=False)
crv_nail_cap_base_curve = EleFrontDataDescription(join_3, ShiftDepth=0, isNameSet=True)
crv_nail_cap_base_curve_2 = EleFrontDataDescription(crv_nail_cap_base_curve, ShiftDepth=0, isNameSet=False)
int_joint_cap_thk_2 = EleFrontDataDescription(int_joint_cap_thk, ShiftDepth=0, isNameSet=False)
neg_4 = Negative(Value=int_joint_cap_thk_2)
boundary_4 = BoundarySurfaces(Edges=crv_nail_cap_base_curve_2)
Z_9 = UnitZ(Factor=neg_4)
extr_5 = Extrude(Base=boundary_4, Direction=Z_9)  # -> simplify(Extrusion)
sld_nail_cap = EleFrontDataDescription(extr_5, ShiftDepth=0, isNameSet=True)

sld_nail_head_2 = EleFrontDataDescription(simplify(sld_nail_head), ShiftDepth=0, isNameSet=False)
sld_nail_body_2 = EleFrontDataDescription(sld_nail_body, ShiftDepth=0, isNameSet=False)
sld_nail_cap_2 = EleFrontDataDescription(sld_nail_cap, ShiftDepth=0, isNameSet=False)

graft_7 = GraftTree(Tree=sld_nail_head_2, IncludeEmptyLists=True, IncludeNullItems=True)
merge_11 = Merge(Data1=graft_7, Data2=sld_nail_body_2, Data3=sld_nail_cap_2)
sunion = SolidUnion(Breps=merge_11)

crv_bridge_base_crv_2 = EleFrontDataDescription(crv_bridge_base_crv, ShiftDepth=0, isNameSet=False)
srf_2 = Surface(boundary)
sld_bridge_solid_4 = EleFrontDataDescription(sld_bridge_solid_3, ShiftDepth=0, isNameSet=False)
sld_nail = EleFrontDataDescription(sunion, ShiftDepth=0, isNameSet=True)

item_10 = ListItem(List=crv_bridge_base_crv_2, Index=0, Wrap=True)
end_3 = EndPoints(Curve=item_10)  # -> Start, End
sld_bridge_solid_5 = EleFrontDataDescription(sld_bridge_solid_4, ShiftDepth=0, isNameSet=False)
sld_nail_2 = EleFrontDataDescription(sld_nail, ShiftDepth=0, isNameSet=False)
vec2pt = Vector2Pt(PointA=end_3.Start, PointB=end_3.End, Unitize=False)  # -> Vector, Length
X_2 = UnitX(Factor=1)
tstat_4 = TreeStatistics(Tree=sld_nail_2)  # -> Paths, Length, Count
flatten_2 = FlattenTree(Tree=sld_nail_2, Path="{0}")
int_bridge_division_number_3 = EleFrontDataDescription(int_bridge_division_number, ShiftDepth=0, isNameSet=False)
flatten_3 = FlattenTree(Tree=sld_bridge_solid_5, Path="{0}")
angle = Angle(VectorA=vec2pt.Vector, VectorB=X_2)  # -> Angle, Reflex
item_11 = ListItem(List=flatten_2, Index=0, Wrap=True)
item_12 = ListItem(List=flatten_3, Index=0, Wrap=True)
item_13 = ListItem(List=flatten(srf_2), Index=0, Wrap=True)
item_14 = ListItem(List=crv_bridge_base_crv_2, Index=0, Wrap=True)
yz = YZPlane(Origin=Point(0, 0, 0))
entwine_5 = Entwine(Branch00=angle.Angle, Branch01=angle.Angle, FlattenInputs=True)
rotate = Rotate(Geometry=item_11, Angle="Pi", Plane=yz)  # -> Geometry, Transform
tstat_5 = TreeStatistics(Tree=sld_bridge_solid_5)  # -> Paths, Length, Count
bbox = BoundingBox(Content=rotate.Geometry, Plane=PlaneXY(0, 0, 0))  # -> Box, Box_2
entwine_6 = Entwine(Branch00=item_12, Branch01=item_14, Branch02=item_13, FlattenInputs=True)
int_num_of_rows_2 = EleFrontDataDescription(int_num_of_rows, ShiftDepth=0, isNameSet=False)
area = Area(Geometry=bbox.Box)  # -> Area, Centroid
debox = DeconstructBox(Box=bbox.Box)  # -> Plane, X, Y, Z
division_2 = Division(A=tstat_5.Count, B=int_num_of_rows_2)
pdecon = Deconstruct(Point=area.Centroid)  # -> XComponent, YComponent, ZComponent
dedomain = DeconstructDomain(Domain=debox.Z)  # -> Start, End
rotate_2 = Rotate(Geometry=entwine_6, Angle=entwine_5, Plane=PlaneXY(0, 0, 0))  # -> Geometry, Transform
pt = ConstructPoint(XCoordinate=pdecon.XComponent, YCoordinate=pdecon.YComponent, ZCoordinate=dedomain.Start)
bbox_2 = BoundingBox(Content=rotate_2.Geometry, Plane=PlaneXY(0, 0, 0))  # -> Box, Box_2
dedomain_2 = DeconstructDomain(Domain=debox.X)  # -> Start, End
panel_6 = Panel(division_2)
round = Round(Number=division_2)  # -> Nearest, Floor, Ceiling
flatten_4 = FlattenTree(Tree=rotate_2.Geometry, Path="{0}")
subtraction_2 = Subtraction(A=dedomain_2.End, B=dedomain_2.Start)
flatten_5 = FlattenTree(Tree=bbox_2.Box, Path="{0}")
division_3 = Division(A=tstat_4.Count, B="3")
addition = Addition(A=subtraction_2, B=1)
item_15 = ListItem(List=flatten_5, Index="-1", Wrap=True)
item_16 = ListItem(List=flatten_4, Index="0", Wrap=True)
int_bridge_nesting_vertical_adj_2 = EleFrontDataDescription(int_bridge_nesting_vertical_adj, ShiftDepth=0, isNameSet=False)
sqgrid = Square(Plane="{500,0,0}", Size=addition, ExtentX=division_3, ExtentY="3")  # -> Cells, Points
area_2 = Area(Geometry=item_15)  # -> Area, Centroid
debox_2 = DeconstructBox(Box=item_15)  # -> Plane, X, Y, Z
area_3 = Area(Geometry=sqgrid.Cells)  # -> Area, Centroid
dedomain_3 = DeconstructDomain(Domain=debox_2.Y)  # -> Start, End
dedomain_4 = DeconstructDomain(Domain=debox_2.X)  # -> Start, End
subtraction_3 = Subtraction(A=dedomain_3.End, B=dedomain_3.Start)
subtraction_4 = Subtraction(A=dedomain_4.End, B=dedomain_4.Start)
vec2pt_2 = Vector2Pt(PointA=pt, PointB=area_3.Centroid, Unitize=False)  # -> Vector, Length
addition_2 = Addition(A=subtraction_4, B="1")
addition_3 = Addition(A=subtraction_3, B=int_bridge_nesting_vertical_adj_2)
move_7 = Move(Geometry=rotate.Geometry, Motion=vec2pt_2.Vector)  # -> Geometry, Transform
move_8 = Move(Geometry=rotate.Geometry, Motion=vec2pt_2.Vector)  # -> Geometry, Transform
recgrid = Rectangular(Plane="{500,100,0}", SizeX=addition_2, SizeY=addition_3, ExtentX=int_num_of_rows_2, ExtentY=round.Ceiling)  # -> Cells, Points
series = Series(Start=0, Step=1, Count=tstat_5.Count)
flatten_6 = FlattenTree(Tree=recgrid.Cells, Path="{0}")
item_17 = ListItem(List=flatten_6, Index=series, Wrap=True)
partition_2 = PartitionList(List=item_17, Size=round.Ceiling)
area_4 = Area(Geometry=partition_2)  # -> Area, Centroid
vec2pt_3 = Vector2Pt(PointA=area_2.Centroid, PointB=area_4.Centroid, Unitize=False)  # -> Vector, Length
sld_joint = EleFrontDataDescription(move_8.Geometry, ShiftDepth=0, isNameSet=True)
move_9 = Move(Geometry=item_16, Motion=vec2pt_3.Vector)  # -> Geometry, Transform
sld_bridge = EleFrontDataDescription(move_9.Geometry, ShiftDepth=0, isNameSet=True)

sld_bridge_2 = EleFrontDataDescription(sld_bridge, ShiftDepth=0, isNameSet=False)
sld_joint_2 = EleFrontDataDescription(sld_joint, ShiftDepth=0, isNameSet=False)
