# Grasshopper definition 04_radialfolding.gh (Grasshopper 1.0.8)
# plug-ins: eleFront

number_slider = Slider(21, range=0..200)
number_slider_2 = Slider(122, range=0..200)
subtraction = Subtraction(A=number_slider_2, B=number_slider)
X = UnitX(Factor=1)
pt = ConstructPoint(XCoordinate=number_slider, YCoordinate=0, ZCoordinate=0)

cir = Circle(Plane=PlaneXY(0, 0, 0), Radius=number_slider_2)
line = LineSDL(Start=pt, Direction=X, Length=subtraction)
cir_2 = Circle(Plane=PlaneXY(0, 0, 0), Radius=number_slider)

crv_inner_circle = EleFrontDataDescription(cir_2, ShiftDepth=0, isNameSet=True)
crv_outer_circle = EleFrontDataDescription(cir, ShiftDepth=0, isNameSet=True)
panel = Panel("2")
arrpolar = PolarArray(Geometry=line, Plane=PlaneXY(0, 0, 0), Count=Slider(12, range=4..30), Angle=6.283185307)  # -> Geometry, Transform
graft = GraftTree(Tree=arrpolar.Geometry, IncludeEmptyLists=True, IncludeNullItems=True)
crv_init_straight_line = EleFrontDataDescription(graft, ShiftDepth=0, isNameSet=False)
crv_init_straight_line_2 = EleFrontDataDescription(crv_init_straight_line, ShiftDepth=0, isNameSet=True)
merge = Merge(Data1=crv_init_straight_line_2, Data2=crv_init_straight_line_2)  # -> flatten(Result)
crv_base_radial_line = EleFrontDataDescription(merge, ShiftDepth=0, isNameSet=True)
crv_base_radial_line_2 = EleFrontDataDescription(crv_base_radial_line, ShiftDepth=0, isNameSet=False)
shift = ShiftList(List=crv_base_radial_line_2, Shift="-1", Wrap=True)
partition = PartitionList(List=shift, Size="2")
dash = DashPattern(Curve=partition, Pattern="2")  # -> simplify(Dashes), simplify(Gaps)
tstat = TreeStatistics(Tree=dash.Dashes)  # -> Paths, Length, Count
tstat_2 = TreeStatistics(Tree=dash.Dashes)  # -> Paths, Length, Count
dispatch = Dispatch(List=tstat.Paths, DispatchPattern=[True, False])  # -> ListA, ListB
dispatch_2 = Dispatch(List=tstat_2.Paths, DispatchPattern=[True, False])  # -> ListA, ListB
item = ListItem(List=tstat.Length, Index=0, Wrap=True)
item_2 = ListItem(List=tstat_2.Length, Index=0, Wrap=True)
branch = TreeBranch(Tree=dash.Dashes, Path=dispatch.ListB, MaintainPaths=True)
branch_2 = TreeBranch(Tree=dash.Dashes, Path=dispatch.ListA, MaintainPaths=True)
branch_3 = TreeBranch(Tree=dash.Dashes, Path=dispatch_2.ListA, MaintainPaths=True)
branch_4 = TreeBranch(Tree=dash.Dashes, Path=dispatch_2.ListB, MaintainPaths=True)
subtraction_2 = Subtraction(A=item, B=1)
subtraction_3 = Subtraction(A=item_2, B=1)
merge_2 = Merge(Data1="0", Data2=subtraction_2)  # -> flatten(Result)
merge_3 = Merge(Data1="0", Data2=subtraction_3)  # -> flatten(Result)
cull_i = CullIndex(List=branch, Indices="0", Wrap=True)
cull_i_2 = CullIndex(List=branch_2, Indices=merge_2, Wrap=True)
cull_i_3 = CullIndex(List=branch_4, Indices=merge_3, Wrap=True)
item_3 = ListItem(List=branch_2, Index=merge_2, Wrap=True)
item_4 = ListItem(List=branch_4, Index=merge_3, Wrap=True)
item_5 = ListItem(List=item_3, Index=0, Wrap=True)  # -> Item, Item1
item_6 = ListItem(List=item_4, Index=0, Wrap=True)  # -> Item, Item1
path_mapper = PathMapper(cull_i_2, source="{A;B;C}(i)", target="{A;B;i}")
path_mapper_2 = PathMapper(cull_i_3, source="{A;B;C}(i)", target="{A;B;i}")
merge_4 = Merge(Data1=path_mapper, Data2=path_mapper)
merge_5 = Merge(Data1=path_mapper_2, Data2=path_mapper_2)
trim = TrimTree(Tree=merge_4, Depth=1)
trim_2 = TrimTree(Tree=merge_5, Depth=1)
merge_6 = Merge(Data1=item_5.Item, Data2=trim, Data3=item_5.Item1)
merge_7 = Merge(Data1=item_6.Item, Data2=trim_2, Data3=item_6.Item1)
graft_2 = GraftTree(Tree=cull_i, IncludeEmptyLists=True, IncludeNullItems=True)  # -> simplify(Tree)
graft_3 = GraftTree(Tree=branch_3, IncludeEmptyLists=True, IncludeNullItems=True)  # -> simplify(Tree)
partition_2 = PartitionList(List=merge_6, Size="2")  # -> simplify(Chunks)
partition_3 = PartitionList(List=merge_7, Size="2")  # -> simplify(Chunks)
item_7 = ListItem(List=partition_2, Index=0, Wrap=True)  # -> Item, Item1
item_8 = ListItem(List=partition_3, Index=0, Wrap=True)  # -> Item, Item1
merge_8 = Merge(Data1=item_7.Item, Data2=graft_2, Data3=item_7.Item1)
merge_9 = Merge(Data1=item_8.Item, Data2=graft_3, Data3=item_8.Item1)
crv_dotted_curves_grouped = EleFrontDataDescription(merge_8, ShiftDepth=0, isNameSet=True)
crv_dotted_curves_grouped_2 = EleFrontDataDescription(merge_9, ShiftDepth=0, isNameSet=True)
crv_dotted_curves_grouped_3 = EleFrontDataDescription(crv_dotted_curves_grouped, ShiftDepth=0, isNameSet=False)
crv_dotted_curves_grouped_4 = EleFrontDataDescription(crv_dotted_curves_grouped_2, ShiftDepth=0, isNameSet=False)
midpt = CurveMiddle(Curve=crv_dotted_curves_grouped_3)
midpt_2 = CurveMiddle(Curve=crv_dotted_curves_grouped_4)
pline = PolyLine(Vertices=midpt, Closed=False)
pline_2 = PolyLine(Vertices=midpt_2, Closed=False)

trim_3 = TrimTree(Tree=pline_2, Depth=1)
trim_4 = TrimTree(Tree=pline, Depth=1)

flip = FlipMatrix(Data=trim_4)
shift_2 = ShiftList(List=flip, Shift=1, Wrap=True)
flip_2 = FlipMatrix(Data=shift_2)  # -> simplify(Data)
weave = Weave(Pattern=[0, 1], Stream0=trim_3, Stream1=flip_2, NullGaps=False)
partition_4 = PartitionList(List=weave, Size="2")
join = JoinCurves(Curves=partition_4, Preserve=False)  # -> simplify(Curves)
trim_5 = TrimTree(Tree=join, Depth=1)
offset = OffsetCurve(Curve=trim_5, Distance=Slider(-1, range=-10..0), Corners=1)
fillet = Fillet(Curve=offset, Radius=Slider(0.4, range=0..1))
crv_inner_pattern = EleFrontDataDescription(fillet, ShiftDepth=0, isNameSet=True)

crv_inner_pattern_2 = EleFrontDataDescription(crv_inner_pattern, ShiftDepth=0, isNameSet=False)
crv_outer_circle_2 = EleFrontDataDescription(crv_outer_circle, ShiftDepth=0, isNameSet=False)
crv_inner_circle_2 = EleFrontDataDescription(crv_inner_circle, ShiftDepth=0, isNameSet=False)

merge_10 = Merge(Data1=crv_inner_pattern_2, Data2=crv_outer_circle_2, Data3=crv_inner_circle_2)  # -> flatten(Result)
join_2 = JoinCurves(Curves=merge_10, Preserve=False)
boundary = BoundarySurfaces(Edges=join_2)
Z = UnitZ(Factor=Slider(0.5, range=0..1))
extr = Extrude(Base=boundary, Direction=Z)
