# Grasshopper definition 05_JointPoC.gh (Grasshopper 1.0.8)
# plug-ins: eleFront

sqgrid = Square(Plane=PlaneXY(0, 0, 0), Size="100", ExtentX="1", ExtentY="2")  # -> Cells, Points
item = ListItem(List=sqgrid.Cells, Index=0, Wrap=True)  # -> Item, Item1
explode = Explode(Curve=item.Item, Recursive=True)  # -> Segments, Vertices
explode_2 = Explode(Curve=item.Item1, Recursive=True)  # -> Segments, Vertices
item_2 = ListItem(List=explode.Vertices, Index=0, Wrap=True)  # -> Item3, Item2, Item1, Item
item_3 = ListItem(List=explode_2.Vertices, Index=0, Wrap=True)  # -> Item, Item1
item_4 = ListItem(List=explode.Segments, Index=0, Wrap=True)
item_5 = ListItem(List=explode_2.Segments, Index=0, Wrap=True)  # -> Item, Item1, Item2
midpt = CurveMiddle(Curve=item_4)
midpt_2 = CurveMiddle(Curve=item_5.Item2)
merge = Merge(Data1=midpt, Data2=item_2.Item3, Data3=item_2.Item2)
merge_2 = Merge(Data1=midpt_2, Data2=item_3.Item, Data3=item_3.Item1)
pline = PolyLine(Vertices=merge, Closed=invert(False))
pline_2 = PolyLine(Vertices=merge_2, Closed=invert(False))

offset = OffsetCurve(Curve=pline_2, Distance="-4", Corners=1)
offset_2 = OffsetCurve(Curve=pline, Distance="-4", Corners=1)

crv_bottom_triangle = EleFrontDataDescription(offset_2, ShiftDepth=0, isNameSet=True)
crv_top_triangle = EleFrontDataDescription(offset, ShiftDepth=0, isNameSet=True)
crv_bottom_triangle_2 = EleFrontDataDescription(crv_bottom_triangle, ShiftDepth=0, isNameSet=False)
crv_top_triangle_2 = EleFrontDataDescription(crv_top_triangle, ShiftDepth=0, isNameSet=False)
explode_3 = Explode(Curve=crv_bottom_triangle_2, Recursive=True)  # -> Segments, Vertices
item_6 = ListItem(List=explode_3.Segments, Index=0, Wrap=True)  # -> Item, Item1
panel = Panel("""0.2
0.5
0.8""")
eval = EvaluateCurve(Curve=reparameterize(item_6.Item1), Parameter=panel)  # -> Point, Tangent, Angle
crv_cp = CurveClosestPoint(Point=eval.Point, Curve=crv_top_triangle_2)  # -> Point, Parameter, Distance
vec2pt = Vector2Pt(PointA=eval.Point, PointB=crv_cp.Point, Unitize=False)  # -> Vector, Length
gap = Panel("1")
addition = Addition(A=crv_cp.Distance, B="-2")
item_7 = ListItem(List=addition, Index=0, Wrap=True)
line = LineSDL(Start=eval.Point, Direction=vec2pt.Vector, Length=addition)
num_panel_to_joint_end = EleFrontDataDescription(item_7, ShiftDepth=0, isNameSet=True)
X = UnitX(Factor=gap)
rev = Reverse(Vector=X)
merge_3 = Merge(Data1=X, Data2=rev)
graft = GraftTree(Tree=line, IncludeEmptyLists=True, IncludeNullItems=True)
move = Move(Geometry=graft, Motion=merge_3)  # -> Geometry, Transform
jointthk = Panel("5")
X_2 = UnitX(Factor=jointthk)
rev_2 = Reverse(Vector=X_2)
crv_bottom_triangle_3 = EleFrontDataDescription(crv_bottom_triangle_2, ShiftDepth=0, isNameSet=False)
vec = Vector([X_2, rev_2])
move_2 = Move(Geometry=move.Geometry, Motion=vec)  # -> Geometry, Transform
flip = FlipCurve(Curve=move_2.Geometry)  # -> Curve, Flag
crv_bottom_triangle_4 = EleFrontDataDescription(crv_bottom_triangle_3, ShiftDepth=0, isNameSet=False)
merge_4 = Merge(Data1=move.Geometry, Data2=flip.Curve)
end = EndPoints(Curve=merge_4)  # -> Start, End
partition = PartitionList(List=merge_4, Size="2")  # -> simplify(Chunks)
crv_cp_2 = CurveClosestPoint(Point=end.Start, Curve=crv_bottom_triangle_4)  # -> Point, Parameter, Distance
trim = TrimTree(Tree=partition, Depth=1)
shatter = Shatter(Curve=crv_bottom_triangle_4, Parameters=flatten(crv_cp_2.Parameter))
item_8 = ListItem(List=trim, Index=0, Wrap=True)  # -> Item, Item1, Item2, Item3
dispatch = Dispatch(List=shatter, DispatchPattern=[True, False])  # -> ListA, ListB
crv_shatterd_triagle = EleFrontDataDescription(dispatch.ListB, ShiftDepth=0, isNameSet=True)
merge_5 = Merge(Data1=item_8.Item3, Data2=item_8.Item1, Data3=item_8.Item, Data4=item_8.Item2)
partition_2 = PartitionList(List=merge_5, Size="2")
connect = ConnectCurves(Curves=partition_2, Continuity=0, Close=True, Bulge=1)
explode_4 = Explode(Curve=connect, Recursive=True)  # -> Segments, Vertices
midpt_3 = CurveMiddle(Curve=explode_4.Segments)
avr = Average(Input=midpt_3)
circle = CircleCNR(Center=avr, Normal=Vector(0, 0, 1), Radius=1)
alongcrv = SortAlongCurve(Points=midpt_3, Curve=circle)  # -> Points, Indices
item_9 = ListItem(List=explode_4.Segments, Index=alongcrv.Indices, Wrap=True)
cull_i = CullIndex(List=item_9, Indices="3", Wrap=True)
crv_shatterd_triagle_2 = EleFrontDataDescription(crv_shatterd_triagle, ShiftDepth=0, isNameSet=False)
join = JoinCurves(Curves=cull_i, Preserve=False)
curves = EleFrontDataDescription(join, ShiftDepth=0, isNameSet=False)
curves_2 = EleFrontDataDescription(curves, ShiftDepth=0, isNameSet=False)
curves_3 = EleFrontDataDescription(curves_2, ShiftDepth=0, isNameSet=False)
int_panelthk = EleFrontDataDescription(Slider(3, range=1..20), ShiftDepth=0, isNameSet=True)
join_2 = JoinCurves(Curves=flatten([crv_shatterd_triagle_2, curves_3]), Preserve=False)
int_panelthk_2 = EleFrontDataDescription(int_panelthk, ShiftDepth=0, isNameSet=False)
crv_plate_base = EleFrontDataDescription(join_2, ShiftDepth=0, isNameSet=True)
curves_4 = EleFrontDataDescription(curves_3, ShiftDepth=0, isNameSet=False)
Z = UnitZ(Factor=int_panelthk_2)
move_3 = Move(Geometry=curves_4, Motion=Z)  # -> Geometry, Transform
explode_5 = Explode(Curve=move_3.Geometry, Recursive=True)  # -> Segments, Vertices
explode_6 = Explode(Curve=curves_4, Recursive=True)  # -> Segments, Vertices
item_10 = ListItem(List=explode_5.Segments, Index="1", Wrap=True)
item_11 = ListItem(List=explode_6.Segments, Index="1", Wrap=True)
line_panelendextrusion = EleFrontDataDescription(item_10, ShiftDepth=0, isNameSet=True)
line_panelendextrusion_2 = EleFrontDataDescription(line_panelendextrusion, ShiftDepth=0, isNameSet=False)
end_2 = EndPoints(Curve=item_11)  # -> Start, End
end_3 = EndPoints(Curve=line_panelendextrusion_2)  # -> Start, End
ln = Line(StartPoint=end_2.Start, EndPoint=end_3.Start)
midpt_4 = CurveMiddle(Curve=ln)
X_3 = UnitX(Factor=1)
division = Division(A=int_panelthk_2, B="4")
yz = YZPlane(Origin=midpt_4)
division_2 = Division(A=int_panelthk_2, B="2")
circle_2 = CircleCNR(Center=midpt_4, Normal=X_3, Radius=division)  # -> simplify(Circle)
arc = Arc(Plane=yz, Radius=division_2, Angle="3*Pi/2 To 5*Pi/2")  # -> Arc, Length
end_4 = EndPoints(Curve=arc.Arc)  # -> Start, End
num_panel_to_joint_end_2 = EleFrontDataDescription(num_panel_to_joint_end, ShiftDepth=0, isNameSet=False)
Y = UnitY(Factor=1)
neg = Negative(Value=num_panel_to_joint_end_2)
line_2 = LineSDL(Start=[end_4.Start, end_4.End], Direction=Y, Length=neg)
join_3 = JoinCurves(Curves=[line_2, arc.Arc], Preserve=False)
connect_2 = ConnectCurves(Curves=join_3, Continuity=0, Close=True, Bulge=1)  # -> simplify(Curve)
join_4 = JoinCurves(Curves=[circle_2, connect_2], Preserve=False)
line_panelendextrusion_3 = EleFrontDataDescription(line_panelendextrusion, ShiftDepth=0, isNameSet=False)
crv_bottom_triangle_5 = EleFrontDataDescription(crv_bottom_triangle, ShiftDepth=0, isNameSet=False)
int_panelthk_3 = EleFrontDataDescription(int_panelthk, ShiftDepth=0, isNameSet=False)
boundary = BoundarySurfaces(Edges=join_4)
boundary_2 = BoundarySurfaces(Edges=crv_bottom_triangle_5)
Z_2 = UnitZ(Factor=int_panelthk_3)
extrcrv = ExtrudeAlong(Base=boundary, Curve=line_panelendextrusion_3)
extr = Extrude(Base=boundary_2, Direction=Z_2)
sunion = SolidUnion(Breps=flatten([extrcrv, extr]))
