# Grasshopper definition 06_TriagleJoint.gh (Grasshopper 1.0.8)
# plug-ins: eleFront

panel = Panel("crv;right_on_rounded")
neg = Negative(Value="300")
dom = ConstructDomain(DomainStart=neg, DomainEnd="300")
rectangle = Rectangle(Plane=PlaneXY(0, 0, 0), XSize=dom, YSize=dom, Radius=0)  # -> Rectangle, Length
explode = Explode(Curve=rectangle.Rectangle, Recursive=True)  # -> Segments, Vertices
area = Area(Geometry=rectangle.Rectangle)  # -> Area, Centroid
cull_i = CullIndex(List=explode.Vertices, Indices="-1", Wrap=True)
cull_i_2 = CullIndex(List=explode.Vertices, Indices="0", Wrap=True)
entwine = Entwine(Branch00=cull_i, Branch01=cull_i_2, FlattenInputs=True)
flip = FlipMatrix(Data=entwine)
ins = InsertItems(List=flip, Item=area.Centroid, Indices="2", Wrap=True)
pline = PolyLine(Vertices=ins, Closed=invert(False))
explode_2 = Explode(Curve=pline, Recursive=True)  # -> Segments, Vertices
offset = OffsetCurve(Curve=pline, Distance=Slider(-9, range=-100..0), Corners=1)
fillet = Fillet(Curve=offset, Radius=Slider(27, range=0..100))
explode_3 = Explode(Curve=fillet, Recursive=True)  # -> Segments, Vertices
dispatch = Dispatch(List=explode_3.Segments, DispatchPattern=[True, False])  # -> ListA, ListB
boundary = BoundarySurfaces(Edges=fillet)
int_panelthk = EleFrontDataDescription(Slider(6, range=1..10), ShiftDepth=0, isNameSet=True)
int_panelthk_2 = EleFrontDataDescription(int_panelthk, ShiftDepth=0, isNameSet=False)
Z = UnitZ(Factor=int_panelthk_2)
item = ListItem(List=dispatch.ListB, Index=0, Wrap=True)  # -> Item, Item1
item_2 = ListItem(List=explode_2.Segments, Index=0, Wrap=True)  # -> Item, Item1
extr = Extrude(Base=boundary, Direction=Z)
crv_bottom_on_rounded = EleFrontDataDescription(item.Item, ShiftDepth=0, isNameSet=True)
crv_right_on_rounded = EleFrontDataDescription(item.Item1, ShiftDepth=0, isNameSet=True)
crv_bottom = EleFrontDataDescription(item_2.Item, ShiftDepth=0, isNameSet=True)
crv_right = EleFrontDataDescription(item_2.Item1, ShiftDepth=0, isNameSet=True)

crv_bottom_on_rounded_2 = EleFrontDataDescription(crv_bottom_on_rounded, ShiftDepth=0, isNameSet=False)
crv_right_on_rounded_2 = EleFrontDataDescription(crv_right_on_rounded, ShiftDepth=0, isNameSet=False)
crv_bottom_2 = EleFrontDataDescription(crv_bottom, ShiftDepth=0, isNameSet=False)
crv_right_2 = EleFrontDataDescription(crv_right, ShiftDepth=0, isNameSet=True)

midpt = CurveMiddle(Curve=crv_right_on_rounded_2)
crv_cp = CurveClosestPoint(Point=midpt, Curve=crv_right_2)  # -> Point, Parameter, Distance
division = Division(A=Z, B=2)
vec2pt = Vector2Pt(PointA=midpt, PointB=crv_cp.Point, Unitize=False)  # -> Vector, Length
move = Move(Geometry=crv_right_on_rounded_2, Motion=vec2pt.Vector)  # -> Geometry, Transform
matrix = ConstructMatrix(Rows=3, Columns=3)
int_panelthk_3 = EleFrontDataDescription(int_panelthk, ShiftDepth=0, isNameSet=False)
multiplication = Multiplication(A=division, B=vec2pt.Vector)
move_2 = Move(Geometry=move.Geometry, Motion=division)  # -> Geometry, Transform
division_2 = Division(A=int_panelthk_3, B="2")
int_panelthk_4 = EleFrontDataDescription(int_panelthk, ShiftDepth=0, isNameSet=False)
move_3 = Move(Geometry=crv_right_on_rounded_2, Motion=division)  # -> Geometry, Transform
crv_connector_center = EleFrontDataDescription(move_2.Geometry, ShiftDepth=0, isNameSet=True)
division_3 = Division(A=int_panelthk_4, B=Slider(5, range=1..10))
transform = EleFrontDataDescription(move_2.Transform, ShiftDepth=0, isNameSet=False)
crv_connector_center_2 = EleFrontDataDescription(crv_connector_center, ShiftDepth=0, isNameSet=False)
transform_2 = EleFrontDataDescription(transform, ShiftDepth=0, isNameSet=False)
neg_2 = Negative(Value=division_3)
addition = Addition(A=division_2, B=1)
merge = Merge(Data1=division_3, Data2=neg_2)
line = Line(crv_connector_center_2)
pframe = PerpFrame(Curve=reparameterize(crv_connector_center_2), Parameter="0")
Z_2 = UnitZ(Factor=merge)
crv_connector_center_3 = EleFrontDataDescription(crv_connector_center, ShiftDepth=0, isNameSet=False)
cir = Circle(Plane=pframe, Radius=addition)
cir_2 = Circle(Plane=pframe, Radius=division_2)
move_4 = Move(Geometry=move_3.Geometry, Motion=Z_2)  # -> Geometry, Transform
merge_2 = Merge(Data1=cir_2, Data2=cir)
midpt_2 = CurveMiddle(Curve=move_4.Geometry)
boundary_2 = BoundarySurfaces(Edges=merge_2)
crv_cp_2 = CurveClosestPoint(Point=midpt_2, Curve=crv_connector_center_3)  # -> Point, Parameter, Distance
extr_2 = Extrude(Base=boundary_2, Direction=line)
vec2pt_2 = Vector2Pt(PointA=midpt_2, PointB=crv_cp_2.Point, Unitize=False)  # -> Vector, Length
devec = DeconstructVector(Vector=vec2pt_2.Vector)  # -> XComponent, YComponent, ZComponent
vec = VectorXYZ(XComponent=devec.XComponent, YComponent=devec.YComponent, ZComponent=0)  # -> Vector, Length
extr_3 = Extrude(Base=move_4.Geometry, Direction=vec.Vector)
